# Grasshopper definition shape_abc_1.gh (Grasshopper 1.0.7)
# plug-ins: Axolotl Info, Weaverbird, Pufferfish

number_slider = Slider(500, range=0..1000)
number_slider_2 = Slider(5, range=0..1000)
number_slider_3 = Slider(800, range=0..1000)
number_slider_4 = Slider(150, range=0..1000)
number_slider_5 = Slider(20, range=0..100)
python = GhPythonScript(top_box_side=number_slider, side_w=Slider(100, range=0..1000), side_h=number_slider_4, extra_b_h=number_slider_2)  # -> out, pd, bx
# ---------- python: Python ----------
# import scripts externally, relative folder
import sys
import os

import Grasshopper

path=os.path.dirname(Grasshopper.Instances.ActiveCanvas.Document.FilePath)
sys.path.append(path)

import volume as vlm
reload(vlm)

pd, bx = vlm.pedistle_with_tolerance(top_box_side, side_w, side_h, extra_b_h)

print(vlm.print_mesh(pd))
print(vlm.print_mesh(bx))
# ---------- end python ----------
Z = UnitZ(Factor=number_slider_3)
addition = Addition(A=number_slider_2, B=number_slider_3)
python_2 = GhPythonScript(
    top_box_side=Slider(500, range=0..1000),
    side_w=Slider(100, range=0..1000),
    side_h=Slider(150, range=0..1000),
    extra_b_h=Slider(5, range=0..1000),
    top_shift=number_slider_5)  # -> out, pd, bx
# ---------- python_2: Python ----------
# import scripts externally, relative folder
import sys
import os

import Grasshopper

path=os.path.dirname(Grasshopper.Instances.ActiveCanvas.Document.FilePath)
sys.path.append(path)

import volume as vlm
reload(vlm)

pd, bx = vlm.pedistle_with_tolerance(top_box_side, side_w, side_h, extra_b_h, top_shift)

print(vlm.print_mesh(pd))
print(vlm.print_mesh(bx))
# ---------- end python_2 ----------
addition_2 = Addition(A=number_slider, B=number_slider_4, C=number_slider_2)
neg = Negative(Value=addition)
move = Move(Geometry=python_2.pd, Motion=Z)  # -> Geometry, Transform
move_2 = Move(Geometry=python.pd, Motion=Z)  # -> Geometry, Transform
move_3 = Move(Geometry=python.bx, Motion=Z)  # -> Geometry, Transform
flipm = FlipMesh(Mesh=move.Geometry, VertexNormals=True, FaceNormals=True, FaceOrientation=True)
flipm_2 = FlipMesh(Mesh=move_2.Geometry, VertexNormals=True, FaceNormals=True, FaceOrientation=True)
flipm_3 = FlipMesh(Mesh=move_3.Geometry, VertexNormals=True, FaceNormals=True, FaceOrientation=True)
mesh = Mesh(flipm_2)
mesh_2 = Mesh(flipm_3)
mesh_3 = Mesh(flipm)
mint = MeshIntersection(MeshesA=mesh, MeshesB=mesh_2)
half_height = Number(expr("x*.5", addition_2))
wbsplitquads = WeaverbirdsConstantQuadsSplitSubdivision(MeshCurves=mesh_3, Level=Slider(3, range=1..3), SmoothNakedEdges=1)
wbsplitquads_2 = WeaverbirdsConstantQuadsSplitSubdivision(MeshCurves=mesh, Level=Slider(3, range=1..3), SmoothNakedEdges=1)
addition_3 = Addition(A=number_slider_3, B=half_height)
Z_2 = UnitZ(Factor=addition)
xy = XYPlane(Origin=Z_2)
wbcatmullclark = WeaverbirdsCatmullClarkSubdivision(MeshCurves=wbsplitquads, Level=Slider(1, range=1..3), SmoothNakedEdges=1)
wbcatmullclark_2 = WeaverbirdsCatmullClarkSubdivision(MeshCurves=wbsplitquads_2, Level=Slider(1, range=1..3), SmoothNakedEdges=1)
pln = Plane(xy)
mesh_4 = Mesh(wbcatmullclark_2)
mesh_5 = Mesh(mesh_4)
cut_mesh_at_height = GhPythonScript(msh=mesh_4, height=addition)  # -> out, n_msh, booleans; inputs msh: Mesh
# ---------- cut_mesh_at_height: Python ----------
from Rhino.Geometry import Mesh, Point3d

pts = []
booleans = []
f_list = []
special_f_list = []

for i, v in enumerate(msh.Vertices):
    loc_pt = Point3d(v)
    booleans.append(loc_pt.Z >= height)
    pts.append(loc_pt)
    
for f in msh.Faces:
    loc_f = []
    is_true = 0
    
    for v_i in f:
        loc_f.append(v_i)
        if booleans[v_i]:
            is_true += 1
            
    if is_true == 4:
        f_list.append(loc_f)
        
    elif is_true == 2:
        special_f_list.append(loc_f)
        f_list.append(loc_f)
        
# fixing the special faces
def face_fix(f):
    global pts, booleans, height
    
    real_pts = []
    false_pts = []
    
    loc_pts = [Point3d(pts[v_i].X, pts[v_i].Y, 0.) for v_i in f]
    
    for i, v_i in enumerate(f):
        if booleans[v_i]:
            real_pts.append( [i, v_i] )
        else:
            false_pts.append( [i, v_i] )
            
    for i, v_i in real_pts:
        distance = 100.
        d_i = -1
        for j, v_j in false_pts:
            d = loc_pts[j].DistanceTo(loc_pts[j])
            if d < distance:
                distance = d
                d_i = v_j
                
        pts[d_i].X = loc_pts[i].X
        pts[d_i].Y = loc_pts[i].Y
        pts[d_i].Z = height
    
    """
    # setting booleans to true
    for v_i in f:
        booleans[v_i] = True
    """

for f in special_f_list:
    face_fix(f)

"""
# reducing the points and face indexes we don't need
n_v_list = []
n_f_list = []
v_map = {}

for i, boolean in enumerate(booleans):
    if boolean:
        v_map[i]=len(n_v_list)
        n_v_list.append(pts[i])
        
print(v_map[100])

n_f_list = []
for f in f_list:
    loc_f_list = []
    try:
        for v_i in f:
            loc_f_list.append(v_map[v_i])
        n_f_list.append(loc_f_list)
    except:
        pass
"""

n_msh = Mesh()
for pt in pts:
    n_msh.Vertices.Add(pt)
    
for f in f_list:
    a,b,c,d = f
    n_msh.Faces.AddFace(a,b,c,d)
# ---------- end cut_mesh_at_height ----------
sec = MeshPlane(Mesh=mesh_5, Plane=xy)
divide = DivideCurve(Curve=sec, Count=1, Kinks=True)  # -> Points, Tangents, Parameters
panel = Panel(cut_mesh_at_height.out)
ma = MassAddition(Input=divide.Points)  # -> Result, PartialResults
shift = ShiftList(List=divide.Points, Shift=1, Wrap=True)
lng = ListLength(List=divide.Points)
mesh_6 = Mesh(cut_mesh_at_height.n_msh)
mesh_7 = Mesh(wbcatmullclark)
mesh_8 = Mesh(mesh_5)
division = Division(A=ma.Result, B=lng)
ln = Line(StartPoint=divide.Points, EndPoint=shift)
ln_2 = Line(StartPoint=division, EndPoint=divide.Points)
merge = Merge(Data1=ln_2, Data2=ln)  # -> flatten(Result)
wbweave = WeaverbirdsMeshFromLinesWeaveBack(Lines=merge, MaximumValence=4)
wbcatmullclark_3 = WeaverbirdsCatmullClarkSubdivision(MeshCurves=mesh_6, Level=Slider(1, range=0..10), SmoothNakedEdges=1)
mesh_9 = Mesh(mesh_6)

# ---- group: sub-structure
tpms = TPMS(Wavelength=Slider(524.842, range=0..5000))
division_2 = Division(A=1, B=Slider(3, range=0..10))
mult = Mult(DistanceObject=tpms, Factor=division_2)
add = Add(DistanceObject=mult, Addend=Slider(1, range=0..1))
neg_2 = Negative(Value=Slider(15, range=0..200))
mult_2 = Mult(DistanceObject=mult, Factor=neg_2)
tpms_distance_object_modifier = TPMSD(Wavelength=Slider(100, range=0..1000), Modulator=mult_2)
mult_3 = Mult(DistanceObject=tpms_distance_object_modifier, Factor=Slider(15, range=0..200))

# ----
merge_2 = Merge(Data1=mesh_6, Data2=wbweave)  # -> flatten(Result)
Z_3 = UnitZ(Factor=addition_3)
mesh_10 = Mesh(mesh_6)
number_slider_6 = Slider(0, range=0..10)
medges = MeshEdges(Mesh=wbcatmullclark_3)  # -> NakedEdges, InteriorEdges, NonManifoldEdges
mjoin = MeshJoin(Meshes=merge_2)
pi = Pi(Factor=number_slider_6)
mesh_11 = Mesh(mesh_8)
clsmsh = CloseMesh(Mesh=mesh_10, Quadrangulate=True)  # -> Closed, Amount, Openings, R
weld = WeldMesh(Mesh=mjoin, Angle=pi)
xy_2 = XYPlane(Origin=Z_3)
top_shift = Number(number_slider_5)
distance_wrapper = DistanceWrapper(Geometry=clsmsh.Closed)
distance_wrapper_2 = DistanceWrapper(Geometry=mesh_7)
boolean_intersect = BooleanIntersect(DistanceObjectS=distance_wrapper, DistanceObject=tpms_distance_object_modifier)
tpms_2 = TPMS(Wavelength=Slider(10, range=0..25))
number_slider_7 = Slider(1000, range=0..1000)
multiplication = Multiplication(A=number_slider_7, B=0.5)
neg_3 = Negative(Value=multiplication)
dom = ConstructDomain(DomainStart=neg_3, DomainEnd=multiplication)
box = DomainBox(Base=xy_2, X=dom, Y=dom, Z=dom)
number_slider_8 = Slider(200, range=0..1000)
number_slider_9 = Slider(200, range=0..1000)
mult_4 = Mult(DistanceObject=tpms_2, Factor=Slider(7.5, range=0..100))
smoothunion = SmoothUnion(DistanceObject=distance_wrapper_2, DistanceObject_2=boolean_intersect, Radius=number_slider_6)
meshbumpminmax = MeshBumpMinMax(D=mult_3, M=wbcatmullclark_3, min=Slider(-15, range=-25..25), max=Slider(0, range=-25..25))
isosurface_distancefunction = IsosurfaceDistancefunction(
    BoundingBox=box,
    NumberX=number_slider_9,
    NumberY=number_slider_9,
    NumberZ=number_slider_9,
    Isovalue=0,
    Capped=True,
    DistanceObject=smoothunion,
    Refine=True)
meshbump = MeshBump(D=tpms_distance_object_modifier, M=mesh_9)
Z_4 = UnitZ(Factor=neg)
pln_2 = Plane(pln)
wbcatmullclark_4 = WeaverbirdsCatmullClarkSubdivision(MeshCurves=wbcatmullclark_3, Level=Slider(3, range=0..10), SmoothNakedEdges=1)
wbcatmullclark_5 = WeaverbirdsCatmullClarkSubdivision(MeshCurves=isosurface_distancefunction, Level=Slider(1, range=0..10), SmoothNakedEdges=1)
plane = Plane(Origin=Z_2, Normal=Vector(0, 0, 1))
add_2 = Add(DistanceObject=plane, Addend=Slider(800, range=-1000..1000))
smoothunion_2 = SmoothUnion(DistanceObject=add_2, DistanceObject_2=tpms_distance_object_modifier, Radius=Slider(1000, range=0..1000))
boolean_intersect_2 = BooleanIntersect(DistanceObjectS=distance_wrapper, DistanceObject=smoothunion_2)
isosurface_octree = IsosurfaceOctree(
    Origin=Z_3,
    WorldSize=number_slider_7,
    Isovalue=0,
    Subdivisions=Slider(5, range=0..10),
    DistanceObject=boolean_intersect_2)
isosurface_distancefunction_2 = IsosurfaceDistancefunction(
    BoundingBox=box,
    NumberX=number_slider_8,
    NumberY=number_slider_8,
    NumberZ=number_slider_8,
    Isovalue=0,
    Capped=True,
    DistanceObject=boolean_intersect_2,
    Refine=True)
wbcatmullclark_6 = WeaverbirdsCatmullClarkSubdivision(MeshCurves=isosurface_distancefunction_2, Level=Slider(1, range=0..10), SmoothNakedEdges=1)
mult_5 = Mult(DistanceObject=mult_3, Factor=-1)
meshbumpminmax_2 = MeshBumpMinMax_2(
    D_2=mult_5,
    M=wbcatmullclark_3,
    min=Slider(-25, range=-25..25),
    max=Slider(0, range=-25..25),
    D=plane,
    B=Slider(100, range=0..250))
wbcatmullclark_7 = WeaverbirdsCatmullClarkSubdivision(MeshCurves=meshbumpminmax_2, Level=Slider(3, range=0..10), SmoothNakedEdges=1)
move_4 = Move(Geometry=wbcatmullclark_7, Motion=Z_4)  # -> Geometry, Transform
mshclsd = IsMeshClosed(Mesh=isosurface_octree)
move_5 = Move(Geometry=isosurface_octree, Motion=Z_4)  # -> Geometry, Transform

# ---- group: currogation
tpms_3 = TPMS(Wavelength=Slider(200, range=0..5000))
division_3 = Division(A=1, B=Slider(3, range=0..10))
mult_6 = Mult(DistanceObject=tpms_3, Factor=division_3)
tpms_distance_object_modifier_2 = TPMSD(Wavelength=Slider(15, range=0..1000), Modulator=mult_6)

# ----
add_3 = Add(DistanceObject=tpms_distance_object_modifier_2, Addend=Slider(0.5, range=0..1))

# ---- group: currogation (continued)
mult_7 = Mult(DistanceObject=add_3, Factor=Slider(2.5, range=0..200))

# ----
meshbump_2 = MeshBump(D=mult_7, M=wbcatmullclark_6)
meshbump_3 = MeshBump(D=mult_7, M=wbcatmullclark_5)
meshbump_4 = MeshBump(D=mult_7, M=wbcatmullclark_4)
meshbump_5 = MeshBump(D=mult_7, M=wbcatmullclark_7)
clsmsh_2 = CloseMesh(Mesh=meshbump_4, Quadrangulate=True)  # -> Closed, Amount, Openings, R
clsmsh_3 = CloseMesh(Mesh=meshbump_5, Quadrangulate=True)  # -> Closed, Amount, Openings, R
move_6 = Move(Geometry=meshbump_3, Motion=Z_4)  # -> Geometry, Transform
move_7 = Move(Geometry=clsmsh_3.Closed, Motion=Z_4)  # -> Geometry, Transform
move_8 = Move(Geometry=meshbump_2, Motion=Z_4)  # -> Geometry, Transform
move_9 = Move(Geometry=clsmsh_2.Closed, Motion=Z_4)  # -> Geometry, Transform
preview = CustomPreview(Geometry=move_6.Geometry, Material=ColourSwatch(SwatchColor=RGB(232, 229, 193)))

# ==== cluster MeshBump
M = ClusterInput()
demesh = DeconstructMesh(Mesh=M)  # -> Vertices, Faces, Colours, Normals
vec = Vector(demesh.Normals)
D = ClusterInput()
evaluatepoints = EvaluatePoints(DistanceObject=D, Points=demesh.Vertices)
multiplication = Multiplication(A=evaluatepoints, B=vec)
addition = Addition(A=demesh.Vertices, B=multiplication)
conmesh = ConstructMesh(Vertices=addition, Faces=demesh.Faces)
M_2 = ClusterOutput(conmesh)

# ==== cluster MeshBumpMinMax
M = ClusterInput()
demesh = DeconstructMesh(Mesh=M)  # -> Vertices, Faces, Colours, Normals
max = ClusterInput()
min = ClusterInput()
vec = Vector(demesh.Normals)
max_2 = Number(max)
min_2 = Number(min)
D = ClusterInput()
evaluatepoints = EvaluatePoints(DistanceObject=D, Points=demesh.Vertices)
multiplication = Multiplication(A=evaluatepoints, B=0)
addition = Addition(A=multiplication, B=min_2)
addition_2 = Addition(A=multiplication, B=max_2)
larger = LargerThan(FirstNumber=evaluatepoints, SecondNumber=max_2)  # -> graft(LargerThan), OrEqualTo
smaller = SmallerThan(FirstNumber=evaluatepoints, SecondNumber=min_2)  # -> graft(SmallerThan), OrEqualTo
merge = Merge(Data1=graft(evaluatepoints), Data2=graft(addition))
item = ListItem(List=merge, Index=smaller.SmallerThan, Wrap=True)
merge_2 = Merge(Data1=item, Data2=graft(addition_2))
item_2 = ListItem(List=merge_2, Index=larger.LargerThan, Wrap=True)  # -> flatten(Item)
multiplication_2 = Multiplication(A=item_2, B=vec)
addition_3 = Addition(A=demesh.Vertices, B=multiplication_2)
conmesh = ConstructMesh(Vertices=addition_3, Faces=demesh.Faces)
M_2 = ClusterOutput(conmesh)

# ==== cluster MeshBumpMinMax_2
M = ClusterInput()
B = ClusterInput()
D = ClusterInput()
demesh = DeconstructMesh(Mesh=M)  # -> Vertices, Faces, Colours, Normals
division = Division(A=1, B=B)
min = ClusterInput()
max = ClusterInput()
abs = Abs(DistanceObject=D)
max_2 = Number(Slider(1, range=0..1))
min_2 = Number(Slider(0, range=0..100))
mult = Mult(DistanceObject=abs, Factor=division)
vec = Vector(demesh.Normals)
evaluatepoints = EvaluatePoints(DistanceObject=mult, Points=demesh.Vertices)  # -> flatten(Values)
D_2 = ClusterInput()
addition = Addition(A=evaluatepoints, B=Slider(-0.01, range=-1..1))
min_3 = Number(min)
max_3 = Number(max)
num = Number(addition)
multiplication = Multiplication(A=num, B=0)
evaluatepoints_2 = EvaluatePoints(DistanceObject=D_2, Points=demesh.Vertices)
addition_2 = Addition(A=multiplication, B=min_2)
addition_3 = Addition(A=multiplication, B=max_2)
larger = LargerThan(FirstNumber=num, SecondNumber=max_2)  # -> graft(LargerThan), OrEqualTo
smaller = SmallerThan(FirstNumber=num, SecondNumber=min_2)  # -> graft(SmallerThan), OrEqualTo
merge = Merge(Data1=graft(num), Data2=graft(addition_2))
item = ListItem(List=merge, Index=smaller.SmallerThan, Wrap=True)
merge_2 = Merge(Data1=item, Data2=graft(addition_3))
item_2 = ListItem(List=merge_2, Index=larger.LargerThan, Wrap=True)  # -> flatten(Item)
multiplication_2 = Multiplication(A=evaluatepoints_2, B=item_2)
num_2 = Number(multiplication_2)
multiplication_3 = Multiplication(A=num_2, B=0)
addition_4 = Addition(A=multiplication_3, B=min_3)
addition_5 = Addition(A=multiplication_3, B=max_3)
larger_2 = LargerThan(FirstNumber=num_2, SecondNumber=max_3)  # -> graft(LargerThan), OrEqualTo
smaller_2 = SmallerThan(FirstNumber=num_2, SecondNumber=min_3)  # -> graft(SmallerThan), OrEqualTo
merge_3 = Merge(Data1=graft(num_2), Data2=graft(addition_4))
item_3 = ListItem(List=merge_3, Index=smaller_2.SmallerThan, Wrap=True)
merge_4 = Merge(Data1=item_3, Data2=graft(addition_5))
item_4 = ListItem(List=merge_4, Index=larger_2.LargerThan, Wrap=True)  # -> flatten(Item)
multiplication_4 = Multiplication(A=item_4, B=vec)
addition_6 = Addition(A=demesh.Vertices, B=multiplication_4)
conmesh = ConstructMesh(Vertices=addition_6, Faces=demesh.Faces)
M_2 = ClusterOutput(conmesh)
