# Grasshopper definition shape_abc_4.gh (Grasshopper 1.0.7)
# plug-ins: Axolotl Info, Weaverbird, Pufferfish

number_slider = Slider(500, range=0..1000)
number_slider_2 = Slider(5, range=0..1000)
addition = Addition(A=Slider(5, range=0..1000), B=Slider(20, range=0..100))
number_slider_3 = Slider(850, range=0..2500)
number_slider_4 = Slider(20, range=0..100)
number_slider_5 = Slider(150, range=0..1000)
python = GhPythonScript(top_box_side=number_slider, side_w=Slider(100, range=0..1000), side_h=number_slider_5, extra_b_h=addition)  # -> out, pd, bx
# ---------- python: Python ----------
# import scripts externally, relative folder
import sys
import os

import Grasshopper

path=os.path.dirname(Grasshopper.Instances.ActiveCanvas.Document.FilePath)
sys.path.append(path)

import volume as vlm
reload(vlm)

pd, bx = vlm.pedistle_with_tolerance(top_box_side, side_w, side_h, extra_b_h)

print(vlm.print_mesh(pd))
print(vlm.print_mesh(bx))
# ---------- end python ----------
Z = UnitZ(Factor=number_slider_3)
addition_2 = Addition(A=number_slider_2, B=number_slider_3)
python_2 = GhPythonScript(
    top_box_side=Slider(500, range=0..1000),
    side_w=Slider(100, range=0..1000),
    side_h=Slider(150, range=0..1000),
    extra_b_h=addition,
    top_shift=number_slider_4)  # -> out, pd, bx, tp_box
# ---------- python_2: Python ----------
# import scripts externally, relative folder
import sys
import os

import Grasshopper

path=os.path.dirname(Grasshopper.Instances.ActiveCanvas.Document.FilePath)
sys.path.append(path)

import volume as vlm
reload(vlm)

pd, bx = vlm.pedistle_with_tolerance(top_box_side, side_w, side_h, extra_b_h, top_shift)
tp_box = vlm.top_box(top_box_side, side_h + extra_b_h, side_w, top_shift)

print(vlm.print_mesh(pd))
print(vlm.print_mesh(bx))
# ---------- end python_2 ----------
addition_3 = Addition(A=number_slider, B=number_slider_5, C=number_slider_2)
neg = Negative(Value=addition_2)
move = Move(Geometry=python_2.tp_box, Motion=Z)  # -> Geometry, Transform
move_2 = Move(Geometry=python.pd, Motion=Z)  # -> Geometry, Transform
move_3 = Move(Geometry=python.bx, Motion=Z)  # -> Geometry, Transform
bbox = BoundingBox(Content=move.Geometry, Plane=PlaneXY(0, 0, 0))  # -> Box, Box_2
flipm = FlipMesh(Mesh=move_2.Geometry, VertexNormals=True, FaceNormals=True, FaceOrientation=True)
flipm_2 = FlipMesh(Mesh=move_3.Geometry, VertexNormals=True, FaceNormals=True, FaceOrientation=True)
cluster = Cluster_2(d2=Slider(50, range=0..100), B=bbox.Box)
mesh = Mesh(flipm)
mesh_2 = Mesh(flipm_2)
cluster_2 = Cluster(B=bbox.Box)  # -> diagonals_2, center_2
addition_4 = Addition(A=addition_2, B=addition)
mint = MeshIntersection(MeshesA=mesh, MeshesB=mesh_2)
pdecon = Deconstruct(Point=cluster_2.center_2)  # -> XComponent, YComponent, ZComponent
xy = XYPlane(Origin=cluster_2.center_2)
pdecon_2 = Deconstruct(Point=cluster_2.diagonals_2)  # -> XComponent, YComponent, ZComponent
half_height = Number(expr("x*.5", addition_3))
box = Box(DimensionX=pdecon_2.XComponent, DimensionY=pdecon_2.YComponent, DimensionZ=pdecon_2.ZComponent, Radius=0, Plane=xy)
wbsplitquads = WeaverbirdsConstantQuadsSplitSubdivision(MeshCurves=mesh, Level=Slider(3, range=1..3), SmoothNakedEdges=1)
addition_5 = Addition(A=number_slider_3, B=half_height)
Z_2 = UnitZ(Factor=addition_2)
Z_3 = UnitZ(Factor=addition_4)
xy_2 = XYPlane(Origin=Z_2)
y_lockholes = Y_lockholes(pockethole_capsule=Slider(70, range=0..100), Y=Slider(-35, range=-100..100), A=pdecon_2.XComponent, height=addition_4)  # -> line_2, D
wbcatmullclark = WeaverbirdsCatmullClarkSubdivision(MeshCurves=wbsplitquads, Level=Slider(1, range=1..3), SmoothNakedEdges=1)
pln = Plane(xy_2)
cluster_3 = Cluster_3(
    capsule_length=Slider(35, range=0..100),
    S=Slider(0.2, range=0..1),
    N=Slider(0.15, range=0..1),
    S_2=Slider(-0.15, range=-1..1),
    N_2=Slider(0.15, range=0..1),
    pt=cluster,
    R=Slider(40, range=0..100),
    B=bbox.Box)  # -> line_2, D
mesh_3 = Mesh(wbcatmullclark)
mesh_4 = Mesh(mesh_3)
cut_mesh_at_height = GhPythonScript(msh=mesh_3, height=addition_2)  # -> out, n_msh, booleans; inputs msh: Mesh
# ---------- cut_mesh_at_height: Python ----------
from Rhino.Geometry import Mesh, Point3d

pts = []
booleans = []
f_list = []
special_f_list = []

for i, v in enumerate(msh.Vertices):
    loc_pt = Point3d(v)
    booleans.append(loc_pt.Z >= height)
    pts.append(loc_pt)
    
for f in msh.Faces:
    loc_f = []
    is_true = 0
    
    for v_i in f:
        loc_f.append(v_i)
        if booleans[v_i]:
            is_true += 1
            
    if is_true == 4:
        f_list.append(loc_f)
        
    elif is_true == 2:
        special_f_list.append(loc_f)
        f_list.append(loc_f)
        
# fixing the special faces
def face_fix(f):
    global pts, booleans, height
    
    real_pts = []
    false_pts = []
    
    loc_pts = [Point3d(pts[v_i].X, pts[v_i].Y, 0.) for v_i in f]
    
    for i, v_i in enumerate(f):
        if booleans[v_i]:
            real_pts.append( [i, v_i] )
        else:
            false_pts.append( [i, v_i] )
            
    for i, v_i in real_pts:
        distance = 100.
        d_i = -1
        for j, v_j in false_pts:
            d = loc_pts[j].DistanceTo(loc_pts[j])
            if d < distance:
                distance = d
                d_i = v_j
                
        pts[d_i].X = loc_pts[i].X
        pts[d_i].Y = loc_pts[i].Y
        pts[d_i].Z = height
    
    """
    # setting booleans to true
    for v_i in f:
        booleans[v_i] = True
    """

for f in special_f_list:
    face_fix(f)

"""
# reducing the points and face indexes we don't need
n_v_list = []
n_f_list = []
v_map = {}

for i, boolean in enumerate(booleans):
    if boolean:
        v_map[i]=len(n_v_list)
        n_v_list.append(pts[i])
        
print(v_map[100])

n_f_list = []
for f in f_list:
    loc_f_list = []
    try:
        for v_i in f:
            loc_f_list.append(v_map[v_i])
        n_f_list.append(loc_f_list)
    except:
        pass
"""

n_msh = Mesh()
for pt in pts:
    n_msh.Vertices.Add(pt)
    
for f in f_list:
    a,b,c,d = f
    n_msh.Faces.AddFace(a,b,c,d)
# ---------- end cut_mesh_at_height ----------
sec = MeshPlane(Mesh=mesh_4, Plane=xy_2)
divide = DivideCurve(Curve=sec, Count=1, Kinks=True)  # -> Points, Tangents, Parameters
number_slider_6 = Slider(50, range=0..100)
boolean_intersect = BooleanIntersect(DistanceObjectS=y_lockholes.D, DistanceObject=box)
ma = MassAddition(Input=divide.Points)  # -> Result, PartialResults
shift = ShiftList(List=divide.Points, Shift=1, Wrap=True)
lng = ListLength(List=divide.Points)
mesh_5 = Mesh(cut_mesh_at_height.n_msh)
mesh_6 = Mesh(mesh_4)
division = Division(A=ma.Result, B=lng)
smoothunionlist = SmoothUnionList(DistanceObjects=flatten([boolean_intersect, cluster_3.D]), SmoothingFactor=5)
ln = Line(StartPoint=divide.Points, EndPoint=shift)
ln_2 = Line(StartPoint=division, EndPoint=divide.Points)
isosurface_distancefunction = IsosurfaceDistancefunction(
    BoundingBox=bbox.Box,
    NumberX=number_slider_6,
    NumberY=number_slider_6,
    NumberZ=number_slider_6,
    Isovalue=0,
    Capped=True,
    DistanceObject=smoothunionlist,
    Refine=True)
merge = Merge(Data1=ln_2, Data2=ln)  # -> flatten(Result)
boolean_intersect_2 = BooleanIntersect(DistanceObjectS=smoothunionlist, DistanceObject=box)
isosurface_octree = IsosurfaceOctree(
    Origin=cluster_2.center_2,
    WorldSize=Slider(1000, range=0..1000),
    Isovalue=0,
    Subdivisions=Slider(8, range=0..10),
    DistanceObject=boolean_intersect_2)
mesh_7 = Mesh(isosurface_distancefunction)
wbweave = WeaverbirdsMeshFromLinesWeaveBack(Lines=merge, MaximumValence=4)
mesh_8 = Mesh(isosurface_octree)
wbcatmullclark_2 = WeaverbirdsCatmullClarkSubdivision(MeshCurves=mesh_5, Level=Slider(1, range=0..10), SmoothNakedEdges=1)
mesh_9 = Mesh(mesh_5)

# ---- group: sub-structure
tpms = TPMS(Wavelength=Slider(1400, range=0..5000))
division_2 = Division(A=1, B=Slider(3, range=0..10))
mult = Mult(DistanceObject=tpms, Factor=division_2)
neg_2 = Negative(Value=Slider(10, range=0..200))
add = Add(DistanceObject=mult, Addend=Slider(1, range=0..1))
mult_2 = Mult(DistanceObject=mult, Factor=neg_2)
tpms_distance_object_modifier = TPMSD(Wavelength=Slider(72, range=0..1000), Modulator=mult_2)
mult_3 = Mult(DistanceObject=tpms_distance_object_modifier, Factor=Slider(25, range=0..200))

# ----
merge_2 = Merge(Data1=mesh_5, Data2=wbweave)  # -> flatten(Result)
Z_4 = UnitZ(Factor=addition_5)
mesh_10 = Mesh(mesh_5)
mjoin = MeshJoin(Meshes=merge_2)
pi = Pi(Factor=Slider(0, range=0..10))
clsmsh = CloseMesh(Mesh=mesh_10, Quadrangulate=True)  # -> Closed, Amount, Openings, R
weld = WeldMesh(Mesh=mjoin, Angle=pi)
xy_3 = XYPlane(Origin=Z_4)
top_shift = Number(number_slider_4)
mesh_11 = Mesh(mesh_6)
distance_wrapper = DistanceWrapper(Geometry=clsmsh.Closed)
boolean_intersect_3 = BooleanIntersect(DistanceObjectS=y_lockholes.D, DistanceObject=distance_wrapper)
tpms_2 = TPMS(Wavelength=Slider(10, range=0..25))
number_slider_7 = Slider(80, range=0..1000)
number_slider_8 = Slider(50, range=0..1000)
number_slider_9 = Slider(1000, range=0..1000)
multiplication = Multiplication(A=number_slider_9, B=0.5)
neg_3 = Negative(Value=multiplication)
dom = ConstructDomain(DomainStart=neg_3, DomainEnd=multiplication)
box_2 = DomainBox(Base=xy_3, X=dom, Y=dom, Z=dom)
number_slider_10 = Slider(100, range=0..1000)
number_slider_11 = Slider(100, range=0..1000)
mult_4 = Mult(DistanceObject=tpms_2, Factor=Slider(7.5, range=0..100))
meshbumpminmax = MeshBumpMinMax(D=mult_3, M=wbcatmullclark_2, min=Slider(-15, range=-25..25), max=Slider(0, range=-25..25))  # disabled
pipe = Pipe(Curve=cluster_3.line_2, Radius=Slider(12, range=0..100), Caps=1)
number_slider_12 = Slider(100, range=0..100)
number_slider_13 = Slider(3, range=0..10)  # disabled
number_slider_14 = Slider(3, range=0..10)  # disabled
meshbump = MeshBump(D=tpms_distance_object_modifier, M=mesh_9)
mesh_12 = Mesh(pipe)
smoothunion = SmoothUnion(DistanceObject=mult_3, DistanceObject_2=smoothunionlist, Radius=Slider(50, range=0..100))
Z_5 = UnitZ(Factor=neg)
pln_2 = Plane(pln)
wbcatmullclark_3 = WeaverbirdsCatmullClarkSubdivision(MeshCurves=wbcatmullclark_2, Level=number_slider_14, SmoothNakedEdges=1)  # disabled
boolean_intersect_4 = BooleanIntersect(DistanceObjectS=smoothunionlist, DistanceObject=box)
plane = Plane(Origin=Z_3, Normal=Vector(0, 0, 1))
add_2 = Add(DistanceObject=plane, Addend=Slider(800, range=-1000..1000))
smoothunion_2 = SmoothUnion(DistanceObject=add_2, DistanceObject_2=tpms_distance_object_modifier, Radius=Slider(1000, range=0..1000))
boolean_intersect_5 = BooleanIntersect(DistanceObjectS=distance_wrapper, DistanceObject=smoothunion_2)
boolean_union = BooleanUnion(DistanceObjectS=boolean_intersect_5, DistanceObject=boolean_intersect_4)
boolean_union_2 = BooleanUnion(DistanceObjectS=box, DistanceObject=boolean_intersect_5)
smoothunion_3 = SmoothUnion(DistanceObject=box, DistanceObject_2=boolean_intersect_5, Radius=Slider(5, range=0..10))
boolean_union_3 = BooleanUnion(DistanceObjectS=smoothunion_3, DistanceObject=boolean_intersect_4)
isosurface_octree_2 = IsosurfaceOctree(
    Origin=Z_4,
    WorldSize=number_slider_9,
    Isovalue=0,
    Subdivisions=Slider(5, range=0..10),
    DistanceObject=boolean_intersect_5)
isosurface_distancefunction_2 = IsosurfaceDistancefunction(
    BoundingBox=box_2,
    NumberX=number_slider_7,
    NumberY=number_slider_7,
    NumberZ=number_slider_7,
    Isovalue=0,
    Capped=True,
    DistanceObject=boolean_union_3,
    Refine=True)
isosurface_distancefunction_3 = IsosurfaceDistancefunction(
    BoundingBox=box_2,
    NumberX=number_slider_8,
    NumberY=number_slider_8,
    NumberZ=number_slider_8,
    Isovalue=0,
    Capped=True,
    DistanceObject=boolean_union,
    Refine=True)
isosurface_distancefunction_4 = IsosurfaceDistancefunction(
    BoundingBox=box_2,
    NumberX=number_slider_10,
    NumberY=number_slider_10,
    NumberZ=number_slider_10,
    Isovalue=0,
    Capped=True,
    DistanceObject=boolean_intersect_5,
    Refine=True)  # disabled
isosurface_distancefunction_5 = IsosurfaceDistancefunction(
    BoundingBox=box_2,
    NumberX=number_slider_11,
    NumberY=number_slider_11,
    NumberZ=number_slider_11,
    Isovalue=0,
    Capped=True,
    DistanceObject=smoothunion_3,
    Refine=True)  # disabled
move_4 = Move(Geometry=isosurface_distancefunction_3, Motion=Z_5)  # -> Geometry, Transform
wbcatmullclark_4 = WeaverbirdsCatmullClarkSubdivision(MeshCurves=isosurface_distancefunction_2, Level=Slider(2, range=0..10), SmoothNakedEdges=1)
wbcatmullclark_5 = WeaverbirdsCatmullClarkSubdivision(MeshCurves=isosurface_distancefunction_3, Level=Slider(2, range=0..10), SmoothNakedEdges=1)
isosurface_distancefunction_6 = IsosurfaceDistancefunction(
    BoundingBox=bbox.Box,
    NumberX=number_slider_12,
    NumberY=number_slider_12,
    NumberZ=number_slider_12,
    Isovalue=0,
    Capped=True,
    DistanceObject=boolean_intersect_4,
    Refine=True)
mult_5 = Mult(DistanceObject=mult_3, Factor=-1)
meshbumpminmax_2 = MeshBumpMinMax_2(
    D_2=mult_5,
    M=wbcatmullclark_2,
    min=Slider(-25, range=-25..25),
    max=Slider(0, range=-25..25),
    D=plane,
    B=Slider(100, range=0..250))  # disabled
wbcatmullclark_6 = WeaverbirdsCatmullClarkSubdivision(MeshCurves=meshbumpminmax_2, Level=number_slider_13, SmoothNakedEdges=1)  # disabled
preview = CustomPreview(Geometry=isosurface_distancefunction_6, Material=ColourSwatch(SwatchColor=RGB(232, 229, 193)))
mshclsd = IsMeshClosed(Mesh=isosurface_octree_2)
move_5 = Move(Geometry=isosurface_octree_2, Motion=Z_5)  # -> Geometry, Transform

# ---- group: sub-structure
tpms_3 = TPMS(Wavelength=Slider(15, range=0..5000))
division_3 = Division(A=1, B=Slider(3, range=0..10))
mult_6 = Mult(DistanceObject=tpms_3, Factor=division_3)
add_3 = Add(DistanceObject=mult_6, Addend=Slider(1, range=0..1))
neg_4 = Negative(Value=Slider(2.5, range=0..200))
mult_7 = Mult(DistanceObject=mult_6, Factor=neg_4)
tpms_distance_object_modifier_2 = TPMSD(Wavelength=Slider(150, range=0..1000), Modulator=mult_7)
mult_8 = Mult(DistanceObject=tpms_distance_object_modifier_2, Factor=Slider(25, range=0..200))

# ----
Z_6 = UnitZ(Factor=Slider(10, range=0..100))

# ---- group: currogation
tpms_4 = TPMS(Wavelength=Slider(125, range=0..5000))
division_4 = Division(A=1, B=Slider(3, range=0..10))
mult_9 = Mult(DistanceObject=tpms_4, Factor=division_4)
tpms_distance_object_modifier_3 = TPMSD(Wavelength=Slider(25, range=0..1000), Modulator=mult_9)
add_4 = Add(DistanceObject=tpms_distance_object_modifier_3, Addend=Slider(0.5, range=0..1))
mult_10 = Mult(DistanceObject=add_4, Factor=Slider(7.5, range=0..200))

# ----
number_slider_15 = Slider(350, range=0..1000)
neg_5 = Negative(Value=number_slider_15)
Z_7 = UnitZ(Factor=Slider(350, range=0..1000))
dom_2 = ConstructDomain(DomainStart=neg_5, DomainEnd=number_slider_15)
number_slider_16 = Slider(100, range=0..1000)
xz = XZPlane(Origin=Z_7)
rectangle = Rectangle(Plane=xz, XSize=dom_2, YSize=dom_2, Radius=0)  # -> Rectangle, Length
mplane = MeshPlane(Boundary=rectangle.Rectangle, WidthCount=number_slider_16, HeightCount=number_slider_16)  # -> Mesh, Area
meshbump_2 = MeshBump(D=mult_3, M=mplane.Mesh)  # disabled

# ---- group: currogation
tpms_5 = TPMS(Wavelength=Slider(175, range=0..5000))
division_5 = Division(A=1, B=Slider(3, range=0..10))
mult_11 = Mult(DistanceObject=tpms_5, Factor=division_5)
tpms_distance_object_modifier_4 = TPMSD(Wavelength=Slider(20, range=0..1000), Modulator=mult_11)

# ----
add_5 = Add(DistanceObject=tpms_distance_object_modifier_4, Addend=Slider(0.5, range=0..1))

# ---- group: currogation (continued)
mult_12 = Mult(DistanceObject=add_5, Factor=Slider(5, range=0..200))

# ----
meshbump_3 = MeshBump(D=mult_12, M=wbcatmullclark_5)
meshbump_4 = MeshBump(D=mult_12, M=wbcatmullclark_4)
meshbump_5 = MeshBump(D=mult_12, M=wbcatmullclark_3)
meshbump_6 = MeshBump(D=mult_12, M=wbcatmullclark_6)
clsmsh_2 = CloseMesh(Mesh=meshbump_5, Quadrangulate=True)  # -> Closed, Amount, Openings, R
flipm_3 = FlipMesh(Mesh=meshbump_4, VertexNormals=True, FaceNormals=True, FaceOrientation=True)
clsmsh_3 = CloseMesh(Mesh=meshbump_6, Quadrangulate=True)  # -> Closed, Amount, Openings, R
mdif = MeshDifference(MeshesA=flipm_3, MeshesB=flatten(mesh_12))
move_6 = Move(Geometry=clsmsh_3.Closed, Motion=Z_5)  # -> Geometry, Transform
move_7 = Move(Geometry=clsmsh_2.Closed, Motion=Z_5)  # -> Geometry, Transform
move_8 = Move(Geometry=mdif, Motion=Z_5)  # -> Geometry, Transform
move_9 = Move(Geometry=meshbump_4, Motion=Z_5)  # -> Geometry, Transform
msplit = MeshSplitPlane(Mesh=move_8.Geometry, Plane=Z_6)  # -> Above, Below
largestmesh = LargestMesh(M=msplit.Above)
clsmsh_4 = CloseMesh(Mesh=largestmesh, Quadrangulate=True)  # -> Closed, Amount, Openings, R
cluster_4 = Cluster_4(num=Slider(10, range=0..10), B=largestmesh)
bbox_2 = BoundingBox(Content=largestmesh, Plane=PlaneXY(0, 0, 0))  # -> Box, Box_2
line = Line(cluster_4)
cluster_5 = Cluster(B=bbox_2.Box)  # -> diagonals_2, center_2
mcx = MeshCurve(Mesh=clsmsh_4.Closed, Curve=line)  # -> Points, Faces; disabled
panel = Panel(cluster_5.diagonals_2)
sift = SiftPattern(List=mcx.Points, SiftPattern=[0, 1])  # -> Output0, Output1
clean = CleanTree(RemoveNulls=True, RemoveInvalid=True, RemoveEmpty=False, Tree=sift.Output0)
clean_2 = CleanTree(RemoveNulls=True, RemoveInvalid=True, RemoveEmpty=False, Tree=sift.Output1)
ln_3 = Line(StartPoint=clean, EndPoint=clean_2)  # -> flatten(Line)
pipe_2 = Pipe(Curve=ln_3, Radius=Slider(6, range=0..10), Caps=1)
meshbump_7 = MeshBump(D=mult_12, M=meshbump_2)
preview_2 = CustomPreview(Geometry=flipm_3, Material=ColourSwatch(SwatchColor=RGB(232, 229, 193)))
mesh_13 = Mesh(meshbump_7)
wbcatmullclark_7 = WeaverbirdsCatmullClarkSubdivision(MeshCurves=mesh_13, Level=Slider(2, range=0..3), SmoothNakedEdges=1)
medges = MeshEdges(Mesh=wbcatmullclark_7)  # -> NakedEdges, InteriorEdges, NonManifoldEdges

# ==== cluster MeshBump
M = ClusterInput()
demesh = DeconstructMesh(Mesh=M)  # -> Vertices, Faces, Colours, Normals
vec = Vector(demesh.Normals)
D = ClusterInput()
evaluatepoints = EvaluatePoints(DistanceObject=D, Points=demesh.Vertices)
multiplication = Multiplication(A=evaluatepoints, B=vec)
addition = Addition(A=demesh.Vertices, B=multiplication)
conmesh = ConstructMesh(Vertices=addition, Faces=demesh.Faces)
M_2 = ClusterOutput(conmesh)

# ==== cluster MeshBumpMinMax
M = ClusterInput()
demesh = DeconstructMesh(Mesh=M)  # -> Vertices, Faces, Colours, Normals
max = ClusterInput()
min = ClusterInput()
vec = Vector(demesh.Normals)
max_2 = Number(max)
min_2 = Number(min)
D = ClusterInput()
evaluatepoints = EvaluatePoints(DistanceObject=D, Points=demesh.Vertices)
multiplication = Multiplication(A=evaluatepoints, B=0)
addition = Addition(A=multiplication, B=min_2)
addition_2 = Addition(A=multiplication, B=max_2)
larger = LargerThan(FirstNumber=evaluatepoints, SecondNumber=max_2)  # -> graft(LargerThan), OrEqualTo
smaller = SmallerThan(FirstNumber=evaluatepoints, SecondNumber=min_2)  # -> graft(SmallerThan), OrEqualTo
merge = Merge(Data1=graft(evaluatepoints), Data2=graft(addition))
item = ListItem(List=merge, Index=smaller.SmallerThan, Wrap=True)
merge_2 = Merge(Data1=item, Data2=graft(addition_2))
item_2 = ListItem(List=merge_2, Index=larger.LargerThan, Wrap=True)  # -> flatten(Item)
multiplication_2 = Multiplication(A=item_2, B=vec)
addition_3 = Addition(A=demesh.Vertices, B=multiplication_2)
conmesh = ConstructMesh(Vertices=addition_3, Faces=demesh.Faces)
M_2 = ClusterOutput(conmesh)

# ==== cluster MeshBumpMinMax_2
M = ClusterInput()
B = ClusterInput()
D = ClusterInput()
demesh = DeconstructMesh(Mesh=M)  # -> Vertices, Faces, Colours, Normals
division = Division(A=1, B=B)
min = ClusterInput()
max = ClusterInput()
abs = Abs(DistanceObject=D)
max_2 = Number(Slider(1, range=0..1))
min_2 = Number(Slider(0, range=0..100))
mult = Mult(DistanceObject=abs, Factor=division)
vec = Vector(demesh.Normals)
evaluatepoints = EvaluatePoints(DistanceObject=mult, Points=demesh.Vertices)  # -> flatten(Values)
D_2 = ClusterInput()
addition = Addition(A=evaluatepoints, B=Slider(-0.01, range=-1..1))
min_3 = Number(min)
max_3 = Number(max)
num = Number(addition)
multiplication = Multiplication(A=num, B=0)
evaluatepoints_2 = EvaluatePoints(DistanceObject=D_2, Points=demesh.Vertices)
addition_2 = Addition(A=multiplication, B=min_2)
addition_3 = Addition(A=multiplication, B=max_2)
larger = LargerThan(FirstNumber=num, SecondNumber=max_2)  # -> graft(LargerThan), OrEqualTo
smaller = SmallerThan(FirstNumber=num, SecondNumber=min_2)  # -> graft(SmallerThan), OrEqualTo
merge = Merge(Data1=graft(num), Data2=graft(addition_2))
item = ListItem(List=merge, Index=smaller.SmallerThan, Wrap=True)
merge_2 = Merge(Data1=item, Data2=graft(addition_3))
item_2 = ListItem(List=merge_2, Index=larger.LargerThan, Wrap=True)  # -> flatten(Item)
multiplication_2 = Multiplication(A=evaluatepoints_2, B=item_2)
num_2 = Number(multiplication_2)
multiplication_3 = Multiplication(A=num_2, B=0)
addition_4 = Addition(A=multiplication_3, B=min_3)
addition_5 = Addition(A=multiplication_3, B=max_3)
larger_2 = LargerThan(FirstNumber=num_2, SecondNumber=max_3)  # -> graft(LargerThan), OrEqualTo
smaller_2 = SmallerThan(FirstNumber=num_2, SecondNumber=min_3)  # -> graft(SmallerThan), OrEqualTo
merge_3 = Merge(Data1=graft(num_2), Data2=graft(addition_4))
item_3 = ListItem(List=merge_3, Index=smaller_2.SmallerThan, Wrap=True)
merge_4 = Merge(Data1=item_3, Data2=graft(addition_5))
item_4 = ListItem(List=merge_4, Index=larger_2.LargerThan, Wrap=True)  # -> flatten(Item)
multiplication_4 = Multiplication(A=item_4, B=vec)
addition_6 = Addition(A=demesh.Vertices, B=multiplication_4)
conmesh = ConstructMesh(Vertices=addition_6, Faces=demesh.Faces)
M_2 = ClusterOutput(conmesh)

# ==== cluster Cluster
B = ClusterInput()
debox = DeconstructBox(Box=flatten(B))  # -> Plane, X, Y, Z
d_dom = D_dom(I=debox.X)  # -> R, R_2
d_dom_2 = D_dom(I=debox.Y)  # -> R, R_2
d_dom_3 = D_dom(I=debox.Z)  # -> R, R_2
pt = ConstructPoint(XCoordinate=d_dom.R_2, YCoordinate=d_dom_2.R_2, ZCoordinate=d_dom_3.R_2)
pt_2 = ConstructPoint(XCoordinate=d_dom.R, YCoordinate=d_dom_2.R, ZCoordinate=d_dom_3.R)
diagonals = Point(pt_2)
center = Point(pt)
center_2 = ClusterOutput(center)
diagonals_2 = ClusterOutput(diagonals)

# ==== cluster LargestMesh
M = ClusterInput()
disjoint = DisjointMesh(Mesh=M)  # -> flatten(Meshes)
bbox = BoundingBox(Content=disjoint, Plane=PlaneXY(0, 0, 0))  # -> Box, Box_2
lng = ListLength(List=disjoint)
volume = Volume(Geometry=bbox.Box)  # -> Volume, Centroid
series = Series(Start=0, Step=1, Count=lng)
sort = SortList(Keys=volume.Volume)  # -> Keys, ValuesA
item = ListItem(List=sort.Keys, Index=0, Wrap=True)  # -> Item1, Item
equals = Equality(FirstNumber=item.Item1, SecondNumber=volume.Volume)  # -> Equality, Inequality
sift = SiftPattern(List=series, SiftPattern=equals.Equality)  # -> Output0, Output1
clean = CleanTree(RemoveNulls=True, RemoveInvalid=True, RemoveEmpty=False, Tree=sift.Output1)
item_2 = ListItem(List=disjoint, Index=clean, Wrap=True)
i = ClusterOutput(item_2)

# ==== cluster Y_lockholes
pockethole_capsule = ClusterInput()
Y = ClusterInput()
A = ClusterInput()
height = ClusterInput()
multiplication = Multiplication(A=A, B=0.5)
pockethole_capsule_2 = Number(pockethole_capsule)
height_2 = Number(height)
subtraction = Subtraction(A=multiplication, B=pockethole_capsule_2)
neg = Negative(Value=subtraction)
addition = Addition(A=height_2, B=Slider(1000, range=0..1000))
merge = Merge(Data1=neg, Data2=subtraction)
pt = ConstructPoint(XCoordinate=merge, YCoordinate=Y, ZCoordinate=addition)
pt_2 = ConstructPoint(XCoordinate=merge, YCoordinate=Y, ZCoordinate=height_2)
ln = Line(StartPoint=pt_2, EndPoint=pt)
capsule = Capsule(Line=ln, Radius=pockethole_capsule_2)
item = ListItem(List=capsule, Index=0, Wrap=True)  # -> Item, Item1
boolean_union = BooleanUnion(DistanceObjectS=item.Item, DistanceObject=item.Item1)
line = Line(ln)
line_2 = ClusterOutput(line)
D = ClusterOutput(boolean_union)

# ==== cluster Cluster_2
number_slider = Slider(3, range=0..10)
B = ClusterInput()
division = Division(A=Slider(0.5, range=0..1), B=number_slider)
division_2 = Division(A=1, B=number_slider)
cluster = Cluster(B=B)  # -> diagonals_2, center_2
pdecon = Deconstruct(Point=cluster.diagonals_2)  # -> XComponent, YComponent, ZComponent
series = Series(Start=division, Step=division_2, Count=number_slider)
d2 = ClusterInput()
multiplication = Multiplication(A=0.5, B=cluster.diagonals_2)
multiplication_2 = Multiplication(A=series, B=pdecon.XComponent)
multiplication_3 = Multiplication(A=series, B=pdecon.ZComponent)
merge = Merge(Data1=Slider(0, range=0..1), Data2=d2, Data3=Slider(0, range=0..1))
pt = ConstructPoint(XCoordinate=multiplication_2, YCoordinate=0, ZCoordinate=graft(multiplication_3))
X = UnitX(Factor=pdecon.XComponent)
Y = UnitY(Factor=pdecon.XComponent)
pt_2 = ConstructPoint(XCoordinate=0, YCoordinate=multiplication_2, ZCoordinate=graft(multiplication_3))
subtraction = Subtraction(A=cluster.center_2, B=multiplication)
merge_2 = Merge(Data1=Slider(1, range=-1..1), Data2=Slider(-1, range=-1..1), Data3=Slider(1, range=-1..1))  # -> graft(Result)
addition = Addition(A=pt, B=subtraction)  # -> graft(Result)
addition_2 = Addition(A=pt_2, B=subtraction)
multiplication_4 = Multiplication(A=merge, B=merge_2)
Y_2 = UnitY(Factor=multiplication_4)
neg = Negative(Value=Y_2)
addition_3 = Addition(A=addition_2, B=X)
addition_4 = Addition(A=addition, B=Y)
addition_5 = Addition(A=Y_2, B=addition_3)  # -> graft(Result)
addition_6 = Addition(A=neg, B=addition_2)  # -> graft(Result)
merge_3 = Merge(Data1=addition_6, Data2=addition_5, Data3=addition_4, Data4=addition)  # -> graft(Result)
path_mapper = PathMapper(merge_3, source="{A;B;C;D;E}", target="{E}")
path_mapper_2 = ClusterOutput(path_mapper)

# ==== cluster Cluster_3
pt = ClusterInput()
S = ClusterInput()
N = ClusterInput()
S_2 = ClusterInput()
N_2 = ClusterInput()
capsule_length = ClusterInput()
pt_2 = Point(pt)
series = Series(Start=S, Step=N, Count=3)  # -> graft(Series)
series_2 = Series(Start=S_2, Step=N_2, Count=3)
B = ClusterInput()
capsule_length_2 = Number(capsule_length)
neg = Negative(Value=series)
brep_cp = BrepClosestPoint(Point=pt_2, Brep=B)  # -> Point, Normal, Distance
merge = Merge(Data1=series_2, Data2=series_2, Data3=series_2)
merge_2 = Merge(Data1=neg, Data2=neg, Data3=neg)  # -> flatten(Result)
rotate = Rotate(Geometry=brep_cp.Normal, Angle=1.570796327, Plane=PlaneXY(0, 0, 0))  # -> Geometry, Transform
rotate_2 = Rotate(Geometry=brep_cp.Normal, Angle=merge_2, Plane=PlaneXY(0, 0, 0))  # -> Geometry, Transform
neg_2 = Negative(Value=capsule_length_2)
pl = PlaneNormal(Origin=Point(0, 0, 0), ZAxis=rotate.Geometry)
rotate_3 = Rotate(Geometry=brep_cp.Normal, Angle=merge_2, Plane=pl)  # -> Geometry, Transform
rotate_4 = Rotate(Geometry=rotate_3.Geometry, Angle=merge, Plane=PlaneXY(0, 0, 0))  # -> Geometry, Transform
multiplication = Multiplication(A=rotate_4.Geometry, B=capsule_length_2)
multiplication_2 = Multiplication(A=rotate_4.Geometry, B=neg_2)
addition = Addition(A=multiplication_2, B=pt_2)
addition_2 = Addition(A=multiplication, B=pt_2)
ln = Line(StartPoint=addition, EndPoint=addition_2)
R = ClusterInput()
line = Line(ln)
capsule = Capsule(Line=ln, Radius=R)
D = ClusterOutput(capsule)
line_2 = ClusterOutput(line)

# ==== cluster Cluster_4
B = ClusterInput()
cluster = Cluster(B=B)  # -> diagonals_2, center_2
num = ClusterInput()
num_2 = Number(num)
division = Division(A=cluster.diagonals_2, B=num_2)
pdecon = Deconstruct(Point=division)  # -> XComponent, YComponent, ZComponent
round = Round(Number=pdecon.XComponent)  # -> Nearest, Floor, Ceiling
round_2 = Round(Number=pdecon.YComponent)  # -> Nearest, Floor, Ceiling
round_3 = Round(Number=pdecon.ZComponent)  # -> Nearest, Floor, Ceiling
multiplication = Multiplication(A=round.Nearest, B=0.5)
multiplication_2 = Multiplication(A=round_2.Nearest, B=0.5)
multiplication_3 = Multiplication(A=round_3.Nearest, B=0.5)
neg = Negative(Value=multiplication)
neg_2 = Negative(Value=multiplication_2)
neg_3 = Negative(Value=multiplication_3)
series = Series(Start=neg, Step=1, Count=round.Nearest)
series_2 = Series(Start=neg_3, Step=1, Count=round_3.Nearest)
series_3 = Series(Start=neg_2, Step=1, Count=round_2.Nearest)
multiplication_4 = Multiplication(A=num_2, B=series)
multiplication_5 = Multiplication(A=num_2, B=neg_2)
multiplication_6 = Multiplication(A=num_2, B=series_2)
multiplication_7 = Multiplication(A=num_2, B=multiplication_2)
pt = ConstructPoint(XCoordinate=multiplication_4, YCoordinate=multiplication_7, ZCoordinate=graft(multiplication_6))
pt_2 = ConstructPoint(XCoordinate=multiplication_4, YCoordinate=multiplication_5, ZCoordinate=graft(multiplication_6))
addition = Addition(A=cluster.center_2, B=pt)
addition_2 = Addition(A=cluster.center_2, B=pt_2)
ln = Line(StartPoint=addition_2, EndPoint=addition)
L = ClusterOutput(ln)

# ==== cluster D_dom
I = ClusterInput()
dedomain = DeconstructDomain(Domain=I)  # -> Start, End
subtraction = Subtraction(A=dedomain.End, B=dedomain.Start)
addition = Addition(A=dedomain.Start, B=dedomain.End)
R = ClusterOutput(subtraction)
multiplication = Multiplication(A=addition, B=0.5)
R_2 = ClusterOutput(multiplication)
