# Grasshopper definition shape_abc_6.gh (Grasshopper 1.0.7)
# plug-ins: Axolotl Info, Weaverbird, Pufferfish, Parakeet

number_slider = Slider(500, range=0..1000)
number_slider_2 = Slider(5, range=0..1000)
addition = Addition(A=Slider(5, range=0..1000), B=Slider(20, range=0..100))
number_slider_3 = Slider(850, range=0..2500)
number_slider_4 = Slider(30, range=0..100)
number_slider_5 = Slider(150, range=0..1000)
number_slider_6 = Slider(0, range=0..10)
python = GhPythonScript(top_box_side=number_slider, side_w=Slider(100, range=0..1000), side_h=number_slider_5, extra_b_h=addition)  # -> out, pd, tp_box, bx
# ---------- python: Python ----------
# import scripts externally, relative folder
import sys
import os

import Grasshopper

path=os.path.dirname(Grasshopper.Instances.ActiveCanvas.Document.FilePath)
sys.path.append(path)

import volume as vlm
reload(vlm)

pd, bx = vlm.pedistle_with_tolerance(top_box_side, side_w, side_h, extra_b_h)
tp_box = vlm.top_box(top_box_side, side_h + extra_b_h, side_w, 0.)

print(vlm.print_mesh(pd))
print(vlm.print_mesh(bx))
# ---------- end python ----------
python_2 = GhPythonScript(msh=python.pd)  # -> out, a; inputs msh: Mesh
# ---------- python_2: Python ----------
import Rhino.Geometry as rg

brep_faces = []
pts = [rg.Point3d(pt) for pt in msh.Vertices]

a = [rg.Polyline([pts[i] for i in list(face)]) for face in msh.Faces]
# ---------- end python_2 ----------
clscrv = CloseCurve(Curve=python_2.a, CloseType=0, Bulge=0.5, Tolerance=0)  # -> Closed, R
lng = ListLength(List=clscrv.Closed)
subtraction = Subtraction(A=lng, B=2)
Z = UnitZ(Factor=number_slider_3)
addition_2 = Addition(A=number_slider_2, B=number_slider_3)
python_3 = GhPythonScript(
    top_box_side=Slider(500, range=0..1000),
    side_w=Slider(100, range=0..1000),
    side_h=Slider(150, range=0..1000),
    extra_b_h=addition,
    top_shift=number_slider_4)  # -> out, pd, bx, tp_box
# ---------- python_3: Python ----------
# import scripts externally, relative folder
import sys
import os

import Grasshopper

path=os.path.dirname(Grasshopper.Instances.ActiveCanvas.Document.FilePath)
sys.path.append(path)

import volume as vlm
reload(vlm)

pd, bx = vlm.pedistle_with_tolerance(top_box_side, side_w, side_h, extra_b_h, top_shift)
tp_box = vlm.top_box(top_box_side, side_h + extra_b_h, side_w, top_shift)

print(vlm.print_mesh(pd))
print(vlm.print_mesh(bx))
# ---------- end python_3 ----------
number_slider_7 = Slider(-60, range=-100..100)
split = SplitList(List=clscrv.Closed, Index=subtraction)  # -> ListA, ListB
srf = Surface(clscrv.Closed)
item = ListItem(List=split.ListB, Index=0, Wrap=True)  # -> Item1, Item
addition_3 = Addition(A=number_slider, B=number_slider_5, C=number_slider_2)
neg = Negative(Value=addition_2)
join = BrepJoin(Breps=srf)  # -> Breps, Closed
sift = SiftPattern(List=split.ListA, SiftPattern=[0, 1])  # -> Output0, Output1
number_slider_8 = Slider(0.2, range=0..1)
clean = CleanTree(RemoveNulls=True, RemoveInvalid=True, RemoveEmpty=False, Tree=sift.Output0)
move = Move(Geometry=python.pd, Motion=Z)  # -> Geometry, Transform
move_2 = Move(Geometry=python.bx, Motion=Z)  # -> Geometry, Transform
move_3 = Move(Geometry=python.tp_box, Motion=Z)  # -> Geometry, Transform
srf_2 = Surface(clean)
bbox = BoundingBox(Content=move_3.Geometry, Plane=PlaneXY(0, 0, 0))  # -> Box, Box_2
flipm = FlipMesh(Mesh=move.Geometry, VertexNormals=True, FaceNormals=True, FaceOrientation=True)
flipm_2 = FlipMesh(Mesh=move_2.Geometry, VertexNormals=True, FaceNormals=True, FaceOrientation=True)
divide = DivideCurve(Curve=item.Item1, Count=1, Kinks=True)  # -> Points, Tangents, Parameters
cluster = Cluster_2(d2=Slider(60, range=0..100), B=bbox.Box)
join_2 = BrepJoin(Breps=srf_2)  # -> Breps, Closed
pow = Power(A=2, B=Slider(3, range=0..10))
offsrf = OffsetSurface(Surface=join.Breps, Distance=number_slider_7, BothSides=0, CreateSolid=True)
shift = ShiftList(List=divide.Points, Shift=1, Wrap=True)
subtraction_2 = Subtraction(A=Slider(1, range=0..1), B=number_slider_8)
mesh = Mesh(flipm)
mesh_2 = Mesh(flipm_2)
division = Division(A=1, B=pow)
cluster_2 = Cluster(B=bbox.Box)  # -> diagonals_2, center_2
cap = CapHoles(Brep=join_2.Breps)
merge = Merge(Data1=number_slider_8, Data2=subtraction_2)  # -> graft(Result)
ln = Line(StartPoint=divide.Points, EndPoint=shift)
neg_2 = Negative(Value=Slider(60, range=0..100))
wbwindow = WeaverbirdsMeshWindow(MeshPolylines=mesh, Distance=expr("x*100.", division), InsetType=0)
wbcarpet = WeaverbirdsSierpinskiCarpet(MeshPolylines=mesh, Distance=expr("x * 100.", division), InsetType=0)
addition_4 = Addition(A=addition_2, B=addition)
mint = MeshIntersection(MeshesA=mesh, MeshesB=mesh_2)
move_4 = Move(Geometry=python_3.tp_box, Motion=Z)  # -> Geometry, Transform
eval = EvaluateCurve(Curve=ln, Parameter=merge)  # -> graft(Point), Tangent, Angle
merge_2 = Merge(Data1=wbcarpet, Data2=wbwindow)
brepoffset = OffsetBrep(Brep=cap, Distance=number_slider_7, Solid=False, BothSides=False, RoundCorners=True, MergeFaces=False)
brepoffset_2 = OffsetBrep(Brep=join.Breps, Distance=number_slider_7, Solid=False, BothSides=False, RoundCorners=True, MergeFaces=False)
pdecon = Deconstruct(Point=cluster_2.center_2)  # -> XComponent, YComponent, ZComponent
xy = XYPlane(Origin=cluster_2.center_2)
pdecon_2 = Deconstruct(Point=cluster_2.diagonals_2)  # -> XComponent, YComponent, ZComponent
cluster_3 = Cluster(B=move_4.Geometry)  # -> diagonals_2, center_2
path_mapper = PathMapper(eval.Point, source="{A;B;C;D;E;F}", target="{F}")
crv_cp = CurveClosestPoint(Point=path_mapper, Curve=item.Item)  # -> Point, Parameter, Distance
brep_cp = BrepClosestPoint(Point=path_mapper, Brep=cap)  # -> Point, Normal, Distance
mjoin = MeshJoin(Meshes=merge_2)
half_height = Number(expr("x*.5", addition_3))
Z_2 = UnitZ(Factor=Slider(-1000, range=-1000..1000))
subtraction_3 = Subtraction(A=brep_cp.Point, B=crv_cp.Point)
box = Box(DimensionX=pdecon_2.XComponent, DimensionY=pdecon_2.YComponent, DimensionZ=pdecon_2.ZComponent, Radius=0, Plane=xy)
bbox_2 = BoundingBox(Content=brepoffset_2, Plane=PlaneXY(0, 0, 0))  # -> Box, Box_2
xy_2 = XYPlane(Origin=cluster_3.center_2)
pdecon_3 = Deconstruct(Point=cluster_3.diagonals_2)  # -> XComponent, YComponent, ZComponent
wbsplitquads = WeaverbirdsConstantQuadsSplitSubdivision(MeshCurves=mesh, Level=Slider(3, range=1..3), SmoothNakedEdges=1)
addition_5 = Addition(A=number_slider_3, B=half_height)
Z_3 = UnitZ(Factor=addition_2)
unit = UnitVector(Vector=subtraction_3)
Z_4 = UnitZ(Factor=addition_4)
cluster_4 = Cluster(B=bbox_2.Box)  # -> diagonals_2, center_2
xy_3 = XYPlane(Origin=Z_3)
y_lockholes = Y_lockholes(pockethole_capsule=Slider(70, range=0..100), Y=Slider(35, range=-100..100), A=pdecon_2.XComponent, height=addition_4)  # -> line_2, D
end = EndPoints(Curve=y_lockholes.line_2)  # -> Start, End
subtraction_4 = Subtraction(A=end.End, B=end.Start)
pl = PlaneNormal(Origin=end.Start, ZAxis=subtraction_4)
rev = ReverseList(List=pl)
deplane = DeconstructPlane(Plane=rev)  # -> Origin, XAxis, YAxis, ZAxis
pdecon_4 = Deconstruct(Point=deplane.Origin)  # -> XComponent, YComponent, ZComponent
pt = ConstructPoint(XCoordinate=pdecon_4.XComponent, YCoordinate=0, ZCoordinate=pdecon_4.ZComponent)
pl_2 = ConstructPlane(Origin=pt, XAxis=deplane.XAxis, YAxis=deplane.YAxis)
ghpython_script = GhPythonScript(
    plns=pl_2,
    h0=Slider(20, range=0..100),
    h1=Slider(20, range=0..100),
    h2=Slider(10, range=0..100),
    w0=Slider(20, range=0..100),
    w1=Slider(40, range=0..100))  # -> out, pts, trans_pts; inputs plns: list of Plane
# ---------- ghpython_script: Python ----------
from Rhino.Geometry import Point3d, Transform, Plane

hs=[h0, h0+h1, h0+h1+h2]
pts=[
    Point3d(w0, 0,0),
    Point3d(w0, h0,0),
    Point3d(w1, h0+h1,0),
    Point3d(w1, h0+h1+h2,0)
]

pts_2=[Point3d(-pt.X, pt.Y, 0) for pt in pts[::-1]]

pts+=pts_2

trans_pts = []
for pln in plns:
    loc_pts = []
    
    t_m = Transform.PlaneToPlane(Plane.WorldXY, pln)
    for pt in pts:
        n_pt = Point3d(pt)
        n_pt.Transform(t_m)
        
        loc_pts.append(n_pt)
        
    trans_pts.extend(loc_pts)
# ---------- end ghpython_script ----------
interlock = Interlock(pt=ghpython_script.trans_pts, num=Slider(5, range=0..10))
offset = OffsetCurve(Curve=interlock, Distance=neg_2, Plane=PlaneXY(0, 0, 0), Corners=1)
extr = Extrude(Base=offset, Direction=Z_2)
cap_2 = CapHoles(Brep=extr)
sdiff = SolidDifference(BrepsA=brepoffset_2, BrepsB=cap_2)
sdiff_2 = SolidDifference(BrepsA=brepoffset, BrepsB=cap_2)
wbcatmullclark = WeaverbirdsCatmullClarkSubdivision(MeshCurves=mjoin, Level=Slider(2, range=1..3), SmoothNakedEdges=1)
multiplication = Multiplication(A=unit, B=Slider(100, range=0..100))
Z_5 = UnitZ(Factor=1)
box_2 = Box(DimensionX=pdecon_3.XComponent, DimensionY=pdecon_3.YComponent, DimensionZ=pdecon_3.ZComponent, Radius=0, Plane=xy_2)
number_slider_9 = Slider(20, range=0..100)
mesh_3 = Mesh()
pln = Plane(xy_3)
cluster_5 = Cluster_3(
    capsule_length=Slider(35, range=0..100),
    S=Slider(0.2, range=0..1),
    N=Slider(0.15, range=0..1),
    S_2=Slider(-0.15, range=-1..1),
    N_2=Slider(0.15, range=0..1),
    pt=cluster,
    R=Slider(40, range=0..100),
    B=bbox.Box)  # -> line_2, D
pdecon_5 = Deconstruct(Point=cluster_4.diagonals_2)  # -> XComponent, YComponent, ZComponent
mesh_4 = Mesh(wbcatmullclark)
mesh_5 = Mesh(mesh_4)
addition_6 = Addition(A=crv_cp.Point, B=multiplication)
xprod = CrossProduct(VectorA=multiplication, VectorB=Z_5, Unitize=False)  # -> Vector, Length
number_slider_10 = Slider(300, range=0..1000)
xz = XZPlane(Origin=cluster_4.center_2)
division_2 = Division(A=pdecon_5.ZComponent, B=2)
pt_2 = Point(Point(0, 0, 0))
cut_mesh_at_height = GhPythonScript(msh=mesh_4, height=addition_2)  # -> out, n_msh, booleans; inputs msh: Mesh
# ---------- cut_mesh_at_height: Python ----------
from Rhino.Geometry import Mesh, Point3d

pts = []
booleans = []
f_list = []
special_f_list = []

for i, v in enumerate(msh.Vertices):
    loc_pt = Point3d(v)
    booleans.append(loc_pt.Z >= height)
    pts.append(loc_pt)
    
for f in msh.Faces:
    loc_f = []
    is_true = 0
    
    for v_i in f:
        loc_f.append(v_i)
        if booleans[v_i]:
            is_true += 1
            
    if is_true == 4:
        f_list.append(loc_f)
        
    elif is_true == 2:
        special_f_list.append(loc_f)
        f_list.append(loc_f)
        
# fixing the special faces
def face_fix(f):
    global pts, booleans, height
    
    real_pts = []
    false_pts = []
    
    loc_pts = [Point3d(pts[v_i].X, pts[v_i].Y, 0.) for v_i in f]
    
    for i, v_i in enumerate(f):
        if booleans[v_i]:
            real_pts.append( [i, v_i] )
        else:
            false_pts.append( [i, v_i] )
            
    for i, v_i in real_pts:
        distance = 100.
        d_i = -1
        for j, v_j in false_pts:
            d = loc_pts[j].DistanceTo(loc_pts[j])
            if d < distance:
                distance = d
                d_i = v_j
                
        pts[d_i].X = loc_pts[i].X
        pts[d_i].Y = loc_pts[i].Y
        pts[d_i].Z = height
    
    """
    # setting booleans to true
    for v_i in f:
        booleans[v_i] = True
    """

for f in special_f_list:
    face_fix(f)

"""
# reducing the points and face indexes we don't need
n_v_list = []
n_f_list = []
v_map = {}

for i, boolean in enumerate(booleans):
    if boolean:
        v_map[i]=len(n_v_list)
        n_v_list.append(pts[i])
        
print(v_map[100])

n_f_list = []
for f in f_list:
    loc_f_list = []
    try:
        for v_i in f:
            loc_f_list.append(v_map[v_i])
        n_f_list.append(loc_f_list)
    except:
        pass
"""

n_msh = Mesh()
for pt in pts:
    n_msh.Vertices.Add(pt)
    
for f in f_list:
    a,b,c,d = f
    n_msh.Faces.AddFace(a,b,c,d)
# ---------- end cut_mesh_at_height ----------
sec = MeshPlane(Mesh=mesh_5, Plane=xy_3)
addition_7 = Addition(A=Slider(50, range=0..100), B=number_slider_9)
neg_3 = Negative(Value=number_slider_9)
pl_3 = ConstructPlane(Origin=addition_6, XAxis=multiplication, YAxis=xprod.Vector)
deplane_2 = DeconstructPlane(Plane=pl_3)  # -> Origin, XAxis, YAxis, ZAxis
subtraction_5 = Subtraction(A=division_2, B=addition_7)
divide_2 = DivideCurve(Curve=sec, Count=1, Kinks=True)  # -> Points, Tangents, Parameters
panel = Panel(cluster_5.line_2)
pl_4 = ConstructPlane(Origin=pt_2, XAxis=deplane_2.XAxis, YAxis=deplane_2.ZAxis)
neg_4 = Negative(Value=number_slider_10)
dom = ConstructDomain(DomainStart=neg_3, DomainEnd=number_slider_9)
number_slider_11 = Slider(50, range=0..100)
neg_5 = Negative(Value=subtraction_5)
boolean_intersect = BooleanIntersect(DistanceObjectS=y_lockholes.D, DistanceObject=box)
ma = MassAddition(Input=divide_2.Points)  # -> Result, PartialResults
shift_2 = ShiftList(List=divide_2.Points, Shift=1, Wrap=True)
lng_2 = ListLength(List=divide_2.Points)
mesh_6 = Mesh(cut_mesh_at_height.n_msh)
mesh_7 = Mesh(mesh_5)
Z_6 = UnitZ(Factor=subtraction_5)
Z_7 = UnitZ(Factor=neg_5)
rotate = Rotate(Geometry=deplane_2.ZAxis, Angle=Slider(0.36, range=0..7), Plane=pl_4)  # -> Geometry, Transform
dom_2 = ConstructDomain(DomainStart=neg_5, DomainEnd=subtraction_5)
division_3 = Division(A=ma.Result, B=lng_2)
unit_2 = UnitVector(Vector=rotate.Geometry)
multiplication_2 = Multiplication(A=unit_2, B=number_slider_10)
multiplication_3 = Multiplication(A=unit_2, B=neg_4)
addition_8 = Addition(A=cluster_4.center_2, B=Z_7)
number_slider_12 = Slider(60, range=0..100)
addition_9 = Addition(A=cluster_4.center_2, B=Z_6)
smoothunionlist = SmoothUnionList(DistanceObjects=flatten([boolean_intersect, cluster_5.D]), SmoothingFactor=5)
addition_10 = Addition(A=deplane_2.Origin, B=multiplication_2)
addition_11 = Addition(A=deplane_2.Origin, B=multiplication_3)
ln_2 = Line(StartPoint=divide_2.Points, EndPoint=shift_2)
ln_3 = Line(StartPoint=division_3, EndPoint=divide_2.Points)
xz_2 = XZPlane(Origin=addition_8)
xz_3 = XZPlane(Origin=addition_9)
number_slider_13 = Slider(8, range=0..100)
isosurface_distancefunction = IsosurfaceDistancefunction(
    BoundingBox=bbox.Box,
    NumberX=number_slider_11,
    NumberY=number_slider_11,
    NumberZ=number_slider_11,
    Isovalue=0,
    Capped=True,
    DistanceObject=smoothunionlist,
    Refine=True)
abs = Absolute(Value=number_slider_7)
merge_3 = Merge(Data1=ln_3, Data2=ln_2)  # -> flatten(Result)
ln_4 = Line(StartPoint=addition_10, EndPoint=addition_11)
boolean_intersect_2 = BooleanIntersect(DistanceObjectS=smoothunionlist, DistanceObject=box)
isosurface_octree = IsosurfaceOctree(
    Origin=cluster_2.center_2,
    WorldSize=Slider(1000, range=0..1000),
    Isovalue=0,
    Subdivisions=Slider(8, range=0..10),
    DistanceObject=boolean_intersect_2)
number_slider_14 = Slider(130, range=0..1000)
cir = Circle(Plane=xz_2, Radius=number_slider_9)
rectangle = Rectangle(Plane=xz, XSize=dom, YSize=dom_2, Radius=0)  # -> Rectangle, Length
cir_2 = Circle(Plane=xz_3, Radius=number_slider_9)
addition_12 = Addition(A=number_slider_13, B=abs)
mesh_8 = Mesh(isosurface_distancefunction)
wbweave = WeaverbirdsMeshFromLinesWeaveBack(Lines=merge_3, MaximumValence=4)
mesh_9 = Mesh(isosurface_octree)
merge_4 = Merge(Data1=cir_2, Data2=cir, Data3=rectangle.Rectangle)
wbcatmullclark_2 = WeaverbirdsCatmullClarkSubdivision(MeshCurves=mesh_6, Level=Slider(1, range=0..10), SmoothNakedEdges=1)
pipe = Pipe(Curve=ln_4, Radius=addition_12, Caps=1)
sdiff_3 = SolidDifference(BrepsA=sdiff, BrepsB=flatten(pipe))
sdiff_4 = SolidDifference(BrepsA=sdiff_2, BrepsB=flatten(pipe))
pipe_2 = Pipe(Curve=ln_4, Radius=number_slider_13, Caps=1)
mesh_10 = Mesh(mesh_6)

# ---- group: sub-structure
tpms = TPMS(Wavelength=Slider(1400, range=0..5000))
division_4 = Division(A=1, B=Slider(3, range=0..10))
mult = Mult(DistanceObject=tpms, Factor=division_4)
neg_6 = Negative(Value=Slider(10, range=0..200))
add = Add(DistanceObject=mult, Addend=Slider(1, range=0..1))
mult_2 = Mult(DistanceObject=mult, Factor=neg_6)
tpms_distance_object_modifier = TPMSD(Wavelength=Slider(72, range=0..1000), Modulator=mult_2)
mult_3 = Mult(DistanceObject=tpms_distance_object_modifier, Factor=Slider(25, range=0..200))

# ----
neg_7 = Negative(Value=number_slider_14)
multiplication_4 = Multiplication(A=number_slider_14, B=2)
merge_5 = Merge(Data1=mesh_6, Data2=wbweave)  # -> flatten(Result)
Z_8 = UnitZ(Factor=addition_5)
runion = RegionUnion(Curves=merge_4)
mesh_11 = Mesh(mesh_6)
Z_9 = UnitZ(Factor=Slider(-100, range=-100..1000))
Y = UnitY(Factor=neg_7)
Y_2 = UnitY(Factor=multiplication_4)
Y_3 = UnitY(Factor=number_slider_14)
Z_10 = UnitZ(Factor=Slider(1000, range=0..1000))
mjoin_2 = MeshJoin(Meshes=merge_5)
pi = Pi(Factor=Slider(0, range=0..10))
number_slider_15 = Slider(30, range=0..100)
clsmsh = CloseMesh(Mesh=mesh_11, Quadrangulate=True)  # -> Closed, Amount, Openings, R
move_5 = Move(Geometry=runion, Motion=Y)  # -> Geometry, Transform
addition_13 = Addition(A=Y, B=Z_9)
addition_14 = Addition(A=Y_3, B=Z_9)
addition_15 = Addition(A=Y_3, B=Z_10)
addition_16 = Addition(A=Y, B=Z_10)
weld = WeldMesh(Mesh=mjoin_2, Angle=pi)
xy_4 = XYPlane(Origin=Z_8)
extr_2 = Extrude(Base=move_5.Geometry, Direction=Y_2)
ln_5 = Line(StartPoint=addition_13, EndPoint=addition_16)
ln_6 = Line(StartPoint=addition_14, EndPoint=addition_15)
Z_11 = UnitZ(Factor=Slider(-100, range=-100..1000))
Z_12 = UnitZ(Factor=Slider(100, range=0..1000))
top_shift = Number(number_slider_4)
mesh_12 = Mesh(mesh_7)
distance_wrapper = DistanceWrapper(Geometry=clsmsh.Closed)
cap_3 = CapHoles(Brep=extr_2)
pipe_3 = Pipe(Curve=ln_5, Radius=number_slider_15, Caps=1)
pipe_4 = Pipe(Curve=ln_6, Radius=number_slider_15, Caps=1)
number_slider_16 = Slider(30, range=0..100)
addition_17 = Addition(A=Y, B=Z_11)
addition_18 = Addition(A=Y_3, B=Z_11)
addition_19 = Addition(A=Y_3, B=Z_12)
addition_20 = Addition(A=Y, B=Z_12)
boolean_intersect_3 = BooleanIntersect(DistanceObjectS=y_lockholes.D, DistanceObject=distance_wrapper)
tpms_2 = TPMS(Wavelength=Slider(10, range=0..25))
number_slider_17 = Slider(140, range=0..1000)
number_slider_18 = Slider(140, range=0..1000)
number_slider_19 = Slider(1000, range=0..1000)
multiplication_5 = Multiplication(A=number_slider_19, B=0.5)
neg_8 = Negative(Value=multiplication_5)
dom_3 = ConstructDomain(DomainStart=neg_8, DomainEnd=multiplication_5)
box_3 = DomainBox(Base=xy_4, X=dom_3, Y=dom_3, Z=dom_3)
ln_7 = Line(StartPoint=addition_17, EndPoint=addition_20)
ln_8 = Line(StartPoint=addition_18, EndPoint=addition_19)
number_slider_20 = Slider(100, range=0..1000)
number_slider_21 = Slider(100, range=0..1000)
brep = Brep(cap_3)
mult_4 = Mult(DistanceObject=tpms_2, Factor=Slider(7.5, range=0..100))
merge_6 = Merge(Data1=pipe_3, Data2=pipe_4, Data3=brep)
merge_7 = Merge(Data1=sdiff_3, Data2=merge_6)  # -> flatten(Result)
sunion = SolidUnion(Breps=merge_7)
pipe_5 = Pipe(Curve=ln_7, Radius=number_slider_16, Caps=1)
pipe_6 = Pipe(Curve=ln_8, Radius=number_slider_16, Caps=1)
number_slider_22 = Slider(160, range=0..1000)
meshbumpminmax = MeshBumpMinMax(D=mult_3, M=wbcatmullclark_2, min=Slider(-15, range=-25..25), max=Slider(0, range=-25..25))  # disabled
merge_8 = Merge(Data1=pipe_5, Data2=pipe_6)
merge_9 = Merge(Data1=sdiff_4, Data2=merge_8)  # -> flatten(Result)
sunion_2 = SolidUnion(Breps=merge_9)
pipe_7 = Pipe(Curve=cluster_5.line_2, Radius=Slider(12, range=0..100), Caps=1)
number_slider_23 = Slider(100, range=0..100)
number_slider_24 = Slider(3, range=0..10)  # disabled
number_slider_25 = Slider(3, range=0..10)  # disabled
meshbump = MeshBump(D=tpms_distance_object_modifier, M=mesh_10)
number_slider_26 = Slider(2, range=0..10)  # disabled
number_slider_27 = Slider(2, range=0..10)  # disabled
number_slider_28 = Slider(2, range=0..10)  # disabled
mesh_13 = Mesh(pipe_7)
smoothunion = SmoothUnion(DistanceObject=mult_3, DistanceObject_2=smoothunionlist, Radius=Slider(50, range=0..100))
Z_13 = UnitZ(Factor=neg)
pln_2 = Plane(pln)
wbcatmullclark_3 = WeaverbirdsCatmullClarkSubdivision(MeshCurves=wbcatmullclark_2, Level=number_slider_25, SmoothNakedEdges=1)  # disabled
isosurface_distancefunction_2 = IsosurfaceDistancefunction(
    BoundingBox=box_3,
    NumberX=number_slider_22,
    NumberY=number_slider_22,
    NumberZ=number_slider_22,
    Isovalue=0,
    Capped=True,
    DistanceObject=distance_wrapper,
    Refine=True)
wbcatmullclark_4 = WeaverbirdsCatmullClarkSubdivision(MeshCurves=isosurface_distancefunction_2, Level=number_slider_26, SmoothNakedEdges=1)  # disabled
boolean_intersect_4 = BooleanIntersect(DistanceObjectS=smoothunionlist, DistanceObject=box)
plane = Plane(Origin=Z_4, Normal=Vector(0, 0, 1))
add_2 = Add(DistanceObject=plane, Addend=Slider(800, range=-1000..1000))
smoothunion_2 = SmoothUnion(DistanceObject=add_2, DistanceObject_2=tpms_distance_object_modifier, Radius=Slider(1000, range=0..1000))
boolean_intersect_5 = BooleanIntersect(DistanceObjectS=distance_wrapper, DistanceObject=smoothunion_2)
boolean_union = BooleanUnion(DistanceObjectS=boolean_intersect_5, DistanceObject=boolean_intersect_4)
boolean_union_2 = BooleanUnion(DistanceObjectS=box_2, DistanceObject=boolean_intersect_5)
smoothunion_3 = SmoothUnion(DistanceObject=box_2, DistanceObject_2=boolean_intersect_5, Radius=Slider(5, range=0..10))
boolean_union_3 = BooleanUnion(DistanceObjectS=smoothunion_3, DistanceObject=boolean_intersect_4)
isosurface_octree_2 = IsosurfaceOctree(
    Origin=Z_8,
    WorldSize=number_slider_19,
    Isovalue=0,
    Subdivisions=Slider(5, range=0..10),
    DistanceObject=boolean_intersect_5)
isosurface_distancefunction_3 = IsosurfaceDistancefunction(
    BoundingBox=box_3,
    NumberX=number_slider_17,
    NumberY=number_slider_17,
    NumberZ=number_slider_17,
    Isovalue=0,
    Capped=True,
    DistanceObject=boolean_union_3,
    Refine=True)
isosurface_distancefunction_4 = IsosurfaceDistancefunction(
    BoundingBox=box_3,
    NumberX=number_slider_18,
    NumberY=number_slider_18,
    NumberZ=number_slider_18,
    Isovalue=0,
    Capped=True,
    DistanceObject=boolean_union,
    Refine=True)
isosurface_distancefunction_5 = IsosurfaceDistancefunction(
    BoundingBox=box_3,
    NumberX=number_slider_20,
    NumberY=number_slider_20,
    NumberZ=number_slider_20,
    Isovalue=0,
    Capped=True,
    DistanceObject=boolean_intersect_5,
    Refine=True)  # disabled
isosurface_distancefunction_6 = IsosurfaceDistancefunction(
    BoundingBox=box_3,
    NumberX=number_slider_21,
    NumberY=number_slider_21,
    NumberZ=number_slider_21,
    Isovalue=0,
    Capped=True,
    DistanceObject=smoothunion_3,
    Refine=True)  # disabled
move_6 = Move(Geometry=isosurface_distancefunction_4, Motion=Z_13)  # -> Geometry, Transform
wbcatmullclark_5 = WeaverbirdsCatmullClarkSubdivision(MeshCurves=isosurface_distancefunction_4, Level=number_slider_28, SmoothNakedEdges=1)  # disabled
wbcatmullclark_6 = WeaverbirdsCatmullClarkSubdivision(MeshCurves=isosurface_distancefunction_3, Level=number_slider_27, SmoothNakedEdges=1)  # disabled
isosurface_distancefunction_7 = IsosurfaceDistancefunction(
    BoundingBox=bbox.Box,
    NumberX=number_slider_23,
    NumberY=number_slider_23,
    NumberZ=number_slider_23,
    Isovalue=0,
    Capped=True,
    DistanceObject=boolean_intersect_4,
    Refine=True)
mesh_14 = Mesh(isosurface_distancefunction_4)
mesh_15 = Mesh(isosurface_distancefunction_3)
mesh_16 = Mesh(wbcatmullclark)
mesh_17 = Mesh(isosurface_distancefunction_4)
mult_5 = Mult(DistanceObject=mult_3, Factor=-1)
wbcatmullclark_7 = WeaverbirdsCatmullClarkSubdivision(MeshCurves=mesh_16, Level=Slider(1, range=0..1), SmoothNakedEdges=1)
mesh_18 = Mesh()
meshbumpminmax_2 = MeshBumpMinMax_2(
    D_2=mult_5,
    M=wbcatmullclark_2,
    min=Slider(-25, range=-25..25),
    max=Slider(0, range=-25..25),
    D=plane,
    B=Slider(100, range=0..250))  # disabled
wbcatmullclark_8 = WeaverbirdsCatmullClarkSubdivision(MeshCurves=meshbumpminmax_2, Level=number_slider_24, SmoothNakedEdges=1)  # disabled
preview = CustomPreview(Geometry=isosurface_distancefunction_7, Material=ColourSwatch(SwatchColor=RGB(232, 229, 193)))
number_slider_29 = Slider(13, range=0..100)
mshclsd = IsMeshClosed(Mesh=isosurface_octree_2)
move_7 = Move(Geometry=interlock, Motion=Z_13)  # -> Geometry, Transform
move_8 = Move(Geometry=isosurface_octree_2, Motion=Z_13)  # -> Geometry, Transform
neg_9 = Negative(Value=Slider(200, range=0..1000))

# ---- group: sub-structure
tpms_3 = TPMS(Wavelength=Slider(15, range=0..5000))
division_5 = Division(A=1, B=Slider(3, range=0..10))
mult_6 = Mult(DistanceObject=tpms_3, Factor=division_5)
add_3 = Add(DistanceObject=mult_6, Addend=Slider(1, range=0..1))
neg_10 = Negative(Value=Slider(2.5, range=0..200))
mult_7 = Mult(DistanceObject=mult_6, Factor=neg_10)
tpms_distance_object_modifier_2 = TPMSD(Wavelength=Slider(150, range=0..1000), Modulator=mult_7)
mult_8 = Mult(DistanceObject=tpms_distance_object_modifier_2, Factor=Slider(25, range=0..200))

# ----
move_9 = Move(Geometry=wbcatmullclark_7, Motion=Z_13)  # -> Geometry, Transform
Z_14 = UnitZ(Factor=number_slider_29)
Z_15 = UnitZ(Factor=Slider(1000, range=0..1000))
Z_16 = UnitZ(Factor=neg_9)
neg_11 = Negative(Value=Z)
neg_12 = Negative(Value=number_slider_29)
move_10 = Move(Geometry=move_7.Geometry, Motion=Z_16)  # -> Geometry, Transform
msplit = MeshSplitPlane(Mesh=move_9.Geometry, Plane=Z_14)  # -> Above, Below
neg_13 = Negative(Value=number_slider_29)
division_6 = Division(A=number_slider_29, B=-2)
Z_17 = UnitZ(Factor=neg_12)

# ---- group: currogation
tpms_4 = TPMS(Wavelength=Slider(125, range=0..5000))
division_7 = Division(A=1, B=Slider(3, range=0..10))
mult_9 = Mult(DistanceObject=tpms_4, Factor=division_7)
tpms_distance_object_modifier_3 = TPMSD(Wavelength=Slider(25, range=0..1000), Modulator=mult_9)
add_4 = Add(DistanceObject=tpms_distance_object_modifier_3, Addend=Slider(0.5, range=0..1))
mult_10 = Mult(DistanceObject=add_4, Factor=Slider(7.5, range=0..200))

# ----
move_11 = Move(Geometry=flatten(mesh_13), Motion=neg_11)  # -> Geometry, Transform
extr_3 = Extrude(Base=move_10.Geometry, Direction=Z_15)
largestmesh = LargestMesh(M=msplit.Above)
Z_18 = UnitZ(Factor=neg_13)
move_12 = Move(Geometry=largestmesh, Motion=Z_17)  # -> Geometry, Transform
Z_19 = UnitZ(Factor=division_6)
number_slider_30 = Slider(350, range=0..1000)
cluster_6 = Cluster_4(num=Slider(10, range=0..10), B=move_12.Geometry)
cap_4 = CapHoles(Brep=extr_3)
move_13 = Move(Geometry=flatten(move_11.Geometry), Motion=Z_18)  # -> Geometry, Transform
bbox_3 = BoundingBox(Content=move_12.Geometry, Plane=PlaneXY(0, 0, 0))  # -> Box, Box_2
neg_14 = Negative(Value=number_slider_30)
clsmsh_2 = CloseMesh(Mesh=move_12.Geometry, Quadrangulate=True)  # -> Closed, Amount, Openings, R
line = Line(cluster_6)
cluster_7 = Cluster(B=bbox_3.Box)  # -> diagonals_2, center_2
Z_20 = UnitZ(Factor=Slider(350, range=0..1000))
dom_4 = ConstructDomain(DomainStart=neg_14, DomainEnd=number_slider_30)
move_14 = Move(Geometry=sunion_2, Motion=Z_19)  # -> Geometry, Transform
move_15 = Move(Geometry=sunion, Motion=Z_19)  # -> Geometry, Transform
move_16 = Move(Geometry=pipe_2, Motion=Z_19)  # -> Geometry, Transform
number_slider_31 = Slider(100, range=0..1000)
xz_4 = XZPlane(Origin=Z_20)
mcx = MeshCurve(Mesh=clsmsh_2.Closed, Curve=line)  # -> Points, Faces; disabled
panel_2 = Panel(cluster_7.diagonals_2)
rectangle_2 = Rectangle(Plane=xz_4, XSize=dom_4, YSize=dom_4, Radius=0)  # -> Rectangle, Length
sift_2 = SiftPattern(List=mcx.Points, SiftPattern=[0, 1])  # -> Output0, Output1
mplane = MeshPlane(Boundary=rectangle_2.Rectangle, WidthCount=number_slider_31, HeightCount=number_slider_31)  # -> Mesh, Area
clean_2 = CleanTree(RemoveNulls=True, RemoveInvalid=True, RemoveEmpty=False, Tree=sift_2.Output0)
clean_3 = CleanTree(RemoveNulls=True, RemoveInvalid=True, RemoveEmpty=False, Tree=sift_2.Output1)
ln_9 = Line(StartPoint=clean_2, EndPoint=clean_3)  # -> flatten(Line)
medges = MeshEdges(Mesh=clsmsh_2.Closed)  # -> NakedEdges, InteriorEdges, NonManifoldEdges
meshbump_2 = MeshBump(D=mult_3, M=mplane.Mesh)  # disabled
whole_height = Brep(move_15.Geometry)
bottom_only = Brep(move_14.Geometry)
ankoring = Brep(move_16.Geometry)
pipe_8 = Pipe(Curve=ln_9, Radius=Slider(6, range=0..10), Caps=1)
interlock_2 = Mesh(cap_4)
holes = Mesh(move_13.Geometry)
mesh_19 = Mesh(flatten(ankoring))
mdif = MeshDifference(MeshesA=clsmsh_2.Closed, MeshesB=holes)
mesh_20 = Mesh(interlock_2)
mesh_21 = Mesh(holes)
mesh_22 = Mesh(bottom_only)
mesh_23 = Mesh(whole_height)
mdif_2 = MeshDifference(MeshesA=mdif, MeshesB=whole_height)
merge_10 = Merge(Data1=mesh_21)
mdif_3 = MeshDifference(MeshesA=mdif_2, MeshesB=mesh_19)
mdif_4 = MeshDifference(MeshesA=mdif_3, MeshesB=mesh_20)
preview_2 = CustomPreview(Geometry=mdif_4, Material=ColourSwatch(SwatchColor=RGB(232, 229, 193)))

# ---- group: currogation
tpms_5 = TPMS(Wavelength=Slider(175, range=0..5000))
division_8 = Division(A=1, B=Slider(3, range=0..10))
mult_11 = Mult(DistanceObject=tpms_5, Factor=division_8)
tpms_distance_object_modifier_4 = TPMSD(Wavelength=Slider(20, range=0..1000), Modulator=mult_11)

# ----
add_5 = Add(DistanceObject=tpms_distance_object_modifier_4, Addend=Slider(0.5, range=0..1))

# ---- group: currogation (continued)
mult_12 = Mult(DistanceObject=add_5, Factor=Slider(5, range=0..200))

# ----
meshbump_3 = MeshBump(D=mult_12, M=wbcatmullclark_5)  # disabled
meshbump_4 = MeshBump(D=mult_12, M=wbcatmullclark_4)  # disabled
meshbump_5 = MeshBump(D=mult_12, M=wbcatmullclark_6)  # disabled
meshbump_6 = MeshBump(D=mult_12, M=wbcatmullclark_3)
meshbump_7 = MeshBump(D=mult_12, M=wbcatmullclark_8)
clsmsh_3 = CloseMesh(Mesh=meshbump_6, Quadrangulate=True)  # -> Closed, Amount, Openings, R
clsmsh_4 = CloseMesh(Mesh=meshbump_7, Quadrangulate=True)  # -> Closed, Amount, Openings, R
flipm_3 = FlipMesh(Mesh=meshbump_3, VertexNormals=True, FaceNormals=True, FaceOrientation=True)
move_17 = Move(Geometry=clsmsh_4.Closed, Motion=Z_13)  # -> Geometry, Transform
move_18 = Move(Geometry=clsmsh_3.Closed, Motion=Z_13)  # -> Geometry, Transform
meshbump_8 = MeshBump(D=mult_12, M=meshbump_2)
mesh_24 = Mesh(meshbump_8)
wbcatmullclark_9 = WeaverbirdsCatmullClarkSubdivision(MeshCurves=mesh_24, Level=Slider(2, range=0..3), SmoothNakedEdges=1)
medges_2 = MeshEdges(Mesh=wbcatmullclark_9)  # -> NakedEdges, InteriorEdges, NonManifoldEdges

# ==== cluster MeshBump
M = ClusterInput()
demesh = DeconstructMesh(Mesh=M)  # -> Vertices, Faces, Colours, Normals
vec = Vector(demesh.Normals)
D = ClusterInput()
evaluatepoints = EvaluatePoints(DistanceObject=D, Points=demesh.Vertices)
multiplication = Multiplication(A=evaluatepoints, B=vec)
addition = Addition(A=demesh.Vertices, B=multiplication)
conmesh = ConstructMesh(Vertices=addition, Faces=demesh.Faces)
M_2 = ClusterOutput(conmesh)

# ==== cluster MeshBumpMinMax
M = ClusterInput()
demesh = DeconstructMesh(Mesh=M)  # -> Vertices, Faces, Colours, Normals
max = ClusterInput()
min = ClusterInput()
vec = Vector(demesh.Normals)
max_2 = Number(max)
min_2 = Number(min)
D = ClusterInput()
evaluatepoints = EvaluatePoints(DistanceObject=D, Points=demesh.Vertices)
multiplication = Multiplication(A=evaluatepoints, B=0)
addition = Addition(A=multiplication, B=min_2)
addition_2 = Addition(A=multiplication, B=max_2)
larger = LargerThan(FirstNumber=evaluatepoints, SecondNumber=max_2)  # -> graft(LargerThan), OrEqualTo
smaller = SmallerThan(FirstNumber=evaluatepoints, SecondNumber=min_2)  # -> graft(SmallerThan), OrEqualTo
merge = Merge(Data1=graft(evaluatepoints), Data2=graft(addition))
item = ListItem(List=merge, Index=smaller.SmallerThan, Wrap=True)
merge_2 = Merge(Data1=item, Data2=graft(addition_2))
item_2 = ListItem(List=merge_2, Index=larger.LargerThan, Wrap=True)  # -> flatten(Item)
multiplication_2 = Multiplication(A=item_2, B=vec)
addition_3 = Addition(A=demesh.Vertices, B=multiplication_2)
conmesh = ConstructMesh(Vertices=addition_3, Faces=demesh.Faces)
M_2 = ClusterOutput(conmesh)

# ==== cluster MeshBumpMinMax_2
M = ClusterInput()
B = ClusterInput()
D = ClusterInput()
demesh = DeconstructMesh(Mesh=M)  # -> Vertices, Faces, Colours, Normals
division = Division(A=1, B=B)
min = ClusterInput()
max = ClusterInput()
abs = Abs(DistanceObject=D)
max_2 = Number(Slider(1, range=0..1))
min_2 = Number(Slider(0, range=0..100))
mult = Mult(DistanceObject=abs, Factor=division)
vec = Vector(demesh.Normals)
evaluatepoints = EvaluatePoints(DistanceObject=mult, Points=demesh.Vertices)  # -> flatten(Values)
D_2 = ClusterInput()
addition = Addition(A=evaluatepoints, B=Slider(-0.01, range=-1..1))
min_3 = Number(min)
max_3 = Number(max)
num = Number(addition)
multiplication = Multiplication(A=num, B=0)
evaluatepoints_2 = EvaluatePoints(DistanceObject=D_2, Points=demesh.Vertices)
addition_2 = Addition(A=multiplication, B=min_2)
addition_3 = Addition(A=multiplication, B=max_2)
larger = LargerThan(FirstNumber=num, SecondNumber=max_2)  # -> graft(LargerThan), OrEqualTo
smaller = SmallerThan(FirstNumber=num, SecondNumber=min_2)  # -> graft(SmallerThan), OrEqualTo
merge = Merge(Data1=graft(num), Data2=graft(addition_2))
item = ListItem(List=merge, Index=smaller.SmallerThan, Wrap=True)
merge_2 = Merge(Data1=item, Data2=graft(addition_3))
item_2 = ListItem(List=merge_2, Index=larger.LargerThan, Wrap=True)  # -> flatten(Item)
multiplication_2 = Multiplication(A=evaluatepoints_2, B=item_2)
num_2 = Number(multiplication_2)
multiplication_3 = Multiplication(A=num_2, B=0)
addition_4 = Addition(A=multiplication_3, B=min_3)
addition_5 = Addition(A=multiplication_3, B=max_3)
larger_2 = LargerThan(FirstNumber=num_2, SecondNumber=max_3)  # -> graft(LargerThan), OrEqualTo
smaller_2 = SmallerThan(FirstNumber=num_2, SecondNumber=min_3)  # -> graft(SmallerThan), OrEqualTo
merge_3 = Merge(Data1=graft(num_2), Data2=graft(addition_4))
item_3 = ListItem(List=merge_3, Index=smaller_2.SmallerThan, Wrap=True)
merge_4 = Merge(Data1=item_3, Data2=graft(addition_5))
item_4 = ListItem(List=merge_4, Index=larger_2.LargerThan, Wrap=True)  # -> flatten(Item)
multiplication_4 = Multiplication(A=item_4, B=vec)
addition_6 = Addition(A=demesh.Vertices, B=multiplication_4)
conmesh = ConstructMesh(Vertices=addition_6, Faces=demesh.Faces)
M_2 = ClusterOutput(conmesh)

# ==== cluster Cluster
B = ClusterInput()
debox = DeconstructBox(Box=flatten(B))  # -> Plane, X, Y, Z
d_dom = D_dom(I=debox.X)  # -> R, R_2
d_dom_2 = D_dom(I=debox.Y)  # -> R, R_2
d_dom_3 = D_dom(I=debox.Z)  # -> R, R_2
pt = ConstructPoint(XCoordinate=d_dom.R_2, YCoordinate=d_dom_2.R_2, ZCoordinate=d_dom_3.R_2)
pt_2 = ConstructPoint(XCoordinate=d_dom.R, YCoordinate=d_dom_2.R, ZCoordinate=d_dom_3.R)
diagonals = Point(pt_2)
center = Point(pt)
center_2 = ClusterOutput(center)
diagonals_2 = ClusterOutput(diagonals)

# ==== cluster LargestMesh
M = ClusterInput()
disjoint = DisjointMesh(Mesh=M)  # -> flatten(Meshes)
bbox = BoundingBox(Content=disjoint, Plane=PlaneXY(0, 0, 0))  # -> Box, Box_2
lng = ListLength(List=disjoint)
volume = Volume(Geometry=bbox.Box)  # -> Volume, Centroid
series = Series(Start=0, Step=1, Count=lng)
sort = SortList(Keys=volume.Volume)  # -> Keys, ValuesA
item = ListItem(List=sort.Keys, Index=0, Wrap=True)  # -> Item1, Item
equals = Equality(FirstNumber=item.Item1, SecondNumber=volume.Volume)  # -> Equality, Inequality
sift = SiftPattern(List=series, SiftPattern=equals.Equality)  # -> Output0, Output1
clean = CleanTree(RemoveNulls=True, RemoveInvalid=True, RemoveEmpty=False, Tree=sift.Output1)
item_2 = ListItem(List=disjoint, Index=clean, Wrap=True)
i = ClusterOutput(item_2)

# ==== cluster Y_lockholes
pockethole_capsule = ClusterInput()
Y = ClusterInput()
A = ClusterInput()
height = ClusterInput()
multiplication = Multiplication(A=A, B=0.5)
pockethole_capsule_2 = Number(pockethole_capsule)
height_2 = Number(height)
subtraction = Subtraction(A=multiplication, B=pockethole_capsule_2)
neg = Negative(Value=subtraction)
addition = Addition(A=height_2, B=Slider(1000, range=0..1000))
merge = Merge(Data1=neg, Data2=subtraction)
pt = ConstructPoint(XCoordinate=merge, YCoordinate=Y, ZCoordinate=addition)
pt_2 = ConstructPoint(XCoordinate=merge, YCoordinate=Y, ZCoordinate=height_2)
ln = Line(StartPoint=pt_2, EndPoint=pt)
capsule = Capsule(Line=ln, Radius=pockethole_capsule_2)
item = ListItem(List=capsule, Index=0, Wrap=True)  # -> Item, Item1
boolean_union = BooleanUnion(DistanceObjectS=item.Item, DistanceObject=item.Item1)
line = Line(ln)
line_2 = ClusterOutput(line)
D = ClusterOutput(boolean_union)

# ==== cluster Cluster_2
number_slider = Slider(3, range=0..10)
B = ClusterInput()
division = Division(A=Slider(0.5, range=0..1), B=number_slider)
division_2 = Division(A=1, B=number_slider)
cluster = Cluster(B=B)  # -> diagonals_2, center_2
pdecon = Deconstruct(Point=cluster.diagonals_2)  # -> XComponent, YComponent, ZComponent
series = Series(Start=division, Step=division_2, Count=number_slider)
d2 = ClusterInput()
multiplication = Multiplication(A=0.5, B=cluster.diagonals_2)
multiplication_2 = Multiplication(A=series, B=pdecon.XComponent)
multiplication_3 = Multiplication(A=series, B=pdecon.ZComponent)
merge = Merge(Data1=Slider(0, range=0..1), Data2=d2, Data3=Slider(0, range=0..1))
pt = ConstructPoint(XCoordinate=multiplication_2, YCoordinate=0, ZCoordinate=graft(multiplication_3))
X = UnitX(Factor=pdecon.XComponent)
Y = UnitY(Factor=pdecon.XComponent)
pt_2 = ConstructPoint(XCoordinate=0, YCoordinate=multiplication_2, ZCoordinate=graft(multiplication_3))
subtraction = Subtraction(A=cluster.center_2, B=multiplication)
merge_2 = Merge(Data1=Slider(1, range=-1..1), Data2=Slider(-1, range=-1..1), Data3=Slider(1, range=-1..1))  # -> graft(Result)
addition = Addition(A=pt, B=subtraction)  # -> graft(Result)
addition_2 = Addition(A=pt_2, B=subtraction)
multiplication_4 = Multiplication(A=merge, B=merge_2)
Y_2 = UnitY(Factor=multiplication_4)
neg = Negative(Value=Y_2)
addition_3 = Addition(A=addition_2, B=X)
addition_4 = Addition(A=addition, B=Y)
addition_5 = Addition(A=Y_2, B=addition_3)  # -> graft(Result)
addition_6 = Addition(A=neg, B=addition_2)  # -> graft(Result)
merge_3 = Merge(Data1=addition_6, Data2=addition_5, Data3=addition_4, Data4=addition)  # -> graft(Result)
path_mapper = PathMapper(merge_3, source="{A;B;C;D;E}", target="{E}")
path_mapper_2 = ClusterOutput(path_mapper)

# ==== cluster Cluster_3
pt = ClusterInput()
S = ClusterInput()
N = ClusterInput()
S_2 = ClusterInput()
N_2 = ClusterInput()
capsule_length = ClusterInput()
pt_2 = Point(pt)
series = Series(Start=S, Step=N, Count=3)  # -> graft(Series)
series_2 = Series(Start=S_2, Step=N_2, Count=3)
B = ClusterInput()
capsule_length_2 = Number(capsule_length)
neg = Negative(Value=series)
brep_cp = BrepClosestPoint(Point=pt_2, Brep=B)  # -> Point, Normal, Distance
merge = Merge(Data1=series_2, Data2=series_2, Data3=series_2)
merge_2 = Merge(Data1=neg, Data2=neg, Data3=neg)  # -> flatten(Result)
rotate = Rotate(Geometry=brep_cp.Normal, Angle=1.570796327, Plane=PlaneXY(0, 0, 0))  # -> Geometry, Transform
rotate_2 = Rotate(Geometry=brep_cp.Normal, Angle=merge_2, Plane=PlaneXY(0, 0, 0))  # -> Geometry, Transform
neg_2 = Negative(Value=capsule_length_2)
pl = PlaneNormal(Origin=Point(0, 0, 0), ZAxis=rotate.Geometry)
rotate_3 = Rotate(Geometry=brep_cp.Normal, Angle=merge_2, Plane=pl)  # -> Geometry, Transform
rotate_4 = Rotate(Geometry=rotate_3.Geometry, Angle=merge, Plane=PlaneXY(0, 0, 0))  # -> Geometry, Transform
multiplication = Multiplication(A=rotate_4.Geometry, B=capsule_length_2)
multiplication_2 = Multiplication(A=rotate_4.Geometry, B=neg_2)
addition = Addition(A=multiplication_2, B=pt_2)
addition_2 = Addition(A=multiplication, B=pt_2)
ln = Line(StartPoint=addition, EndPoint=addition_2)
R = ClusterInput()
line = Line(ln)
capsule = Capsule(Line=ln, Radius=R)
D = ClusterOutput(capsule)
line_2 = ClusterOutput(line)

# ==== cluster Cluster_4
B = ClusterInput()
cluster = Cluster(B=B)  # -> diagonals_2, center_2
num = ClusterInput()
num_2 = Number(num)
division = Division(A=cluster.diagonals_2, B=num_2)
pdecon = Deconstruct(Point=division)  # -> XComponent, YComponent, ZComponent
round = Round(Number=pdecon.XComponent)  # -> Nearest, Floor, Ceiling
round_2 = Round(Number=pdecon.YComponent)  # -> Nearest, Floor, Ceiling
round_3 = Round(Number=pdecon.ZComponent)  # -> Nearest, Floor, Ceiling
multiplication = Multiplication(A=round.Nearest, B=0.5)
multiplication_2 = Multiplication(A=round_2.Nearest, B=0.5)
multiplication_3 = Multiplication(A=round_3.Nearest, B=0.5)
neg = Negative(Value=multiplication)
neg_2 = Negative(Value=multiplication_2)
neg_3 = Negative(Value=multiplication_3)
series = Series(Start=neg, Step=1, Count=round.Nearest)
series_2 = Series(Start=neg_3, Step=1, Count=round_3.Nearest)
series_3 = Series(Start=neg_2, Step=1, Count=round_2.Nearest)
multiplication_4 = Multiplication(A=num_2, B=series)
multiplication_5 = Multiplication(A=num_2, B=neg_2)
multiplication_6 = Multiplication(A=num_2, B=series_2)
multiplication_7 = Multiplication(A=num_2, B=multiplication_2)
pt = ConstructPoint(XCoordinate=multiplication_4, YCoordinate=multiplication_7, ZCoordinate=graft(multiplication_6))
pt_2 = ConstructPoint(XCoordinate=multiplication_4, YCoordinate=multiplication_5, ZCoordinate=graft(multiplication_6))
addition = Addition(A=cluster.center_2, B=pt)
addition_2 = Addition(A=cluster.center_2, B=pt_2)
ln = Line(StartPoint=addition_2, EndPoint=addition)
L = ClusterOutput(ln)

# ==== cluster Interlock
num = ClusterInput()
pt = ClusterInput()
num_2 = Number(num)
pt_2 = Point(pt)
item = ListItem(List=pt_2, Index=0, Wrap=True)  # -> Item1, Item
subtraction = Subtraction(A=item.Item1, B=item.Item)
addition = Addition(A=item.Item1, B=subtraction)
subtraction_2 = Subtraction(A=item.Item, B=subtraction)
merge = Merge(Data1=subtraction_2, Data2=pt_2, Data3=addition)
pline = PolyLine(Vertices=merge, Closed=False)
neg = Negative(Value=num_2)
offset = OffsetCurve(Curve=pline, Distance=num_2, Plane=PlaneXY(0, 0, 0), Corners=1)
offset_2 = OffsetCurve(Curve=pline, Distance=neg, Plane=PlaneXY(0, 0, 0), Corners=1)
end = EndPoints(Curve=offset_2)  # -> Start, End
end_2 = EndPoints(Curve=offset)  # -> Start, End
ln = Line(StartPoint=end.Start, EndPoint=end_2.Start)
ln_2 = Line(StartPoint=end.End, EndPoint=end_2.End)
merge_2 = Merge(Data1=ln, Data2=offset_2, Data3=offset, Data4=ln_2)
join = JoinCurves(Curves=merge_2, Preserve=False)
C = ClusterOutput(join)

# ==== cluster D_dom
I = ClusterInput()
dedomain = DeconstructDomain(Domain=I)  # -> Start, End
subtraction = Subtraction(A=dedomain.End, B=dedomain.Start)
addition = Addition(A=dedomain.Start, B=dedomain.End)
R = ClusterOutput(subtraction)
multiplication = Multiplication(A=addition, B=0.5)
R_2 = ClusterOutput(multiplication)
