# Grasshopper definition shape_gen.gh (Grasshopper 1.0.7)
# plug-ins: Weaverbird, Pufferfish

number_slider = Slider(250, range=0..1000)
python = GhPythonScript(
    top_box_side=Slider(500, range=0..1000),
    side_w=Slider(250, range=0..1000),
    side_h=Slider(250, range=0..1000),
    extra_b_h=number_slider)  # -> out, pd, bx
# ---------- python: Python ----------
# import scripts externally, relative folder
import sys
import os

import Grasshopper

path=os.path.dirname(Grasshopper.Instances.ActiveCanvas.Document.FilePath)
sys.path.append(path)

import volume as vlm
reload(vlm)

pd, bx = vlm.pedistle_with_tolerance(top_box_side, side_w, side_h, extra_b_h)

print(vlm.print_mesh(pd))
print(vlm.print_mesh(bx))
# ---------- end python ----------
flipm = FlipMesh(Mesh=python.pd, VertexNormals=True, FaceNormals=True, FaceOrientation=True)
flipm_2 = FlipMesh(Mesh=python.bx, VertexNormals=True, FaceNormals=True, FaceOrientation=True)
panel = Panel(python.out)
mesh = Mesh(flipm)
mesh_2 = Mesh(flipm_2)
mint = MeshIntersection(MeshesA=mesh, MeshesB=mesh_2)
wbsplitquads = WeaverbirdsConstantQuadsSplitSubdivision(MeshCurves=mesh, Level=Slider(2, range=1..3), SmoothNakedEdges=1)
Z = UnitZ(Factor=number_slider)
wbcatmullclark = WeaverbirdsCatmullClarkSubdivision(MeshCurves=wbsplitquads, Level=Slider(3, range=1..3), SmoothNakedEdges=1)
wbsplitquads_2 = WeaverbirdsConstantQuadsSplitSubdivision(MeshCurves=mesh_2, Level=Slider(3, range=1..3), SmoothNakedEdges=1)
xy = XYPlane(Origin=Z)
mesh_3 = Mesh(wbcatmullclark)
wbsplitquads_3 = WeaverbirdsConstantQuadsSplitSubdivision(MeshCurves=wbsplitquads_2, Level=Slider(1, range=1..3), SmoothNakedEdges=1)
msplit = MeshSplitPlane(Mesh=mesh_3, Plane=xy)  # -> Above, Below
mesh_4 = Mesh(msplit.Above)
clsmsh = CloseMesh(Mesh=mesh_4, Quadrangulate=True)  # -> Closed, Amount, Openings, R
mshclsd = IsMeshClosed(Mesh=clsmsh.Closed)
