# Grasshopper definition shape_gen_f.gh (Grasshopper 1.0.7)
# plug-ins: Weaverbird, Pufferfish

number_slider = Slider(200, range=0..1000)
python = GhPythonScript(
    top_box_side=Slider(500, range=0..1000),
    side_w=Slider(100, range=0..1000),
    side_h=Slider(150, range=0..1000),
    extra_b_h=number_slider)  # -> out, pd, bx
# ---------- python: Python ----------
# import scripts externally, relative folder
import sys
import os

import Grasshopper

path=os.path.dirname(Grasshopper.Instances.ActiveCanvas.Document.FilePath)
sys.path.append(path)

import volume as vlm
reload(vlm)

pd, bx = vlm.pedistle_with_tolerance(top_box_side, side_w, side_h, extra_b_h)

print(vlm.print_mesh(pd))
print(vlm.print_mesh(bx))
# ---------- end python ----------
flipm = FlipMesh(Mesh=python.pd, VertexNormals=True, FaceNormals=True, FaceOrientation=True)
flipm_2 = FlipMesh(Mesh=python.bx, VertexNormals=True, FaceNormals=True, FaceOrientation=True)
panel = Panel(python.out)
mesh = Mesh(flipm)
mesh_2 = Mesh(flipm_2)
mint = MeshIntersection(MeshesA=mesh, MeshesB=mesh_2)
mesh_3 = Mesh(mint)
bbox_xy = BboxXy(C=mint)
wbsplitquads = WeaverbirdsConstantQuadsSplitSubdivision(MeshCurves=mesh_2, Level=Slider(3, range=1..3), SmoothNakedEdges=1)
number_slider_2 = Slider(200, range=0..500)
panel_2 = Panel(bbox_xy)
pi = Pi(Factor=2)
wbsplitquads_2 = WeaverbirdsConstantQuadsSplitSubdivision(MeshCurves=wbsplitquads, Level=Slider(1, range=1..3), SmoothNakedEdges=1)
pi_2 = Pi(Factor=2)
division = Division(A=number_slider_2, B=pi)
wbsplitquads_3 = WeaverbirdsConstantQuadsSplitSubdivision(MeshCurves=mesh, Level=Slider(1, range=1..3), SmoothNakedEdges=1)
division_2 = Division(A=Slider(20, range=0..25), B=pi_2)
Z = UnitZ(Factor=number_slider)
wbcatmullclark = WeaverbirdsCatmullClarkSubdivision(MeshCurves=wbsplitquads_3, Level=Slider(3, range=1..3), SmoothNakedEdges=1)
xy = XYPlane(Origin=Z)
mesh_4 = Mesh(wbcatmullclark)
wbcatmullclark_2 = WeaverbirdsCatmullClarkSubdivision(MeshCurves=mesh_4, Level=Slider(3, range=1..3), SmoothNakedEdges=1)
demesh = DeconstructMesh(Mesh=wbcatmullclark_2)  # -> Vertices, Faces, Colours, Normals
vec = Vector(demesh.Normals)
pt = Point(demesh.Vertices)
pt_2 = Point(pt)
gyroid = GhPythonScript(pts=pt_2, n=vec, period=number_slider_2)  # -> out, pts; inputs pts: list of Point3d, n: list of Vector3d
# ---------- gyroid: Python ----------
from math import sin, cos

n_pts = []
for i, pt in enumerate(pts):
    u, v, w = (pt.X/period, pt.Y/period, pt.Z/period)
    
    v = ( sin(u) * cos(v) + sin(v) * cos(w) + sin(w) * cos(u) ) * .3333 + .5
    
    n_pts.append(n[i]*v + pt)
    
pts = n_pts
# ---------- end gyroid ----------
gyroid_2 = GhPythonScript(pts=pt, n=vec, period=division, amplitude=Slider(60, range=0..100))  # -> out, pts; inputs pts: list of Point3d, n: list of Vector3d
# ---------- gyroid_2: Python ----------
from math import sin, cos

n_pts = []
for i, pt in enumerate(pts):
    u, v, w = (pt.X/period, pt.Y/period, pt.Z/period)
    
    v = ( sin(u) * cos(v) + sin(v) * cos(w) + sin(w) * cos(u) ) * .3333
    
    n_pts.append(n[i]*v*amplitude + pt)
    
pts = n_pts
# ---------- end gyroid_2 ----------
gyroid_3 = GhPythonScript(pts=pt, n=vec, period=division_2, amplitude=Slider(17.5, range=0..100))  # -> out, pts; inputs pts: list of Point3d, n: list of Vector3d
# ---------- gyroid_3: Python ----------
from math import sin, cos

n_pts = []

p_inv = 1. / period

for i, pt in enumerate(pts):
    u, v, w = (pt.X*p_inv, pt.Y*p_inv, pt.Z*p_inv)
    salt_val = ( sin(u) * cos(v) + sin(v) * cos(w) + sin(w) * cos(u) ) * .3333 
    s_val = p_inv*(1. + .01 * salt_val)
    
    u, v, w = (pt.X*s_val, pt.Y*s_val, pt.Z*s_val)
    
    v = ( sin(u) * cos(v) + sin(v) * cos(w) + sin(w) * cos(u) ) * .3333
    
    n_pts.append(n[i]*v*amplitude + pt)
    
pts = n_pts
# ---------- end gyroid_3 ----------
conmesh = ConstructMesh(Vertices=gyroid_3.pts, Faces=demesh.Faces)
msplit = MeshSplitPlane(Mesh=mesh_4, Plane=xy)  # -> Above, Below
clsmsh = CloseMesh(Mesh=msplit.Above, Quadrangulate=True)  # -> Closed, Amount, Openings, R
msplit_2 = MeshSplitPlane(Mesh=conmesh, Plane=xy)  # -> Above, Below
pt_3 = Point()  # disabled
pt_4 = Point(gyroid_3.pts)  # disabled
item = ListItem(List=msplit_2.Above, Index=0, Wrap=True)
mesh_5 = Mesh(msplit_2.Above)
colour = ColourPicker(PickedColour=RGB(169, 168, 154))
ln = Line(StartPoint=pt_3, EndPoint=pt_4)  # disabled
clsmsh_2 = CloseMesh(Mesh=item, Quadrangulate=True)  # -> Closed, Amount, Openings, R
X = UnitX(Factor=1)
Y = UnitY(Factor=Slider(500, range=0..1000))
num = Number(number_slider)
mshclsd = IsMeshClosed(Mesh=clsmsh_2.Closed)
xz = XZPlane(Origin=Point(0, 0, 0))
neg = Negative(Value=Y)
preview = CustomPreview(Geometry=clsmsh_2.Closed, Material=colour)
xz_2 = XZPlane(Origin=Y)
division_3 = Division(A=Slider(800, range=0..1000), B=2)
bbox_xy_2 = BboxXy(C=clsmsh_2.Closed)
addition = Addition(A=Slider(800, range=0..1000), B=num)
number_slider_3 = Slider(1.5, range=0..10)
sec = MeshPlane(Mesh=mint, Plane=xz)
xz_3 = XZPlane(Origin=neg)
neg_2 = Negative(Value=division_3)
rectangle = Rectangle(Plane=xz_2, XSize=Domain(-1, 1), YSize=Domain(-2, 2), Radius=0)  # -> Rectangle, Length
panel_3 = Panel(bbox_xy_2)
dom = ConstructDomain(DomainStart=neg_2, DomainEnd=division_3)
dom_2 = ConstructDomain(DomainStart=num, DomainEnd=addition)
move = Move(Geometry=sec, Motion=neg)  # -> Geometry, Transform
swatch = ColourSwatch(SwatchColor=RGB(172, 0, 0))
pipe = Pipe(Curve=move.Geometry, Radius=number_slider_3, Caps=2)
rectangle_2 = Rectangle(Plane=xz_3, XSize=dom, YSize=dom_2, Radius=0)  # -> Rectangle, Length
swatch_2 = ColourSwatch(SwatchColor=RGB(255, 255, 255))
pipe_2 = Pipe(Curve=rectangle_2.Rectangle, Radius=number_slider_3, Caps=2)
preview_2 = CustomPreview(Geometry=pipe, Material=swatch)
preview_3 = CustomPreview(Geometry=pipe_2, Material=swatch)

# ==== cluster BboxXy
C = ClusterInput()
bbox = BoundingBox(Content=C, Plane=PlaneXY(0, 0, 0))  # -> Box, Box_2
debox = DeconstructBox(Box=bbox.Box)  # -> Plane, X, Y, Z
dedomain = DeconstructDomain(Domain=debox.Y)  # -> Start, End
dedomain_2 = DeconstructDomain(Domain=debox.X)  # -> Start, End
subtraction = Subtraction(A=dedomain.End, B=dedomain.Start)
subtraction_2 = Subtraction(A=dedomain_2.End, B=dedomain_2.Start)
merge = Merge(Data1=subtraction_2, Data2=subtraction)
R = ClusterOutput(merge)
