# Grasshopper definition shape_gen_h.gh (Grasshopper 1.0.7)
# plug-ins: Weaverbird, Pufferfish, Axolotl Info

number_slider = Slider(500, range=0..1000)
number_slider_2 = Slider(200, range=0..1000)
number_slider_3 = Slider(100, range=0..1000)
number_slider_4 = Slider(150, range=0..1000)
python = GhPythonScript(top_box_side=number_slider, side_w=number_slider_3, side_h=number_slider_4, extra_b_h=number_slider_2)  # -> out, pd, bx
# ---------- python: Python ----------
# import scripts externally, relative folder
import sys
import os

import Grasshopper

path=os.path.dirname(Grasshopper.Instances.ActiveCanvas.Document.FilePath)
sys.path.append(path)

import volume as vlm
reload(vlm)

pd, bx = vlm.pedistle_with_tolerance(top_box_side, side_w, side_h, extra_b_h)

print(vlm.print_mesh(pd))
print(vlm.print_mesh(bx))
# ---------- end python ----------
top_box_side = Number(number_slider)
extra_b_h = Number(number_slider_2)
side_w = Number(number_slider_3)
side_h = Number(number_slider_4)
addition = Addition(A=side_h, B=extra_b_h)
division = Division(A=top_box_side, B=2)
addition_2 = Addition(A=side_h, B=extra_b_h, C=division)
box = Box(python.bx)
debox = DeconstructBox(Box=box)  # -> Plane, X, Y, Z
expression = Expression(x=top_box_side, y=side_w, Expression="x+y*2")
Z = UnitZ(Factor=extra_b_h)
flipm = FlipMesh(Mesh=python.pd, VertexNormals=True, FaceNormals=True, FaceOrientation=True)
flipm_2 = FlipMesh(Mesh=python.bx, VertexNormals=True, FaceNormals=True, FaceOrientation=True)
dedomain = DeconstructDomain(Domain=debox.Z)  # -> Start, End
panel = Panel(python.out)
Z_2 = UnitZ(Factor=addition_2)
multiplication = Multiplication(A=division, B=2)
neg = Negative(Value=division)
pt = ConstructPoint(XCoordinate=neg, YCoordinate=neg, ZCoordinate=addition)
pt_2 = ConstructPoint(XCoordinate=expr("x*.5", expression), YCoordinate=0, ZCoordinate=number_slider_2)
vec = VectorXYZ(XComponent=side_h, YComponent=0, ZComponent=side_w)  # -> Vector, Length
pi = Pi(Factor=0.5)
Z_3 = UnitZ(Factor=-1)
dom = ConstructDomain(DomainStart=neg, DomainEnd=division)
series = Series(Start=0, Step=pi, Count=4)
mesh = Mesh(flipm)
mesh_2 = Mesh(flipm_2)
side_length = Number(top_box_side)
xy = XYPlane(Origin=Z_2)
box_2 = DomainBox(Base=debox.Plane, X=debox.X, Y=debox.Y, Z=dedomain.End)
box_3 = DomainBox(Base=PlaneXY(0, 0, 0), X=dom, Y=dom, Z=multiplication)
box_4 = Box(DimensionX=side_length, DimensionY=side_length, DimensionZ=side_length, Radius=0, Plane=xy)
rotate = Rotate(Geometry=pt_2, Angle=series, Plane=PlaneXY(0, 0, 0))  # -> Geometry, Transform
rotate_2 = Rotate(Geometry=vec.Vector, Angle=series, Plane=PlaneXY(0, 0, 0))  # -> Geometry, Transform
mint = MeshIntersection(MeshesA=mesh, MeshesB=mesh_2)
mesh_3 = Mesh(mint)
box_5 = Box(DimensionX=debox.X, DimensionY=debox.Y, DimensionZ=debox.Z, Radius=0, Plane=PlaneXY(0, 0, 0))
bbox_xy = BboxXy(C=mint)
wbsplitquads = WeaverbirdsConstantQuadsSplitSubdivision(MeshCurves=mesh_2, Level=Slider(3, range=1..3), SmoothNakedEdges=1)
number_slider_5 = Slider(200, range=0..500)
number_slider_6 = Slider(0.1, range=0..0.1)
panel_2 = Panel(bbox_xy)
number_slider_7 = Slider(0.0001, range=0..0.0001)
cone = Cone(RadiusA=4, RadiusB=2, Height=8, Plane=PlaneXY(0, 0, 0))
pi_2 = Pi(Factor=2)
number_slider_8 = Slider(50, range=0..100)
polygonextrusion = PolygonExtrusion(Radius=4, SecondRadius=-1, Height=8, Number=6, Plane=PlaneXY(0, 0, 0))
wbsplitquads_2 = WeaverbirdsConstantQuadsSplitSubdivision(MeshCurves=wbsplitquads, Level=Slider(1, range=1..3), SmoothNakedEdges=1)
pl = PlaneNormal(Origin=Z, ZAxis=Z_3)
pl_2 = PlaneNormal(Origin=rotate.Geometry, ZAxis=rotate_2.Geometry)
plane = Plane(Origin=rotate.Geometry, Normal=rotate_2.Geometry)
number_slider_9 = Slider(3e-06, range=0..1)
number_slider_10 = Slider(200, range=0..1000)
pi_3 = Pi(Factor=2)
division_2 = Division(A=number_slider_5, B=pi_2)
number_slider_11 = Slider(200, range=0..1000)
Z_4 = UnitZ(Factor=number_slider_2)
plane_2 = Plane(Origin=Z_4, Normal=Z_3)
wbsplitquads_3 = WeaverbirdsConstantQuadsSplitSubdivision(MeshCurves=mesh, Level=Slider(1, range=1..3), SmoothNakedEdges=1)
merge = Merge(Data1=plane, Data2=plane_2)  # -> flatten(Result)
boolean_union = BooleanUnion(DistanceObjectS=merge)
boolean_subtract = BooleanSubtract(DistanceObject=box_4, DistanceObject_2=boolean_union)
mult = Mult(DistanceObject=box_4, Factor=-1)
number_slider_12 = Slider(100, range=0..100)
boolean_intersect = BooleanIntersect(DistanceObjectS=plane, DistanceObject=plane_2)
division_3 = Division(A=Slider(20, range=0..25), B=pi_3)
number_slider_13 = Slider(4, range=0..10)
shift = ShiftList(List=pl_2, Shift=1, Wrap=True)
ppx = PlanePlane(PlaneA=pl_2, PlaneB=pl)
division_4 = Division(A=1, B=Slider(6, range=0..10))
wbcatmullclark = WeaverbirdsCatmullClarkSubdivision(MeshCurves=wbsplitquads_3, Level=Slider(3, range=1..3), SmoothNakedEdges=1)
smoothunion = SmoothUnion(DistanceObject=boolean_intersect, DistanceObject_2=box_4, Radius=Slider(100, range=0..100))
boolean_union_2 = BooleanUnion(DistanceObjectS=boolean_intersect, DistanceObject=box_4)
xy_2 = XYPlane(Origin=Z_4)
boolean_union_3 = BooleanUnion(DistanceObjectS=merge, DistanceObject=box_4)
number_slider_14 = Slider(1, range=0..1)
mesh_4 = Mesh(wbcatmullclark)
ppx_2 = PlanePlane(PlaneA=pl_2, PlaneB=shift)
wbcatmullclark_2 = WeaverbirdsCatmullClarkSubdivision(MeshCurves=mesh_4, Level=Slider(3, range=1..3), SmoothNakedEdges=1)
demesh = DeconstructMesh(Mesh=wbcatmullclark_2)  # -> Vertices, Faces, Colours, Normals
vec_2 = Vector(demesh.Normals)
pt_3 = Point(demesh.Vertices)
pt_4 = Point(pt_3)
gyroid = GhPythonScript(pts=pt_4, n=vec_2, period=number_slider_5)  # -> out, pts; inputs pts: list of Point3d, n: list of Vector3d
# ---------- gyroid: Python ----------
from math import sin, cos

n_pts = []
for i, pt in enumerate(pts):
    u, v, w = (pt.X/period, pt.Y/period, pt.Z/period)
    
    v = ( sin(u) * cos(v) + sin(v) * cos(w) + sin(w) * cos(u) ) * .3333 + .5
    
    n_pts.append(n[i]*v + pt)
    
pts = n_pts
# ---------- end gyroid ----------
gyroid_2 = GhPythonScript(pts=pt_3, n=vec_2, period=division_2, amplitude=Slider(60, range=0..100))  # -> out, pts; inputs pts: list of Point3d, n: list of Vector3d; disabled
# ---------- gyroid_2: Python ----------
from math import sin, cos

n_pts = []
for i, pt in enumerate(pts):
    u, v, w = (pt.X/period, pt.Y/period, pt.Z/period)
    
    v = ( sin(u) * cos(v) + sin(v) * cos(w) + sin(w) * cos(u) ) * .3333
    
    n_pts.append(n[i]*v*amplitude + pt)
    
pts = n_pts
# ---------- end gyroid_2 ----------
gyroid_3 = GhPythonScript(pts=pt_3, n=vec_2, period=division_3, amplitude=Slider(17.5, range=0..100))  # -> out, pts; inputs pts: list of Point3d, n: list of Vector3d
# ---------- gyroid_3: Python ----------
from math import sin, cos

n_pts = []

p_inv = 1. / period

for i, pt in enumerate(pts):
    u, v, w = (pt.X*p_inv, pt.Y*p_inv, pt.Z*p_inv)
    salt_val = ( sin(u) * cos(v) + sin(v) * cos(w) + sin(w) * cos(u) ) * .3333 
    s_val = p_inv*(1. + .01 * salt_val)
    
    u, v, w = (pt.X*s_val, pt.Y*s_val, pt.Z*s_val)
    
    v = ( sin(u) * cos(v) + sin(v) * cos(w) + sin(w) * cos(u) ) * .3333
    
    n_pts.append(n[i]*v*amplitude + pt)
    
pts = n_pts
# ---------- end gyroid_3 ----------
conmesh = ConstructMesh(Vertices=gyroid_3.pts, Faces=demesh.Faces)
msplit = MeshSplitPlane(Mesh=mesh_4, Plane=xy_2)  # -> Above, Below
end = EndPoints(Curve=ppx)  # -> Start, End
end_2 = EndPoints(Curve=ppx_2)  # -> Start, End
mult_2 = Mult(DistanceObject=boolean_union_3, Factor=-1)
boolean_intersect_2 = BooleanIntersect(DistanceObjectS=box_4, DistanceObject=boolean_union_3)
clsmsh = CloseMesh(Mesh=msplit.Above, Quadrangulate=True)  # -> Closed, Amount, Openings, R
addition_3 = Addition(A=end.Start, B=end.End)
addition_4 = Addition(A=end_2.Start, B=end_2.End)
msplit_2 = MeshSplitPlane(Mesh=conmesh, Plane=xy_2)  # -> Above, Below
pt_5 = Point()  # disabled
pt_6 = Point(gyroid_3.pts)  # disabled
multiplication_2 = Multiplication(A=addition_4, B=0.5)
multiplication_3 = Multiplication(A=addition_3, B=0.5)
item = ListItem(List=msplit_2.Above, Index=0, Wrap=True)
mesh_5 = Mesh(msplit_2.Above)
colour = ColourPicker(PickedColour=RGB(161, 138, 154))
scale = Scale(Geometry=ppx_2, Center=multiplication_2, Factor=Slider(1000, range=0..1000))  # -> Geometry, Transform
scale_2 = Scale(Geometry=ppx, Center=multiplication_3, Factor=Slider(1000, range=0..1000))  # -> Geometry, Transform
ln = Line(StartPoint=pt_5, EndPoint=pt_6)  # disabled
clsmsh_2 = CloseMesh(Mesh=item, Quadrangulate=True)  # -> Closed, Amount, Openings, R
number_slider_15 = Slider(20, range=0..25)
tpms = TPMS(Wavelength=number_slider_15)
mult_3 = Mult(DistanceObject=tpms, Factor=division_4)
boolean_union_4 = BooleanUnion(DistanceObjectS=boolean_subtract, DistanceObject=tpms)
add = Add(DistanceObject=mult_3, Addend=Slider(0.5, range=0..1))
boolean_intersect_3 = BooleanIntersect(DistanceObjectS=smoothunion, DistanceObject=tpms)
boolean_subtract_2 = BooleanSubtract(DistanceObject=tpms, DistanceObject_2=boolean_subtract)
X = UnitX(Factor=1)
Y = UnitY(Factor=Slider(500, range=0..1000))
num = Number(number_slider_2)
mshclsd = IsMeshClosed(Mesh=clsmsh_2.Closed)
xz = XZPlane(Origin=Point(0, 0, 0))
neg_2 = Negative(Value=Y)
pi_4 = Pi(Factor=2)
tpms_2 = TPMS(Wavelength=Slider(50, range=0..1000))
number_slider_16 = Slider(17.5, range=0..100)
amplitude = Number(number_slider_16)
mult_4 = Mult(DistanceObject=add, Factor=amplitude)
overlay = Overlay(DistanceObject=smoothunion, DistanceObject_2=mult_4, Factor=number_slider_14)
isosurface_distancefunction = IsosurfaceDistancefunction(
    BoundingBox=box_2,
    NumberX=number_slider_11,
    NumberY=number_slider_11,
    NumberZ=number_slider_11,
    Isovalue=0,
    Capped=True,
    DistanceObject=overlay,
    Refine=True)
preview = CustomPreview(
    Geometry=isosurface_distancefunction,
    Material={diffuse=RGB(221, 160, 221), emission=RGB(66, 48, 66), shine=0.5, specular=RGB(255, 255, 255), transparency=0})
mshclsd_2 = IsMeshClosed(Mesh=isosurface_distancefunction)
preview_2 = CustomPreview(Geometry=clsmsh_2.Closed, Material=colour)
xz_2 = XZPlane(Origin=Y)
division_5 = Division(A=Slider(800, range=0..1000), B=2)
division_6 = Division(A=1, B=Slider(6, range=0..10))
division_7 = Division(A=number_slider_15, B=pi_4)
division_8 = Division(A=1, B=division_7)
bbox_xy_2 = BboxXy(C=clsmsh_2.Closed)
addition_5 = Addition(A=Slider(800, range=0..1000), B=num)
number_slider_17 = Slider(1.5, range=0..10)
sec = MeshPlane(Mesh=mint, Plane=xz)
xz_3 = XZPlane(Origin=neg_2)
neg_3 = Negative(Value=division_5)
rectangle = Rectangle(Plane=xz_2, XSize=Domain(-1, 1), YSize=Domain(-2, 2), Radius=0)  # -> Rectangle, Length
mult_5 = Mult(DistanceObject=tpms_2, Factor=division_6)
panel_3 = Panel(bbox_xy_2)
dom_2 = ConstructDomain(DomainStart=neg_3, DomainEnd=division_5)
dom_3 = ConstructDomain(DomainStart=num, DomainEnd=addition_5)
move = Move(Geometry=sec, Motion=neg_2)  # -> Geometry, Transform
number_slider_18 = Slider(300, range=0..1000)
add_2 = Add(DistanceObject=mult_5, Addend=Slider(0.5, range=0..1))
swatch = ColourSwatch(SwatchColor=RGB(172, 0, 0))
pipe = Pipe(Curve=move.Geometry, Radius=number_slider_17, Caps=2)
rectangle_2 = Rectangle(Plane=xz_3, XSize=dom_2, YSize=dom_3, Radius=0)  # -> Rectangle, Length
mult_6 = Mult(DistanceObject=add_2, Factor=Slider(5, range=0..200))
boolean_intersect_4 = BooleanIntersect(DistanceObjectS=box_4, DistanceObject=boolean_union_3)
tpms_distance_object_modifier = TPMSD(Wavelength=Slider(150, range=0..1000), Modulator=mult_6)
swatch_2 = ColourSwatch(SwatchColor=RGB(255, 255, 255))
pipe_2 = Pipe(Curve=rectangle_2.Rectangle, Radius=number_slider_17, Caps=2)
preview_3 = CustomPreview(Geometry=pipe, Material=swatch)
boolean_intersect_5 = BooleanIntersect(DistanceObjectS=tpms_distance_object_modifier, DistanceObject=smoothunion)
preview_4 = CustomPreview(Geometry=pipe_2, Material=swatch)
overlay_2 = Overlay(DistanceObject=boolean_intersect_5, DistanceObject_2=mult_4, Factor=number_slider_14)
isosurface_distancefunction_2 = IsosurfaceDistancefunction(
    BoundingBox=box_2,
    NumberX=number_slider_18,
    NumberY=number_slider_18,
    NumberZ=number_slider_18,
    Isovalue=0,
    Capped=True,
    DistanceObject=boolean_intersect_5,
    Refine=True)
demesh_2 = DeconstructMesh(Mesh=isosurface_distancefunction_2)  # -> Vertices, Faces, Colours, Normals
vec_3 = Vector(demesh_2.Normals)
gyroid_4 = GhPythonScript(pts=demesh_2.Vertices, n=vec_3, period=division_7, amplitude=number_slider_16)  # -> out, pts; inputs pts: list of Point3d, n: list of Vector3d; same code as gyroid_3
conmesh_2 = ConstructMesh(Vertices=gyroid_4.pts, Faces=demesh_2.Faces)
preview_5 = CustomPreview(Geometry=conmesh_2, Material=colour)
isosurface_octree = IsosurfaceOctree(Origin=Point(0, 0, 0), WorldSize=10, Isovalue=0, Subdivisions=4, DistanceObject=boolean_intersect_5)
preview_6 = CustomPreview(
    Geometry=isosurface_distancefunction_2,
    Material={diffuse=RGB(221, 160, 221), emission=RGB(66, 48, 66), shine=0.5, specular=RGB(255, 255, 255), transparency=0})

# ==== cluster BboxXy
C = ClusterInput()
bbox = BoundingBox(Content=C, Plane=PlaneXY(0, 0, 0))  # -> Box, Box_2
debox = DeconstructBox(Box=bbox.Box)  # -> Plane, X, Y, Z
dedomain = DeconstructDomain(Domain=debox.Y)  # -> Start, End
dedomain_2 = DeconstructDomain(Domain=debox.X)  # -> Start, End
subtraction = Subtraction(A=dedomain.End, B=dedomain.Start)
subtraction_2 = Subtraction(A=dedomain_2.End, B=dedomain_2.Start)
merge = Merge(Data1=subtraction_2, Data2=subtraction)
R = ClusterOutput(merge)
