# Grasshopper definition shape_gen_l.gh (Grasshopper 1.0.7)
# plug-ins: Weaverbird, Pufferfish, Axolotl Info

number_slider = Slider(500, range=0..1000)
number_slider_2 = Slider(200, range=0..1000)
number_slider_3 = Slider(100, range=0..1000)
number_slider_4 = Slider(150, range=0..1000)
number_slider_5 = Slider(200, range=0..1000)
python = GhPythonScript(top_box_side=number_slider, side_w=number_slider_3, side_h=number_slider_4, extra_b_h=number_slider_2)  # -> out, pd, bx
# ---------- python: Python ----------
# import scripts externally, relative folder
import sys
import os

import Grasshopper

path=os.path.dirname(Grasshopper.Instances.ActiveCanvas.Document.FilePath)
sys.path.append(path)

import volume as vlm
reload(vlm)

pd, bx = vlm.pedistle_with_tolerance(top_box_side, side_w, side_h, extra_b_h)

print(vlm.print_mesh(pd))
print(vlm.print_mesh(bx))
# ---------- end python ----------
python_2 = GhPythonScript(
    top_box_side=Slider(500, range=0..1000),
    side_w=Slider(100, range=0..1000),
    side_h=Slider(150, range=0..1000),
    extra_b_h=number_slider_5)  # -> out, pd, bx; same code as python
flipm = FlipMesh(Mesh=python_2.pd, VertexNormals=True, FaceNormals=True, FaceOrientation=True)
flipm_2 = FlipMesh(Mesh=python_2.bx, VertexNormals=True, FaceNormals=True, FaceOrientation=True)
panel = Panel(python_2.out)
Z = UnitZ(Factor=number_slider_5)
mesh = Mesh(flipm)
mesh_2 = Mesh(flipm_2)
Z_2 = UnitZ(Factor=number_slider_2)
mint = MeshIntersection(MeshesA=mesh, MeshesB=mesh_2)
mesh_3 = Mesh(mint)
bbox_xy = BboxXy(C=mint)
wbsplitquads = WeaverbirdsConstantQuadsSplitSubdivision(MeshCurves=mesh_2, Level=Slider(3, range=1..3), SmoothNakedEdges=1)
number_slider_6 = Slider(200, range=0..500)
panel_2 = Panel(bbox_xy)
top_box_side = Number(number_slider)
pi = Pi(Factor=2)
side_w = Number(number_slider_3)
extra_b_h = Number(number_slider_2)
side_h = Number(number_slider_4)
box = Box(python.bx)
wbsplitquads_2 = WeaverbirdsConstantQuadsSplitSubdivision(MeshCurves=wbsplitquads, Level=Slider(1, range=1..3), SmoothNakedEdges=1)
debox = DeconstructBox(Box=box)  # -> Plane, X, Y, Z
pi_2 = Pi(Factor=2)
division = Division(A=number_slider_6, B=pi)
expression = Expression(x=top_box_side, y=side_w, Expression="x+y*2")
Z_3 = UnitZ(Factor=extra_b_h)
wbsplitquads_3 = WeaverbirdsConstantQuadsSplitSubdivision(MeshCurves=mesh, Level=Slider(1, range=1..3), SmoothNakedEdges=1)
dedomain = DeconstructDomain(Domain=debox.Z)  # -> Start, End
division_2 = Division(A=Slider(20, range=0..25), B=pi_2)
division_3 = Division(A=top_box_side, B=2)
number_slider_7 = Slider(750, range=-1000..2000)
cluster = Cluster(I=debox.X)
pt = ConstructPoint(XCoordinate=expr("x*.5", expression), YCoordinate=0, ZCoordinate=number_slider_2)
vec = VectorXYZ(XComponent=side_h, YComponent=0, ZComponent=side_w)  # -> Vector, Length
pi_3 = Pi(Factor=0.5)
Z_4 = UnitZ(Factor=-1)
cluster_2 = Cluster(I=debox.Y)
cluster_3 = Cluster(I=debox.Z)
wbcatmullclark = WeaverbirdsCatmullClarkSubdivision(MeshCurves=wbsplitquads_3, Level=Slider(3, range=1..3), SmoothNakedEdges=1)
addition = Addition(A=side_h, B=extra_b_h, C=division_3)
xy = XYPlane(Origin=Z)
series = Series(Start=0, Step=pi_3, Count=4)
box_2 = DomainBox(Base=debox.Plane, X=debox.X, Y=debox.Y, Z=dedomain.End)
pt_2 = ConstructPoint(XCoordinate=cluster, YCoordinate=cluster_2, ZCoordinate=cluster_3)
mesh_4 = Mesh(wbcatmullclark)
Z_5 = UnitZ(Factor=addition)
Z_6 = UnitZ(Factor=number_slider_7)
wbcatmullclark_2 = WeaverbirdsCatmullClarkSubdivision(MeshCurves=mesh_4, Level=Slider(3, range=1..3), SmoothNakedEdges=1)
demesh = DeconstructMesh(Mesh=wbcatmullclark_2)  # -> Vertices, Faces, Colours, Normals
vec_2 = Vector(demesh.Normals)
pt_3 = Point(demesh.Vertices)
pt_4 = Point(pt_3)
gyroid = GhPythonScript(pts=pt_4, n=vec_2, period=number_slider_6)  # -> out, pts; inputs pts: list of Point3d, n: list of Vector3d
# ---------- gyroid: Python ----------
from math import sin, cos

n_pts = []
for i, pt in enumerate(pts):
    u, v, w = (pt.X/period, pt.Y/period, pt.Z/period)
    
    v = ( sin(u) * cos(v) + sin(v) * cos(w) + sin(w) * cos(u) ) * .3333 + .5
    
    n_pts.append(n[i]*v + pt)
    
pts = n_pts
# ---------- end gyroid ----------
gyroid_2 = GhPythonScript(pts=pt_3, n=vec_2, period=division, amplitude=Slider(60, range=0..100))  # -> out, pts; inputs pts: list of Point3d, n: list of Vector3d; disabled
# ---------- gyroid_2: Python ----------
from math import sin, cos

n_pts = []
for i, pt in enumerate(pts):
    u, v, w = (pt.X/period, pt.Y/period, pt.Z/period)
    
    v = ( sin(u) * cos(v) + sin(v) * cos(w) + sin(w) * cos(u) ) * .3333
    
    n_pts.append(n[i]*v*amplitude + pt)
    
pts = n_pts
# ---------- end gyroid_2 ----------
gyroid_3 = GhPythonScript(pts=pt_3, n=vec_2, period=division_2, amplitude=Slider(17.5, range=0..100))  # -> out, pts; inputs pts: list of Point3d, n: list of Vector3d
# ---------- gyroid_3: Python ----------
from math import sin, cos

n_pts = []

p_inv = 1. / period

for i, pt in enumerate(pts):
    u, v, w = (pt.X*p_inv, pt.Y*p_inv, pt.Z*p_inv)
    salt_val = ( sin(u) * cos(v) + sin(v) * cos(w) + sin(w) * cos(u) ) * .3333 
    s_val = p_inv*(1. + .01 * salt_val)
    
    u, v, w = (pt.X*s_val, pt.Y*s_val, pt.Z*s_val)
    
    v = ( sin(u) * cos(v) + sin(v) * cos(w) + sin(w) * cos(u) ) * .3333
    
    n_pts.append(n[i]*v*amplitude + pt)
    
pts = n_pts
# ---------- end gyroid_3 ----------
conmesh = ConstructMesh(Vertices=gyroid_3.pts, Faces=demesh.Faces)
msplit = MeshSplitPlane(Mesh=mesh_4, Plane=xy)  # -> Above, Below
rotate = Rotate(Geometry=pt, Angle=series, Plane=PlaneXY(0, 0, 0))  # -> Geometry, Transform
rotate_2 = Rotate(Geometry=vec.Vector, Angle=series, Plane=PlaneXY(0, 0, 0))  # -> Geometry, Transform
addition_2 = Addition(A=Z_6, B=Z_5)
clsmsh = CloseMesh(Mesh=msplit.Above, Quadrangulate=True)  # -> Closed, Amount, Openings, R
addition_3 = Addition(A=Z_2, B=Z_6)
addition_4 = Addition(A=rotate.Geometry, B=Z_6)
msplit_2 = MeshSplitPlane(Mesh=conmesh, Plane=xy)  # -> Above, Below
pt_5 = Point()  # disabled
side_length = Number(top_box_side)
pt_6 = Point(gyroid_3.pts)  # disabled
xy_2 = XYPlane(Origin=addition_2)
item = ListItem(List=msplit_2.Above, Index=0, Wrap=True)
mesh_5 = Mesh(msplit_2.Above)
plane = Plane(Origin=addition_4, Normal=rotate_2.Geometry)
plane_2 = Plane(Origin=addition_3, Normal=Z_4)
colour = ColourPicker(PickedColour=RGB(179, 180, 177))
ln = Line(StartPoint=pt_5, EndPoint=pt_6)  # disabled
clsmsh_2 = CloseMesh(Mesh=item, Quadrangulate=True)  # -> Closed, Amount, Openings, R
box_3 = Box(DimensionX=side_length, DimensionY=side_length, DimensionZ=side_length, Radius=0, Plane=xy_2)
boolean_intersect = BooleanIntersect(DistanceObjectS=plane, DistanceObject=plane_2)
number_slider_8 = Slider(4, range=0..10)
X = UnitX(Factor=1)
Y = UnitY(Factor=Slider(500, range=0..1000))
num = Number(number_slider_5)
mshclsd = IsMeshClosed(Mesh=clsmsh_2.Closed)
xz = XZPlane(Origin=Point(0, 0, 0))
neg = Negative(Value=Y)
preview = CustomPreview(Geometry=clsmsh_2.Closed, Material=colour)
xz_2 = XZPlane(Origin=Y)
division_4 = Division(A=Slider(800, range=0..1000), B=2)
bbox_xy_2 = BboxXy(C=clsmsh_2.Closed)
addition_5 = Addition(A=Slider(800, range=0..1000), B=num)
number_slider_9 = Slider(1.5, range=0..10)
sec = MeshPlane(Mesh=mint, Plane=xz)
xz_3 = XZPlane(Origin=neg)
neg_2 = Negative(Value=division_4)
rectangle = Rectangle(Plane=xz_2, XSize=Domain(-1, 1), YSize=Domain(-2, 2), Radius=0)  # -> Rectangle, Length
smoothunion = SmoothUnion(DistanceObject=boolean_intersect, DistanceObject_2=box_3, Radius=Slider(100, range=0..100))
panel_3 = Panel(bbox_xy_2)
dom = ConstructDomain(DomainStart=neg_2, DomainEnd=division_4)
dom_2 = ConstructDomain(DomainStart=num, DomainEnd=addition_5)
move = Move(Geometry=sec, Motion=neg)  # -> Geometry, Transform
swatch = ColourSwatch(SwatchColor=RGB(172, 0, 0))
pipe = Pipe(Curve=move.Geometry, Radius=number_slider_9, Caps=2)
rectangle_2 = Rectangle(Plane=xz_3, XSize=dom, YSize=dom_2, Radius=0)  # -> Rectangle, Length
swatch_2 = ColourSwatch(SwatchColor=RGB(255, 255, 255))
pipe_2 = Pipe(Curve=rectangle_2.Rectangle, Radius=number_slider_9, Caps=2)
colour_2 = ColourPicker(PickedColour=RGB(179, 180, 177))
preview_2 = CustomPreview(Geometry=pipe, Material=swatch)
number_slider_10 = Slider(20, range=0..25)
tpms = TPMS(Wavelength=number_slider_10)
preview_3 = CustomPreview(Geometry=pipe_2, Material=swatch)
pi_4 = Pi(Factor=2)
tpms_2 = TPMS(Wavelength=Slider(3937.171, range=0..5000))
division_5 = Division(A=1, B=Slider(3, range=0..10))
division_6 = Division(A=number_slider_10, B=pi_4)
mult = Mult(DistanceObject=tpms_2, Factor=division_5)
add = Add(DistanceObject=mult, Addend=Slider(1, range=0..1))
number_slider_11 = Slider(300, range=0..1000)
number_slider_12 = Slider(100, range=0..1000)
mult_2 = Mult(DistanceObject=mult, Factor=Slider(20, range=0..200))
tpms_distance_object_modifier = TPMSD(Wavelength=Slider(100, range=0..1000), Modulator=mult_2)
boolean_intersect_2 = BooleanIntersect(DistanceObjectS=tpms_distance_object_modifier, DistanceObject=smoothunion)
neg_3 = Negative(Value=number_slider_7)
Z_7 = UnitZ(Factor=number_slider_7)
pt_7 = Point(pt_2)
overlay = Overlay(DistanceObject=boolean_intersect_2, DistanceObject_2=tpms, Factor=Slider(1, range=0..1))
addition_6 = Addition(A=Z_7, B=pt_7)
isosurface_octree = IsosurfaceOctree(
    Origin=addition_6,
    WorldSize=Slider(999, range=0..1000),
    Isovalue=0,
    Subdivisions=Slider(5, range=0..10),
    DistanceObject=boolean_intersect_2)
Z_8 = UnitZ(Factor=neg_3)
isosurface_distancefunction = IsosurfaceDistancefunction(
    BoundingBox=box_2,
    NumberX=number_slider_12,
    NumberY=number_slider_12,
    NumberZ=number_slider_12,
    Isovalue=0,
    Capped=True,
    DistanceObject=boolean_intersect_2,
    Refine=True)  # disabled
isosurface_distancefunction_2 = IsosurfaceDistancefunction(
    BoundingBox=box_2,
    NumberX=number_slider_11,
    NumberY=number_slider_11,
    NumberZ=number_slider_11,
    Isovalue=0,
    Capped=True,
    DistanceObject=boolean_intersect_2,
    Refine=True)  # disabled
isosurface_octree_2 = IsosurfaceOctree(
    Origin=addition_6,
    WorldSize=Slider(999, range=0..1000),
    Isovalue=0,
    Subdivisions=Slider(8, range=0..10),
    DistanceObject=overlay)  # disabled
weld = WeldMesh(Mesh=isosurface_octree, Angle=3.141592654)
move_2 = Move(Geometry=isosurface_octree_2, Motion=Z_8)  # -> Geometry, Transform
isosurface_octree_3 = IsosurfaceOctree(Origin=Point(0, 0, 0), WorldSize=10, Isovalue=0, Subdivisions=4, DistanceObject=boolean_intersect_2)  # disabled
weld_2 = WeldMesh(Mesh=move_2.Geometry, Angle=3.141592654)  # disabled
disjoint = DisjointMesh(Mesh=weld)
mshclsd_2 = IsMeshClosed(Mesh=weld_2)
flipm_3 = FlipMesh(Mesh=weld_2, VertexNormals=True, FaceNormals=True, FaceOrientation=True)  # disabled
preview_4 = CustomPreview(
    Geometry=isosurface_distancefunction,
    Material={diffuse=RGB(221, 160, 221), emission=RGB(66, 48, 66), shine=0.5, specular=RGB(255, 255, 255), transparency=0})  # disabled
move_3 = Move(Motion=Vector(0, 0, 10))  # -> Geometry, Transform
mesh_6 = Mesh(weld)
item_2 = ListItem(List=disjoint, Index=1, Wrap=True)  # -> Item1, Item
demesh_2 = DeconstructMesh(Mesh=item_2.Item1)  # -> Vertices, Faces, Colours, Normals
vec_3 = Vector(demesh_2.Normals)
gyroid_4 = GhPythonScript(pts=demesh_2.Vertices, n=vec_3, period=division_6, amplitude=Slider(17.5, range=0..100))  # -> out, pts; inputs pts: list of Point3d, n: list of Vector3d; same code as gyroid_3
conmesh_2 = ConstructMesh(Vertices=gyroid_4.pts, Faces=demesh_2.Faces)
preview_5 = CustomPreview(Geometry=conmesh_2, Material=colour_2)
preview_6 = CustomPreview(
    Geometry=isosurface_octree,
    Material={diffuse=RGB(221, 160, 221), emission=RGB(66, 48, 66), shine=0.5, specular=RGB(255, 255, 255), transparency=0})

# ==== cluster BboxXy
C = ClusterInput()
bbox = BoundingBox(Content=C, Plane=PlaneXY(0, 0, 0))  # -> Box, Box_2
debox = DeconstructBox(Box=bbox.Box)  # -> Plane, X, Y, Z
dedomain = DeconstructDomain(Domain=debox.Y)  # -> Start, End
dedomain_2 = DeconstructDomain(Domain=debox.X)  # -> Start, End
subtraction = Subtraction(A=dedomain.End, B=dedomain.Start)
subtraction_2 = Subtraction(A=dedomain_2.End, B=dedomain_2.Start)
merge = Merge(Data1=subtraction_2, Data2=subtraction)
R = ClusterOutput(merge)

# ==== cluster Cluster
I = ClusterInput()
dedomain = DeconstructDomain(Domain=I)  # -> Start, End
addition = Addition(A=dedomain.Start, B=dedomain.End)
multiplication = Multiplication(A=addition, B=0.5)
R = ClusterOutput(multiplication)
