# Grasshopper definition shape_gen_n.gh (Grasshopper 1.0.7)
# plug-ins: Weaverbird, Pufferfish, Axolotl Info

number_slider = Slider(500, range=0..1000)
number_slider_2 = Slider(200, range=0..1000)
number_slider_3 = Slider(100, range=0..1000)
number_slider_4 = Slider(150, range=0..1000)
number_slider_5 = Slider(200, range=0..1000)
python = GhPythonScript(top_box_side=number_slider, side_w=number_slider_3, side_h=number_slider_4, extra_b_h=number_slider_2)  # -> out, pd, bx
# ---------- python: Python ----------
# import scripts externally, relative folder
import sys
import os

import Grasshopper

path=os.path.dirname(Grasshopper.Instances.ActiveCanvas.Document.FilePath)
sys.path.append(path)

import volume as vlm
reload(vlm)

pd, bx = vlm.pedistle_with_tolerance(top_box_side, side_w, side_h, extra_b_h)

print(vlm.print_mesh(pd))
print(vlm.print_mesh(bx))
# ---------- end python ----------
python_2 = GhPythonScript(
    top_box_side=Slider(500, range=0..1000),
    side_w=Slider(100, range=0..1000),
    side_h=Slider(150, range=0..1000),
    extra_b_h=number_slider_5)  # -> out, pd, bx; same code as python
flipm = FlipMesh(Mesh=python_2.pd, VertexNormals=True, FaceNormals=True, FaceOrientation=True)
flipm_2 = FlipMesh(Mesh=python_2.bx, VertexNormals=True, FaceNormals=True, FaceOrientation=True)
panel = Panel(python_2.out)
Z = UnitZ(Factor=number_slider_5)
mesh = Mesh(flipm)
mesh_2 = Mesh(flipm_2)
Z_2 = UnitZ(Factor=number_slider_2)
mint = MeshIntersection(MeshesA=mesh, MeshesB=mesh_2)
mesh_3 = Mesh(mint)
bbox_xy = BboxXy(C=mint)
wbsplitquads = WeaverbirdsConstantQuadsSplitSubdivision(MeshCurves=mesh_2, Level=Slider(3, range=1..3), SmoothNakedEdges=1)
number_slider_6 = Slider(200, range=0..500)
panel_2 = Panel(bbox_xy)
top_box_side = Number(number_slider)
pi = Pi(Factor=2)
side_w = Number(number_slider_3)
extra_b_h = Number(number_slider_2)
side_h = Number(number_slider_4)
box = Box(python.bx)
wbsplitquads_2 = WeaverbirdsConstantQuadsSplitSubdivision(MeshCurves=wbsplitquads, Level=Slider(1, range=1..3), SmoothNakedEdges=1)
debox = DeconstructBox(Box=box)  # -> Plane, X, Y, Z
pi_2 = Pi(Factor=2)
division = Division(A=number_slider_6, B=pi)
expression = Expression(x=top_box_side, y=side_w, Expression="x+y*2")
Z_3 = UnitZ(Factor=extra_b_h)
wbsplitquads_3 = WeaverbirdsConstantQuadsSplitSubdivision(MeshCurves=mesh, Level=Slider(1, range=1..3), SmoothNakedEdges=1)
dedomain = DeconstructDomain(Domain=debox.Z)  # -> Start, End
division_2 = Division(A=Slider(20, range=0..25), B=pi_2)
division_3 = Division(A=top_box_side, B=2)
number_slider_7 = Slider(0, range=-1000..2000)
cluster = Cluster(I=debox.X)
pt = ConstructPoint(XCoordinate=expr("x*.5", expression), YCoordinate=0, ZCoordinate=number_slider_2)
vec = VectorXYZ(XComponent=side_h, YComponent=0, ZComponent=side_w)  # -> Vector, Length
pi_3 = Pi(Factor=0.5)
Z_4 = UnitZ(Factor=-1)
cluster_2 = Cluster(I=debox.Y)
cluster_3 = Cluster(I=debox.Z)
wbcatmullclark = WeaverbirdsCatmullClarkSubdivision(MeshCurves=wbsplitquads_3, Level=Slider(3, range=1..3), SmoothNakedEdges=1)
addition = Addition(A=side_h, B=extra_b_h, C=division_3)
xy = XYPlane(Origin=Z)
series = Series(Start=0, Step=pi_3, Count=4)
box_2 = DomainBox(Base=debox.Plane, X=debox.X, Y=debox.Y, Z=dedomain.End)
pt_2 = ConstructPoint(XCoordinate=cluster, YCoordinate=cluster_2, ZCoordinate=cluster_3)
mesh_4 = Mesh(wbcatmullclark)
Z_5 = UnitZ(Factor=addition)
Z_6 = UnitZ(Factor=number_slider_7)
wbcatmullclark_2 = WeaverbirdsCatmullClarkSubdivision(MeshCurves=mesh_4, Level=Slider(3, range=1..3), SmoothNakedEdges=1)
demesh = DeconstructMesh(Mesh=wbcatmullclark_2)  # -> Vertices, Faces, Colours, Normals
vec_2 = Vector(demesh.Normals)
pt_3 = Point(demesh.Vertices)
pt_4 = Point(pt_3)
gyroid = GhPythonScript(pts=pt_4, n=vec_2, period=number_slider_6)  # -> out, pts; inputs pts: list of Point3d, n: list of Vector3d
# ---------- gyroid: Python ----------
from math import sin, cos

n_pts = []
for i, pt in enumerate(pts):
    u, v, w = (pt.X/period, pt.Y/period, pt.Z/period)
    
    v = ( sin(u) * cos(v) + sin(v) * cos(w) + sin(w) * cos(u) ) * .3333 + .5
    
    n_pts.append(n[i]*v + pt)
    
pts = n_pts
# ---------- end gyroid ----------
gyroid_2 = GhPythonScript(pts=pt_3, n=vec_2, period=division, amplitude=Slider(60, range=0..100))  # -> out, pts; inputs pts: list of Point3d, n: list of Vector3d; disabled
# ---------- gyroid_2: Python ----------
from math import sin, cos

n_pts = []
for i, pt in enumerate(pts):
    u, v, w = (pt.X/period, pt.Y/period, pt.Z/period)
    
    v = ( sin(u) * cos(v) + sin(v) * cos(w) + sin(w) * cos(u) ) * .3333
    
    n_pts.append(n[i]*v*amplitude + pt)
    
pts = n_pts
# ---------- end gyroid_2 ----------
gyroid_3 = GhPythonScript(pts=pt_3, n=vec_2, period=division_2, amplitude=Slider(17.5, range=0..100))  # -> out, pts; inputs pts: list of Point3d, n: list of Vector3d
# ---------- gyroid_3: Python ----------
from math import sin, cos

n_pts = []

p_inv = 1. / period

for i, pt in enumerate(pts):
    u, v, w = (pt.X*p_inv, pt.Y*p_inv, pt.Z*p_inv)
    salt_val = ( sin(u) * cos(v) + sin(v) * cos(w) + sin(w) * cos(u) ) * .3333 
    s_val = p_inv*(1. + .01 * salt_val)
    
    u, v, w = (pt.X*s_val, pt.Y*s_val, pt.Z*s_val)
    
    v = ( sin(u) * cos(v) + sin(v) * cos(w) + sin(w) * cos(u) ) * .3333
    
    n_pts.append(n[i]*v*amplitude + pt)
    
pts = n_pts
# ---------- end gyroid_3 ----------
conmesh = ConstructMesh(Vertices=gyroid_3.pts, Faces=demesh.Faces)
msplit = MeshSplitPlane(Mesh=mesh_4, Plane=xy)  # -> Above, Below
rotate = Rotate(Geometry=pt, Angle=series, Plane=PlaneXY(0, 0, 0))  # -> Geometry, Transform
rotate_2 = Rotate(Geometry=vec.Vector, Angle=series, Plane=PlaneXY(0, 0, 0))  # -> Geometry, Transform
addition_2 = Addition(A=Z_6, B=Z_5)
clsmsh = CloseMesh(Mesh=msplit.Above, Quadrangulate=True)  # -> Closed, Amount, Openings, R
addition_3 = Addition(A=Z_2, B=Z_6)
addition_4 = Addition(A=rotate.Geometry, B=Z_6)
msplit_2 = MeshSplitPlane(Mesh=conmesh, Plane=xy)  # -> Above, Below
pt_5 = Point()  # disabled
side_length = Number(top_box_side)
pt_6 = Point(gyroid_3.pts)  # disabled
xy_2 = XYPlane(Origin=addition_2)
item = ListItem(List=msplit_2.Above, Index=0, Wrap=True)
mesh_5 = Mesh(msplit_2.Above)
plane = Plane(Origin=addition_4, Normal=rotate_2.Geometry)
plane_2 = Plane(Origin=addition_3, Normal=Z_4)
colour = ColourPicker(PickedColour=RGB(179, 180, 177))
ln = Line(StartPoint=pt_5, EndPoint=pt_6)  # disabled
clsmsh_2 = CloseMesh(Mesh=item, Quadrangulate=True)  # -> Closed, Amount, Openings, R
box_3 = Box(DimensionX=side_length, DimensionY=side_length, DimensionZ=side_length, Radius=0, Plane=xy_2)
boolean_intersect = BooleanIntersect(DistanceObjectS=plane, DistanceObject=plane_2)
number_slider_8 = Slider(4, range=0..10)
X = UnitX(Factor=1)
Y = UnitY(Factor=Slider(500, range=0..1000))
num = Number(number_slider_5)
mshclsd = IsMeshClosed(Mesh=clsmsh_2.Closed)
xz = XZPlane(Origin=Point(0, 0, 0))
neg = Negative(Value=Y)
preview = CustomPreview(Geometry=clsmsh_2.Closed, Material=colour)
xz_2 = XZPlane(Origin=Y)
division_4 = Division(A=Slider(800, range=0..1000), B=2)
bbox_xy_2 = BboxXy(C=clsmsh_2.Closed)
addition_5 = Addition(A=Slider(800, range=0..1000), B=num)
number_slider_9 = Slider(1.5, range=0..10)
sec = MeshPlane(Mesh=mint, Plane=xz)
xz_3 = XZPlane(Origin=neg)
neg_2 = Negative(Value=division_4)
rectangle = Rectangle(Plane=xz_2, XSize=Domain(-1, 1), YSize=Domain(-2, 2), Radius=0)  # -> Rectangle, Length
smoothunion = SmoothUnion(DistanceObject=boolean_intersect, DistanceObject_2=box_3, Radius=Slider(100, range=0..100))
panel_3 = Panel(bbox_xy_2)
dom = ConstructDomain(DomainStart=neg_2, DomainEnd=division_4)
dom_2 = ConstructDomain(DomainStart=num, DomainEnd=addition_5)
move = Move(Geometry=sec, Motion=neg)  # -> Geometry, Transform
swatch = ColourSwatch(SwatchColor=RGB(172, 0, 0))
pipe = Pipe(Curve=move.Geometry, Radius=number_slider_9, Caps=2)
rectangle_2 = Rectangle(Plane=xz_3, XSize=dom, YSize=dom_2, Radius=0)  # -> Rectangle, Length
colour_2 = ColourPicker(PickedColour=RGB(179, 180, 177))
swatch_2 = ColourSwatch(SwatchColor=RGB(255, 255, 255))
pipe_2 = Pipe(Curve=rectangle_2.Rectangle, Radius=number_slider_9, Caps=2)
addition_6 = Addition(A=number_slider_4, B=number_slider_7)
preview_2 = CustomPreview(Geometry=pipe, Material=swatch)
number_slider_10 = Slider(20, range=0..25)
tpms = TPMS(Wavelength=number_slider_10)
preview_3 = CustomPreview(Geometry=pipe_2, Material=swatch)
number_slider_11 = Slider(0, range=0..1)
number_slider_12 = Slider(1, range=0..1)
tpms_2 = TPMS(Wavelength=Slider(10, range=0..25))
addition_7 = Addition(A=addition_6, B=Slider(50, range=0..100))
pi_4 = Pi(Factor=2)
number_slider_13 = Slider(39, range=0..100)
number_slider_14 = Slider(0, range=0..1)
tpms_3 = TPMS(Wavelength=Slider(524.842, range=0..5000))
number_slider_15 = Slider(0, range=0..1)
division_5 = Division(A=1, B=Slider(3, range=0..10))
division_6 = Division(A=number_slider_10, B=pi_4)
mult = Mult(DistanceObject=tpms_2, Factor=Slider(7.5, range=0..100))
neg_3 = Negative(Value=number_slider_12)
neg_4 = Negative(Value=number_slider_13)
neg_5 = Negative(Value=Slider(1, range=0..1))
mult_2 = Mult(DistanceObject=tpms_3, Factor=division_5)
vec_3 = VectorXYZ(XComponent=number_slider_11, YComponent=number_slider_11, ZComponent=number_slider_12)  # -> Vector, Length
add = Add(DistanceObject=mult_2, Addend=Slider(1, range=0..1))
vec_4 = VectorXYZ(XComponent=number_slider_14, YComponent=number_slider_14, ZComponent=neg_5)  # -> Vector, Length
number_slider_16 = Slider(300, range=0..1000)
X_2 = UnitX(Factor=neg_4)
number_slider_17 = Slider(100, range=0..1000)
Z_7 = UnitZ(Factor=addition_7)
X_3 = UnitX(Factor=number_slider_13)
number_slider_18 = Slider(0, range=0..1)
vec_5 = VectorXYZ(XComponent=Slider(1, range=0..1), YComponent=Slider(0, range=0..1), ZComponent=0)  # -> Vector, Length
vec_6 = VectorXYZ(XComponent=number_slider_15, YComponent=number_slider_15, ZComponent=Slider(1, range=0..1))  # -> Vector, Length
number_slider_19 = Slider(148.821, range=0..250)
_10º = PowerOf10(Value=Slider(-2.503, range=-8..8))
mult_3 = Mult(DistanceObject=mult_2, Factor=Slider(15, range=0..200))
plane_3 = Plane(Origin=X_3, Normal=vec_4.Vector)
plane_4 = Plane(Origin=X_2, Normal=vec_4.Vector)
plane_5 = Plane(Origin=Z_7, Normal=vec_3.Vector)
plane_6 = Plane(Origin=Point(0, 0, 0), Normal=vec_5.Vector)
_10º_2 = PowerOf10(Value=Slider(-4.609, range=-8..8))
plane_7 = Plane(Origin=Point(0, 0, 0), Normal=vec_6.Vector)
tpms_distance_object_modifier = TPMSD(Wavelength=Slider(100, range=0..1000), Modulator=mult_3)
panel_4 = Panel(_10º)
mult_4 = Mult(DistanceObject=plane_6, Factor=Slider(0.1, range=0..1))
overlay = Overlay(DistanceObject=plane_3, DistanceObject_2=plane_4, Factor=Slider(0, range=0..1))
smoothintersection = SmoothIntersection(DistanceObject=tpms_distance_object_modifier, DistanceObject_2=plane_5, Radius=number_slider_19)
smoothunion_2 = SmoothUnion(DistanceObject=tpms_distance_object_modifier, DistanceObject_2=plane_5, Radius=number_slider_19)
boolean_subtract = BooleanSubtract(DistanceObject=tpms_distance_object_modifier, DistanceObject_2=plane_5)
boolean_union = BooleanUnion(DistanceObjectS=tpms_distance_object_modifier, DistanceObject=plane_5)
neg_6 = Negative(Value=number_slider_7)
Z_8 = UnitZ(Factor=number_slider_7)
pt_7 = Point(pt_2)
boolean_intersect_2 = BooleanIntersect(DistanceObjectS=tpms_distance_object_modifier, DistanceObject=plane_5)
number_slider_20 = Slider(-228.16, range=-500..500)
addition_8 = Addition(A=Z_8, B=pt_7)
boolean_intersect_3 = BooleanIntersect(DistanceObjectS=smoothunion_2, DistanceObject=smoothunion)
overlay_2 = Overlay(DistanceObject=boolean_intersect_3, DistanceObject_2=plane_6, Factor=_10º)
overlay_3 = Overlay(DistanceObject=boolean_intersect_3, DistanceObject_2=tpms, Factor=Slider(1, range=0..1))
swatch_3 = ColourSwatch(SwatchColor=RGB(188, 57, 71))
Z_9 = UnitZ(Factor=neg_6)
overlay_4 = Overlay(DistanceObject=overlay_2, DistanceObject_2=plane_7, Factor=_10º_2)
isosurface_distancefunction = IsosurfaceDistancefunction(
    BoundingBox=box_2,
    NumberX=number_slider_17,
    NumberY=number_slider_17,
    NumberZ=number_slider_17,
    Isovalue=0,
    Capped=True,
    DistanceObject=boolean_intersect_3,
    Refine=True)  # disabled
isosurface_distancefunction_2 = IsosurfaceDistancefunction(
    BoundingBox=box_2,
    NumberX=number_slider_16,
    NumberY=number_slider_16,
    NumberZ=number_slider_16,
    Isovalue=0,
    Capped=True,
    DistanceObject=boolean_intersect_3,
    Refine=True)  # disabled
isosurface_octree = IsosurfaceOctree(
    Origin=addition_8,
    WorldSize=Slider(999, range=0..1000),
    Isovalue=0,
    Subdivisions=Slider(8, range=0..10),
    DistanceObject=overlay_3)  # disabled
move_2 = Move(Geometry=isosurface_octree, Motion=Z_9)  # -> Geometry, Transform
isosurface_octree_2 = IsosurfaceOctree(Origin=Point(0, 0, 0), WorldSize=10, Isovalue=0, Subdivisions=4, DistanceObject=boolean_intersect_3)  # disabled
isosurface_octree_3 = IsosurfaceOctree(
    Origin=addition_8,
    WorldSize=Slider(999, range=0..1000),
    Isovalue=0,
    Subdivisions=Slider(6, range=0..10),
    DistanceObject=overlay_4)
weld = WeldMesh(Mesh=isosurface_octree_3, Angle=3.141592654)
weld_2 = WeldMesh(Mesh=move_2.Geometry, Angle=3.141592654)  # disabled
slice2d = Slice2D(DistanceObject=overlay, NumberU=50, NumberV=50, DimensionX=10, DimensionY=10, Plane=PlaneXY(0, 0, 0))  # -> Values, Mesh, Contours
addition_9 = Addition(A=number_slider_7, B=Slider(500, range=0..1000))
Y_2 = UnitY(Factor=number_slider_20)
X_4 = UnitX(Factor=number_slider_20)
preview_4 = CustomPreview(Geometry=isosurface_octree_3, Material=swatch_3)
disjoint = DisjointMesh(Mesh=weld)
mshclsd_2 = IsMeshClosed(Mesh=weld_2)
flipm_3 = FlipMesh(Mesh=weld_2, VertexNormals=True, FaceNormals=True, FaceOrientation=True)  # disabled
preview_5 = CustomPreview(
    Geometry=isosurface_distancefunction,
    Material={diffuse=RGB(221, 160, 221), emission=RGB(66, 48, 66), shine=0.5, specular=RGB(255, 255, 255), transparency=0})  # disabled
Z_10 = UnitZ(Factor=addition_9)
move_3 = Move(Motion=Vector(0, 0, 10))  # -> Geometry, Transform
number_slider_21 = Slider(1000, range=0..1000)
mesh_6 = Mesh(weld)
number_slider_22 = Slider(250, range=0..1000)
wbcatmullclark_3 = WeaverbirdsCatmullClarkSubdivision(MeshCurves=isosurface_octree_3, Level=Slider(2, range=0..10), SmoothNakedEdges=1)
demesh_2 = DeconstructMesh(Mesh=wbcatmullclark_3)  # -> Vertices, Faces, Colours, Normals
vec_7 = Vector(demesh_2.Normals)
gyroid_4 = GhPythonScript(pts=demesh_2.Vertices, n=vec_7, period=division_6, amplitude=Slider(17.5, range=0..100))  # -> out, pts; inputs pts: list of Point3d, n: list of Vector3d; same code as gyroid_3
cluster_4 = Cluster_2(D=mult, M=wbcatmullclark_3)
mesh_7 = Mesh(cluster_4)
evaluatepoints = EvaluatePoints(DistanceObject=mult, Points=demesh_2.Vertices)
multiplication = Multiplication(A=evaluatepoints, B=vec_7)
addition_10 = Addition(A=demesh_2.Vertices, B=multiplication)
addition_11 = Addition(A=Z_10, B=X_4)
item_2 = ListItem(List=disjoint, Index=1, Wrap=True)  # -> Item1, Item
yz = YZPlane(Origin=addition_11)
conmesh_2 = ConstructMesh(Vertices=addition_10, Faces=demesh_2.Faces)
isosurface_distancefield = IsosurfaceDistancefield(NumberX=50, NumberY=50, NumberZ=50, Isovalue=0)
preview_6 = CustomPreview(
    Geometry=conmesh_2,
    Material={diffuse=RGB(221, 160, 221), emission=RGB(66, 48, 66), shine=0.5, specular=RGB(255, 255, 255), transparency=0})
slice2d_2 = Slice2D(
    DistanceObject=overlay_4,
    NumberU=number_slider_22,
    NumberV=number_slider_22,
    DimensionX=number_slider_21,
    DimensionY=number_slider_21,
    Plane=yz)  # -> Values, Mesh, Contours
contour2dvalues = Contour2DValues(DistanceValues=overlay_4, NumberU=50, NumberV=50, DimensionX=number_slider_21, DimensionY=number_slider_21, Plane=yz)
preview_7 = CustomPreview(Geometry=isosurface_octree_3, Material=swatch_3)
isosurface_distancefunction_3 = IsosurfaceDistancefunction(NumberX=50, NumberY=50, NumberZ=50, Isovalue=0, Capped=False, DistanceObject=overlay_4, Refine=True)

# ==== cluster BboxXy
C = ClusterInput()
bbox = BoundingBox(Content=C, Plane=PlaneXY(0, 0, 0))  # -> Box, Box_2
debox = DeconstructBox(Box=bbox.Box)  # -> Plane, X, Y, Z
dedomain = DeconstructDomain(Domain=debox.Y)  # -> Start, End
dedomain_2 = DeconstructDomain(Domain=debox.X)  # -> Start, End
subtraction = Subtraction(A=dedomain.End, B=dedomain.Start)
subtraction_2 = Subtraction(A=dedomain_2.End, B=dedomain_2.Start)
merge = Merge(Data1=subtraction_2, Data2=subtraction)
R = ClusterOutput(merge)

# ==== cluster Cluster
I = ClusterInput()
dedomain = DeconstructDomain(Domain=I)  # -> Start, End
addition = Addition(A=dedomain.Start, B=dedomain.End)
multiplication = Multiplication(A=addition, B=0.5)
R = ClusterOutput(multiplication)

# ==== cluster Cluster_2
M = ClusterInput()
demesh = DeconstructMesh(Mesh=M)  # -> Vertices, Faces, Colours, Normals
vec = Vector(demesh.Normals)
D = ClusterInput()
evaluatepoints = EvaluatePoints(DistanceObject=D, Points=demesh.Vertices)
multiplication = Multiplication(A=evaluatepoints, B=vec)
addition = Addition(A=demesh.Vertices, B=multiplication)
conmesh = ConstructMesh(Vertices=addition, Faces=demesh.Faces)
M_2 = ClusterOutput(conmesh)
