# Grasshopper definition interlock_details_2.gh (Grasshopper 1.0.7)

number_slider = Slider(25, range=0..100)
number_slider_2 = Slider(35, range=0..100)
number_slider_3 = Slider(15, range=0..100)
number_slider_4 = Slider(11, range=0..100)
mesh = Mesh(<mesh referenced from the Rhino model>)
bounding_box = BoundingBox(Content=mesh, Plane=PlaneXY(0, 0, 0))  # -> Box, Box_2
ghpython_script = GhPythonScript(r0=number_slider_4, h1=number_slider_2, r1=number_slider_3, w=number_slider)  # -> out, pts
# ---------- ghpython_script: Python ----------
from Rhino.Geometry import Point3d

delta=((r0+r1)**2.-(h1-r0)**2.)**.5
    
pts=[
    Point3d(-w*.5-delta, r0,0),
    Point3d(-w*.5, h1,0),
]

pts_2=[Point3d(-pt.X, pt.Y, 0) for pt in pts[::-1]]

pts+=pts_2
# ---------- end ghpython_script ----------
ghpython_script_2 = GhPythonScript(r0=number_slider_4, h1=number_slider_2, r1=number_slider_3, w=number_slider)  # -> out, pts, pts_a
# ---------- ghpython_script_2: Python ----------
from Rhino.Geometry import Point3d, Vector3d, Arc

delta=((r0+r1)**2.-(h1-r0)**2.)**.5
    
pts=[
    Point3d(-w*.5-delta, r0,0),
    Point3d(-w*.5, h1,0),
]

pt_b=Point3d(-w*.5-delta, 0.,0.)
dir_v=Vector3d(pts[1]-pts[0])
pt_c=Point3d(-w*.5, h1+r1,0.),
v_2=Vector3d((Vector3d(pt_b-pts[0])+dir_v)*.5)
v_3=Vector3d((Vector3d(0, r1, 0)-dir_v)*.5)
dir_v.Unitize()
v_2.Unitize()
v_3.Unitize()

pts_a=[
    Point3d(pt_b),
    Point3d(pts[0]+v_2*r0),
    Point3d(pts[0]+dir_v*r0),
    Point3d(pts[1]+v_3*r1),
    Point3d(-w*.5, h1+r1,0.)
]
# ---------- end ghpython_script_2 ----------
ghpython_script_3 = GhPythonScript(
    h0=Slider(15, range=0..100),
    h1=Slider(20, range=0..100),
    h2=Slider(10, range=0..100),
    w0=Slider(15, range=0..100),
    w1=Slider(28, range=0..100))  # -> out, pts
# ---------- ghpython_script_3: Python ----------
from Rhino.Geometry import Point3d

hs=[h0, h0+h1, h0+h1+h2]
pts=[
    Point3d(w0, 0,0),
    Point3d(w0, h0,0),
    Point3d(w1, h0+h1,0),
    Point3d(w1, h0+h1+h2,0)
]

pts_2=[Point3d(-pt.X, pt.Y, 0) for pt in pts[::-1]]

pts+=pts_2
# ---------- end ghpython_script_3 ----------
line = Line([Line((120, -158.0615218, 120), (0, -158.0615218, 120)), Line((120, 60, 120), (0, 60, 120))])
list_item = ListItem(List=ghpython_script_2.pts_a, Index=0, Wrap=True)  # -> Item, Item1, Item2, Item3, Item4
volume = Volume(Geometry=mesh)  # -> Volume, Centroid
volume_2 = Volume(Geometry=bounding_box.Box)  # -> Volume, Centroid
point = Point(ghpython_script_2.pts_a)
polyline = PolyLine(Vertices=ghpython_script_3.pts, Closed=False)
merge = Merge(Data1=number_slider_4, Data2=number_slider_3, Data3=number_slider_3, Data4=number_slider_4)
panel = Panel(ghpython_script_2.out)
arc_3pt = Arc3Pt(PointA=list_item.Item2, PointB=list_item.Item3, PointC=list_item.Item4)  # -> Arc, Plane, Radius
arc_3pt_2 = Arc3Pt(PointA=list_item.Item, PointB=list_item.Item1, PointC=list_item.Item2)  # -> Arc, Plane, Radius
number_slider_5 = Slider(2.5, range=0..10)
circle_cnr = CircleCNR(Center=ghpython_script.pts, Normal=Vector(0, 0, 1), Radius=merge)
panel_2 = Panel(volume.Volume)
division = Division(A=volume_2.Volume, B=volume.Volume)
flip_curve = FlipCurve(Curve=polyline)  # -> Curve, Flag
merge_2 = Merge(Data1=arc_3pt_2.Arc, Data2=arc_3pt.Arc)
number_slider_6 = Slider(60, range=0..100)
negative = Negative(Value=number_slider_5)
unit_y = UnitY(Factor=number_slider_6)
xy_plane = XYPlane(Origin=Point(0, 0, 0))
panel_3 = Panel(division)
join_curves = JoinCurves(Curves=merge_2, Preserve=False)
rotate = Rotate(Geometry=xy_plane, Angle=3.141592654, Plane=PlaneXY(0, 0, 0))  # -> Geometry, Transform
offset_curve = OffsetCurve(Curve=flip_curve.Curve, Distance=number_slider_5, Plane=PlaneXY(0, 0, 0), Corners=1)
negative_2 = Negative(Value=number_slider_6)
offset_curve_2 = OffsetCurve(Curve=flip_curve.Curve, Distance=negative, Plane=PlaneXY(0, 0, 0), Corners=1)
mirror = Mirror(Geometry=join_curves, Plane=PlaneYZ(0, 0, 0))  # -> Geometry, Transform
multiplication = Multiplication(A=number_slider_6, B=2)
end_points = EndPoints(Curve=mirror.Geometry)  # -> Start, End
end_points_2 = EndPoints(Curve=join_curves)  # -> Start, End
merge_3 = Merge(Data1=negative_2, Data2=number_slider_6)
move = Move(Geometry=rotate.Geometry, Motion=unit_y)  # -> Geometry, Transform
line_2 = Line(StartPoint=end_points_2.End, EndPoint=end_points.End)
construct_point = ConstructPoint(XCoordinate=graft(merge_3), YCoordinate=merge_3, ZCoordinate=0)  # -> flatten(Point)
merge_4 = Merge(Data1=join_curves, Data2=mirror.Geometry, Data3=line_2)
rotate_2 = Rotate(Geometry=move.Geometry, Angle=3.141592654, Plane=PlaneXY(0, 0, 0))  # -> Geometry, Transform
list_item_2 = ListItem(List=construct_point, Index=0, Wrap=True)  # -> Item, Item1, Item2, Item3
join_curves_2 = JoinCurves(Curves=merge_4, Preserve=False)
offset_curve_3 = OffsetCurve(Curve=join_curves_2, Distance=number_slider_5, Plane=PlaneXY(0, 0, 0), Corners=1)
offset_curve_4 = OffsetCurve(Curve=join_curves_2, Distance=negative, Plane=PlaneXY(0, 0, 0), Corners=1)
cluster = Cluster_2(A=number_slider_5, curve_2=offset_curve_2, curve=offset_curve_4, number=number_slider_6)  # -> curve_5, x, result
cluster_2 = Cluster(curve=offset_curve, curve_2=offset_curve_3, number=number_slider_6)  # -> x, x_2, result
ghpython_script_4 = GhPythonScript(x=offset_curve_2, y=move.Geometry)  # -> p2p, x; inputs x: GeometryBase, y: Plane; same code as ghpython_script
line_3 = Line(StartPoint=list_item_2.Item, EndPoint=list_item_2.Item1)
line_4 = Line(StartPoint=list_item_2.Item2, EndPoint=list_item_2.Item3)
ghpython_script_5 = GhPythonScript(x=offset_curve_4, y=rotate_2.Geometry)  # -> p2p, x; inputs x: GeometryBase, y: Plane; same code as ghpython_script
end_points_3 = EndPoints(Curve=cluster.curve_5)  # -> Start, End
end_points_4 = EndPoints(Curve=cluster.x)  # -> Start, End
line_5 = Line(StartPoint=end_points_4.Start, EndPoint=list_item_2.Item)
line_6 = Line(StartPoint=end_points_4.End, EndPoint=list_item_2.Item2)
line_7 = Line(StartPoint=end_points_3.End, EndPoint=list_item_2.Item1)
line_8 = Line(StartPoint=end_points_3.Start, EndPoint=list_item_2.Item3)
merge_5 = Merge(
    Data1=cluster.curve_5,
    Data2=cluster.x,
    Data3=line_3,
    Data4=line_4,
    Data5=line_8,
    Data6=line_7,
    Data7=line_5,
    Data8=line_6)  # -> flatten(Result)
unit_z = UnitZ(Factor=multiplication)
join_curves_3 = JoinCurves(Curves=merge_5, Preserve=False)
merge_6 = Merge(Data1=negative_2, Data2=number_slider_6)
extrude = Extrude(Base=join_curves_3, Direction=unit_z)
construct_point_2 = ConstructPoint(XCoordinate=merge_6, YCoordinate=graft(cluster_2.result), ZCoordinate=0)  # -> flatten(Point)
addition = Addition(A=multiplication, B=Slider(15, range=0..100))
curve = Curve(cluster_2.x)
curve_2 = Curve(cluster_2.x_2)
cap_holes = CapHoles(Brep=extrude)
multiplication_2 = Multiplication(A=addition, B=2)
list_item_3 = ListItem(List=construct_point_2, Index=0, Wrap=True)  # -> Item, Item1, Item2, Item3
unit_x = UnitX(Factor=addition)
unit_x_2 = UnitX(Factor=multiplication_2)
line_9 = Line(StartPoint=list_item_3.Item, EndPoint=list_item_3.Item2)
line_10 = Line(StartPoint=list_item_3.Item1, EndPoint=list_item_3.Item3)
move_2 = Move(Geometry=cap_holes, Motion=unit_x)  # -> Geometry, Transform
end_points_5 = EndPoints(Curve=curve_2)  # -> Start, End
end_points_6 = EndPoints(Curve=curve)  # -> Start, End
line_11 = Line(StartPoint=end_points_5.End, EndPoint=list_item_3.Item2)
line_12 = Line(StartPoint=end_points_5.Start, EndPoint=list_item_3.Item3)
line_13 = Line(StartPoint=end_points_6.Start, EndPoint=list_item_3.Item)
line_14 = Line(StartPoint=end_points_6.End, EndPoint=list_item_3.Item1)
merge_7 = Merge(Data1=curve, Data2=curve_2, Data3=line_9, Data4=line_10, Data5=line_13, Data6=line_14, Data7=line_12, Data8=line_11)  # -> flatten(Result)
unit_z_2 = UnitZ(Factor=multiplication)
join_curves_4 = JoinCurves(Curves=merge_7, Preserve=False)
extrude_2 = Extrude(Base=join_curves_4, Direction=unit_z_2)
cap_holes_2 = CapHoles(Brep=extrude_2)
move_3 = Move(Geometry=cap_holes_2, Motion=unit_x_2)  # -> Geometry, Transform
merge_8 = Merge(Data1=move_3.Geometry, Data2=move_2.Geometry)

# ==== cluster Cluster
curve = ClusterInput()
curve_2 = ClusterInput()
number = ClusterInput()
curve_3 = Curve(curve_2)
curve_4 = Curve(curve)
number_2 = Number(number)
bounding_box = BoundingBox(Content=curve_3, Plane=PlaneXY(0, 0, 0))  # -> Box, Box_2
bounding_box_2 = BoundingBox(Content=curve_4, Plane=PlaneXY(0, 0, 0))  # -> Box, Box_2
deconstruct_box = DeconstructBox(Box=bounding_box_2.Box)  # -> Plane, X, Y, Z
deconstruct_box_2 = DeconstructBox(Box=bounding_box.Box)  # -> Plane, X, Y, Z
deconstruct_domain = DeconstructDomain(Domain=deconstruct_box.Y)  # -> Start, End
deconstruct_domain_2 = DeconstructDomain(Domain=deconstruct_box_2.Y)  # -> Start, End
subtraction = Subtraction(A=deconstruct_domain_2.End, B=deconstruct_domain_2.Start)
subtraction_2 = Subtraction(A=deconstruct_domain.End, B=deconstruct_domain.Start)
subtraction_3 = Subtraction(A=number_2, B=subtraction)
subtraction_4 = Subtraction(A=number_2, B=subtraction_2)
subtraction_5 = Subtraction(A=number_2, B=deconstruct_domain.End)
subtraction_6 = Subtraction(A=number_2, B=deconstruct_domain_2.End)
negative = Negative(Value=subtraction_3)
unit_y = UnitY(Factor=subtraction_6)
unit_y_2 = UnitY(Factor=subtraction_5)
merge = Merge(Data1=subtraction_4, Data2=negative)
result = ClusterOutput(merge)
xy_plane = XYPlane(Origin=unit_y)
xy_plane_2 = XYPlane(Origin=unit_y_2)
rotate = Rotate(Geometry=xy_plane, Angle=3.141592654, Plane=PlaneXY(0, 0, 0))  # -> Geometry, Transform
ghpython_script = GhPythonScript(x=curve_4, y=xy_plane_2)  # -> p2p, x; inputs x: GeometryBase, y: Plane
# ---------- ghpython_script: Python ----------
from Rhino.Geometry.Transform import PlaneToPlane
from Rhino.Geometry.Plane import WorldXY

t_m=PlaneToPlane(WorldXY, y)
x.Transform(t_m)
# ---------- end ghpython_script ----------
x = ClusterOutput(ghpython_script.x)
ghpython_script_2 = GhPythonScript(x=curve_3, y=rotate.Geometry)  # -> p2p, x; inputs x: GeometryBase, y: Plane; same code as ghpython_script
x_2 = ClusterOutput(ghpython_script_2.x)

# ==== cluster Cluster_2
A = ClusterInput()
curve = ClusterInput()
curve_2 = ClusterInput()
number = ClusterInput()
curve_3 = Curve(curve)
curve_4 = Curve(curve_2)
multiplication = Multiplication(A=A, B=2)
number_2 = Number(number)
bounding_box = BoundingBox(Content=curve_3, Plane=PlaneXY(0, 0, 0))  # -> Box, Box_2
bounding_box_2 = BoundingBox(Content=curve_4, Plane=PlaneXY(0, 0, 0))  # -> Box, Box_2
flatoffset = Number(multiplication)
deconstruct_box = DeconstructBox(Box=bounding_box_2.Box)  # -> Plane, X, Y, Z
deconstruct_box_2 = DeconstructBox(Box=bounding_box.Box)  # -> Plane, X, Y, Z
deconstruct_domain = DeconstructDomain(Domain=deconstruct_box.Y)  # -> Start, End
deconstruct_domain_2 = DeconstructDomain(Domain=deconstruct_box_2.Y)  # -> Start, End
subtraction = Subtraction(A=deconstruct_domain_2.End, B=deconstruct_domain_2.Start)
subtraction_2 = Subtraction(A=deconstruct_domain.End, B=deconstruct_domain.Start)
subtraction_3 = Subtraction(A=number_2, B=subtraction_2)
subtraction_4 = Subtraction(A=number_2, B=subtraction)
negative = Negative(Value=subtraction_4)
addition = Addition(A=deconstruct_domain.Start, B=number_2)
addition_2 = Addition(A=deconstruct_domain_2.Start, B=number_2)
addition_3 = Addition(A=addition, B=flatoffset)
merge = Merge(Data1=subtraction_3, Data2=negative)
negative_2 = Negative(Value=addition_2)
negative_3 = Negative(Value=addition_3)
result = ClusterOutput(merge)
unit_y = UnitY(Factor=negative_2)
unit_y_2 = UnitY(Factor=negative_3)
xy_plane = XYPlane(Origin=unit_y)
xy_plane_2 = XYPlane(Origin=unit_y_2)
negative_4 = Negative(Value=flatoffset)
rotate = Rotate(Geometry=xy_plane_2, Angle=3.141592654, Plane=PlaneXY(0, 0, 0))  # -> Geometry, Transform
ghpython_script = GhPythonScript(x=curve_3, y=xy_plane)  # -> p2p, x; inputs x: GeometryBase, y: Plane; same code as ghpython_script
x = ClusterOutput(ghpython_script.x)
ghpython_script_2 = GhPythonScript(x=curve_4, y=rotate.Geometry)  # -> p2p, x; inputs x: GeometryBase, y: Plane; same code as ghpython_script
flatoffset_2 = Number(negative_4)
extend_curve = ExtendCurve(Curve=ghpython_script_2.x, Type=0, Start=flatoffset_2, End=flatoffset_2)
curve_5 = ClusterOutput(extend_curve)
