# Grasshopper definition interlock_details_4.gh (Grasshopper 1.0.7)
# plug-ins: VoxelTools, Axolotl Info

number_slider = Slider(65, range=0..100)
number_slider_2 = Slider(2, range=0..10)
number_slider_3 = Slider(20, range=0..100)
number_slider_4 = Slider(35, range=0..100)
number_slider_5 = Slider(15, range=0..100)
number_slider_6 = Slider(12.5, range=0..100)
mesh = Mesh(<mesh referenced from the Rhino model>)
negative = Negative(Value=number_slider)
brep = Brep([<brep referenced from the Rhino model> x2])
brep_2 = Brep([<brep referenced from the Rhino model> x2])
bounding_box = BoundingBox(Content=mesh, Plane=PlaneXY(0, 0, 0))  # -> Box, Box_2
number_slider_7 = Slider(15, range=0..100)
construct_domain = ConstructDomain(DomainStart=negative, DomainEnd=number_slider)
number_slider_8 = Slider(10, range=0..10)
bounding_box_2 = BoundingBox(Content=brep, Plane=PlaneXY(0, 0, 0))  # -> Box, Box_2
bounding_box_3 = BoundingBox(Content=brep_2, Plane=PlaneXY(0, 0, 0))  # -> Box, Box_2
ghpython_script = GhPythonScript(r0=number_slider_6, h1=number_slider_4, r1=number_slider_5, w=number_slider_3)  # -> out, pts
# ---------- ghpython_script: Python ----------
from Rhino.Geometry import Point3d

delta=((r0+r1)**2.-(h1-r0)**2.)**.5
    
pts=[
    Point3d(-w*.5-delta, r0,0),
    Point3d(-w*.5, h1,0),
]

pts_2=[Point3d(-pt.X, pt.Y, 0) for pt in pts[::-1]]

pts+=pts_2
# ---------- end ghpython_script ----------
ghpython_script_2 = GhPythonScript(r0=number_slider_6, h1=number_slider_4, r1=number_slider_5, w=number_slider_3)  # -> out, pts, pts_a
# ---------- ghpython_script_2: Python ----------
from Rhino.Geometry import Point3d, Vector3d, Arc

delta=((r0+r1)**2.-(h1-r0)**2.)**.5
    
pts=[
    Point3d(-w*.5-delta, r0,0),
    Point3d(-w*.5, h1,0),
]

pt_b=Point3d(-w*.5-delta, 0.,0.)
dir_v=Vector3d(pts[1]-pts[0])
pt_c=Point3d(-w*.5, h1+r1,0.),
v_2=Vector3d((Vector3d(pt_b-pts[0])+dir_v)*.5)
v_3=Vector3d((Vector3d(0, r1, 0)-dir_v)*.5)
dir_v.Unitize()
v_2.Unitize()
v_3.Unitize()

pts_a=[
    Point3d(pt_b),
    Point3d(pts[0]+v_2*r0),
    Point3d(pts[0]+dir_v*r0),
    Point3d(pts[1]+v_3*r1),
    Point3d(-w*.5, h1+r1,0.)
]
# ---------- end ghpython_script_2 ----------
multiplication = Multiplication(A=2, B=number_slider_2)
ghpython_script_3 = GhPythonScript(
    h0=Slider(20, range=0..100),
    h1=Slider(20, range=0..100),
    h2=Slider(10, range=0..100),
    w0=Slider(20, range=0..100),
    w1=Slider(40, range=0..100))  # -> out, pts
# ---------- ghpython_script_3: Python ----------
from Rhino.Geometry import Point3d

hs=[h0, h0+h1, h0+h1+h2]
pts=[
    Point3d(w0, 0,0),
    Point3d(w0, h0,0),
    Point3d(w1, h0+h1,0),
    Point3d(w1, h0+h1+h2,0)
]

pts_2=[Point3d(-pt.X, pt.Y, 0) for pt in pts[::-1]]

pts+=pts_2
# ---------- end ghpython_script_3 ----------
line = Line([Line((120, -158.0615218, 120), (0, -158.0615218, 120)), Line((120, 60, 120), (0, 60, 120))])
box_2pt = Box2Pt(PointA=Point(167.0694036, 261.6520427, 0), PointB=Point(207.0694036, 381.6520427, 120), Plane=PlaneXY(0, 0, 0))
negative_2 = Negative(Value=number_slider_7)
list_item = ListItem(List=ghpython_script_2.pts_a, Index=0, Wrap=True)  # -> Item, Item1, Item2, Item3, Item4
volume = Volume(Geometry=mesh)  # -> Volume, Centroid
volume_2 = Volume(Geometry=bounding_box.Box)  # -> Volume, Centroid
tpms = TPMS(Wavelength=Slider(1.923, range=0..10))
point = Point(ghpython_script_2.pts_a)
polyline = PolyLine(Vertices=ghpython_script_3.pts, Closed=False)
lattice = Lattice(Cellsize=Slider(2, range=0..10), Thickness=1)
deconstruct_box = DeconstructBox(Box=box_2pt)  # -> Plane, X, Y, Z
domain_box = DomainBox(Base=PlaneXY(0, 0, 0), X=construct_domain, Y=construct_domain, Z=number_slider_2)
deconstruct_box_2 = DeconstructBox(Box=bounding_box_3.Box_2)  # -> Plane, X, Y, Z
deconstruct_box_3 = DeconstructBox(Box=bounding_box_2.Box_2)  # -> Plane, X, Y, Z
merge = Merge(Data1=number_slider_6, Data2=number_slider_5, Data3=number_slider_5, Data4=number_slider_6)
panel = Panel(ghpython_script_2.out)
construct_domain_2 = ConstructDomain(DomainStart=negative_2, DomainEnd=number_slider_7)
arc_3pt = Arc3Pt(PointA=list_item.Item2, PointB=list_item.Item3, PointC=list_item.Item4)  # -> Arc, Plane, Radius
arc_3pt_2 = Arc3Pt(PointA=list_item.Item, PointB=list_item.Item1, PointC=list_item.Item2)  # -> Arc, Plane, Radius
number_slider_9 = Slider(2.5, range=0..10)
circle_cnr = CircleCNR(Center=ghpython_script.pts, Normal=Vector(0, 0, 1), Radius=merge)
box = Box(DimensionX=number_slider_8, DimensionY=number_slider_8, DimensionZ=number_slider_8, Radius=0, Plane=PlaneXY(0, 0, 0))
create_voxelgrid = CreateVoxelGrid(BoundingBox=domain_box, SizeX=number_slider_2, SizeY=number_slider_2, SizeZ=number_slider_2)
deconstruct_domain = DeconstructDomain(Domain=deconstruct_box.X)  # -> Start, End
deconstruct_domain_2 = DeconstructDomain(Domain=deconstruct_box.Y)  # -> Start, End
deconstruct_domain_3 = DeconstructDomain(Domain=deconstruct_box.Z)  # -> Start, End
deconstruct_domain_4 = DeconstructDomain(Domain=deconstruct_box_2.X)  # -> Start, End
deconstruct_domain_5 = DeconstructDomain(Domain=deconstruct_box_2.Y)  # -> Start, End
deconstruct_domain_6 = DeconstructDomain(Domain=deconstruct_box_3.Y)  # -> Start, End
deconstruct_domain_7 = DeconstructDomain(Domain=deconstruct_box_3.X)  # -> Start, End
deconstruct_domain_8 = DeconstructDomain(Domain=deconstruct_box_3.Z)  # -> Start, End
deconstruct_domain_9 = DeconstructDomain(Domain=deconstruct_box_2.Z)  # -> Start, End
panel_2 = Panel(volume.Volume)
division = Division(A=volume_2.Volume, B=volume.Volume)
number_slider_10 = Slider(50, range=0..100)
boolean_intersect = BooleanIntersect(DistanceObjectS=box, DistanceObject=tpms)
flip_curve = FlipCurve(Curve=polyline)  # -> Curve, Flag
surface = Surface(<surface referenced from the Rhino model>)
number_slider_11 = Slider(50, range=0..100)
merge_2 = Merge(Data1=arc_3pt_2.Arc, Data2=arc_3pt.Arc)
tpms_d = TPMSD(Wavelength=1, Modulator=lattice)
number_slider_12 = Slider(60, range=0..100)
negative_3 = Negative(Value=number_slider_9)
unit_y = UnitY(Factor=number_slider_12)
domain_box_2 = DomainBox(Base=PlaneXY(0, 0, 0), X=construct_domain_2, Y=construct_domain_2, Z=construct_domain_2)
xy_plane = XYPlane(Origin=Point(0, 0, 0))
panel_3 = Panel(division)
deconstruct_box_4 = DeconstructBox(Box=surface)  # -> Plane, X, Y, Z
join_curves = JoinCurves(Curves=merge_2, Preserve=False)
voxelategeometry = VoxelateGeometry(Geometry=domain_box, VoxelGrid=create_voxelgrid, Distance=0)
merge_3 = Merge(
    Data1=deconstruct_domain_5.Start,
    Data2=deconstruct_domain_5.End,
    Data3=deconstruct_domain_6.Start,
    Data4=deconstruct_domain_6.End)
merge_4 = Merge(
    Data1=deconstruct_domain_4.Start,
    Data2=deconstruct_domain_4.End,
    Data3=deconstruct_domain_7.Start,
    Data4=deconstruct_domain_7.End)
merge_5 = Merge(
    Data1=deconstruct_domain_9.Start,
    Data2=deconstruct_domain_9.End,
    Data3=deconstruct_domain_8.Start,
    Data4=deconstruct_domain_8.End)
construct_point = ConstructPoint(XCoordinate=deconstruct_domain.Start, YCoordinate=deconstruct_domain_2.Start, ZCoordinate=deconstruct_domain_3.Start)
construct_point_2 = ConstructPoint(XCoordinate=deconstruct_domain.End, YCoordinate=deconstruct_domain_2.End, ZCoordinate=deconstruct_domain_3.End)
rotate = Rotate(Geometry=xy_plane, Angle=3.141592654, Plane=PlaneXY(0, 0, 0))  # -> Geometry, Transform
offset_curve = OffsetCurve(Curve=flip_curve.Curve, Distance=number_slider_9, Plane=PlaneXY(0, 0, 0), Corners=1)
isosurface_distancefunction = IsosurfaceDistancefunction(
    BoundingBox=box_2pt,
    NumberX=Slider(16, range=0..100),
    NumberY=number_slider_10,
    NumberZ=number_slider_10,
    Isovalue=0,
    Capped=False,
    DistanceObject=boolean_intersect,
    Refine=True)
negative_4 = Negative(Value=number_slider_12)
offset_curve_2 = OffsetCurve(Curve=flip_curve.Curve, Distance=negative_3, Plane=PlaneXY(0, 0, 0), Corners=1)
mirror = Mirror(Geometry=join_curves, Plane=PlaneYZ(0, 0, 0))  # -> Geometry, Transform
multiplication_2 = Multiplication(A=number_slider_12, B=2)
sort_list = SortList(Keys=merge_3)  # -> Keys, ValuesValuesA
end_points = EndPoints(Curve=mirror.Geometry)  # -> Start, End
end_points_2 = EndPoints(Curve=join_curves)  # -> Start, End
sort_list_2 = SortList(Keys=merge_4)  # -> Keys, ValuesValuesA
sort_list_3 = SortList(Keys=merge_5)  # -> Keys, ValuesValuesA
merge_6 = Merge(Data1=negative_4, Data2=number_slider_12)
isosurface_octree = IsosurfaceOctree(Origin=Point(0, 0, 0), WorldSize=number_slider_11, Isovalue=0, Subdivisions=4, DistanceObject=boolean_intersect)
isosurface_distancefunction_2 = IsosurfaceDistancefunction(
    BoundingBox=domain_box_2,
    NumberX=Slider(16, range=0..100),
    NumberY=number_slider_11,
    NumberZ=number_slider_11,
    Isovalue=0,
    Capped=False,
    DistanceObject=box,
    Refine=True)
division_2 = Division(A=number_slider_2, B=2)
deconstruct_mesh = DeconstructMesh(Mesh=voxelategeometry)  # -> Vertices, Faces, Colours, Normals
move = Move(Geometry=rotate.Geometry, Motion=unit_y)  # -> Geometry, Transform
subtraction = Subtraction(A=construct_point_2, B=construct_point)
line_2 = Line(StartPoint=end_points_2.End, EndPoint=end_points.End)
custom_preview = CustomPreview(
    Geometry=isosurface_distancefunction,
    Material={diffuse=RGB(221, 160, 221), emission=RGB(66, 48, 66), shine=0.5, specular=RGB(255, 255, 255), transparency=0})
number_slider_13 = Slider(2.5, range=0..10)
deconstruct = Deconstruct(Point=deconstruct_mesh.Vertices)  # -> XComponent, YComponent, ZComponent
box_2 = Box(DimensionX=8, DimensionY=7, DimensionZ=6, Radius=0, Plane=PlaneXY(0, 0, 0))
multiplication_3 = Multiplication(A=subtraction, B=0.5)
point_2 = Point(flatten(deconstruct_mesh.Vertices))
list_item_2 = ListItem(List=sort_list_2.Keys, Index=0, Wrap=True)  # -> Item1, Item
list_item_3 = ListItem(List=sort_list.Keys, Index=0, Wrap=True)  # -> Item1, Item
list_item_4 = ListItem(List=sort_list_3.Keys, Index=0, Wrap=True)  # -> Item1, Item
construct_point_3 = ConstructPoint(XCoordinate=graft(merge_6), YCoordinate=merge_6, ZCoordinate=0)  # -> flatten(Point)
custom_preview_2 = CustomPreview(
    Geometry=isosurface_octree,
    Material={diffuse=RGB(221, 160, 221), emission=RGB(66, 48, 66), shine=0.5, specular=RGB(255, 255, 255), transparency=0})
deconstruct_2 = Deconstruct(Point=construct_point_2)  # -> XComponent, YComponent, ZComponent
merge_7 = Merge(Data1=join_curves, Data2=mirror.Geometry, Data3=line_2)
rotate_2 = Rotate(Geometry=move.Geometry, Angle=3.141592654, Plane=PlaneXY(0, 0, 0))  # -> Geometry, Transform
addition = Addition(A=multiplication_3, B=construct_point)
construct_domain_3 = ConstructDomain(DomainStart=list_item_2.Item, DomainEnd=list_item_2.Item1)
construct_domain_4 = ConstructDomain(DomainStart=list_item_3.Item, DomainEnd=list_item_3.Item1)
ghpython_script_4 = GhPythonScript(y=point_2, g_a=Slider(0.01, range=0..1), g_b=Slider(0.1, range=0..10), global_scale=Slider(10, range=0..10))  # -> out, flatten(y); inputs y: list of Point3d
# ---------- ghpython_script_4: Python ----------
from math import sin, cos

def sdfGyroid(pt, scale):
    x,y,z=pt.X*scale, pt.Y*scale, pt.Z*scale
    ds = (
        sin(x) * cos(y) + 
        sin(y) * cos(z) + 
        sin(z) * cos(x)
    )
    return ds

for pt in y:
    pt.Z += global_scale*(1+.333*sdfGyroid(pt, g_a * sdfGyroid(pt, g_b)))
# ---------- end ghpython_script_4 ----------
construct_domain_5 = ConstructDomain(DomainStart=list_item_4.Item, DomainEnd=list_item_4.Item1)
larger_than = LargerThan(FirstNumber=deconstruct.ZComponent, SecondNumber=division_2)  # -> LargerThan, flatten(OrEqualTo)
box_3 = Box(DimensionX=8, DimensionY=7, DimensionZ=6, Radius=0, Plane=PlaneXY(0, 0, 0))
list_item_5 = ListItem(List=construct_point_3, Index=0, Wrap=True)  # -> Item, Item1, Item2, Item3
cluster = Cluster_2(value=number_slider_13, A=number_slider_9, curve=offset_curve_2, number=number_slider_12)  # -> curve_4, curve_5, result
cluster_2 = Cluster(distance=number_slider_13, curve=offset_curve, number=number_slider_12)  # -> x, x_2, result
join_curves_2 = JoinCurves(Curves=merge_7, Preserve=False)
offset_curve_3 = OffsetCurve(Curve=join_curves_2, Distance=number_slider_9, Plane=PlaneXY(0, 0, 0), Corners=1)
offset_curve_4 = OffsetCurve(Curve=join_curves_2, Distance=negative_3, Plane=PlaneXY(0, 0, 0), Corners=1)
merge_8 = Merge(Data1=graft(point_2), Data2=graft(ghpython_script_4.y))
ghpython_script_5 = GhPythonScript(x=offset_curve_2, y=move.Geometry)  # -> p2p, x; inputs x: GeometryBase, y: Plane; same code as ghpython_script
box_4 = Box(
    DimensionX=deconstruct_box.X,
    DimensionY=deconstruct_box.Y,
    DimensionZ=deconstruct_box.Z,
    Radius=1,
    Plane=construct_point)
line_3 = Line(StartPoint=list_item_5.Item, EndPoint=list_item_5.Item1)
line_4 = Line(StartPoint=list_item_5.Item2, EndPoint=list_item_5.Item3)
ghpython_script_6 = GhPythonScript(x=offset_curve_4, y=rotate_2.Geometry)  # -> p2p, x; inputs x: GeometryBase, y: Plane; same code as ghpython_script
list_item_6 = ListItem(List=merge_8, Index=graft(larger_than.OrEqualTo), Wrap=True)  # -> flatten(Item)
domain_box_3 = DomainBox(Base=PlaneXY(0, 0, 0), X=construct_domain_3, Y=construct_domain_4, Z=construct_domain_5)
end_points_3 = EndPoints(Curve=cluster.curve_4)  # -> Start, End
end_points_4 = EndPoints(Curve=cluster.curve_5)  # -> Start, End
panel_4 = Panel(list_item_6)
line_5 = Line(StartPoint=end_points_4.Start, EndPoint=list_item_5.Item)
line_6 = Line(StartPoint=end_points_4.End, EndPoint=list_item_5.Item2)
line_7 = Line(StartPoint=end_points_3.End, EndPoint=list_item_5.Item1)
line_8 = Line(StartPoint=end_points_3.Start, EndPoint=list_item_5.Item3)
construct_mesh = ConstructMesh(Vertices=list_item_6, Faces=deconstruct_mesh.Faces, Colours=deconstruct_mesh.Colours)
merge_9 = Merge(
    Data1=cluster.curve_4,
    Data2=cluster.curve_5,
    Data3=line_3,
    Data4=line_4,
    Data5=line_8,
    Data6=line_7,
    Data7=line_5,
    Data8=line_6)  # -> flatten(Result)
custom_preview_3 = CustomPreview(
    Geometry=construct_mesh,
    Material={diffuse=RGB(221, 160, 221), emission=RGB(66, 48, 66), shine=0.5, specular=RGB(255, 255, 255), transparency=0})
unit_z = UnitZ(Factor=multiplication_2)
join_curves_3 = JoinCurves(Curves=merge_9, Preserve=False)
merge_10 = Merge(Data1=negative_4, Data2=number_slider_12)
extrude = Extrude(Base=join_curves_3, Direction=unit_z)
construct_point_4 = ConstructPoint(XCoordinate=merge_10, YCoordinate=graft(cluster_2.result), ZCoordinate=0)  # -> flatten(Point)
addition_2 = Addition(A=multiplication_2, B=Slider(15, range=0..100))
curve = Curve(cluster_2.x)
curve_2 = Curve(cluster_2.x_2)
cap_holes = CapHoles(Brep=extrude)
multiplication_4 = Multiplication(A=addition_2, B=2)
list_item_7 = ListItem(List=construct_point_4, Index=0, Wrap=True)  # -> Item, Item1, Item2, Item3
unit_x = UnitX(Factor=addition_2)
unit_x_2 = UnitX(Factor=multiplication_4)
line_9 = Line(StartPoint=list_item_7.Item, EndPoint=list_item_7.Item2)
line_10 = Line(StartPoint=list_item_7.Item1, EndPoint=list_item_7.Item3)
move_2 = Move(Geometry=cap_holes, Motion=unit_x)  # -> Geometry, Transform
end_points_5 = EndPoints(Curve=curve_2)  # -> Start, End
end_points_6 = EndPoints(Curve=curve)  # -> Start, End
line_11 = Line(StartPoint=end_points_5.End, EndPoint=list_item_7.Item2)
line_12 = Line(StartPoint=end_points_5.Start, EndPoint=list_item_7.Item3)
line_13 = Line(StartPoint=end_points_6.Start, EndPoint=list_item_7.Item)
line_14 = Line(StartPoint=end_points_6.End, EndPoint=list_item_7.Item1)
merge_11 = Merge(Data1=curve, Data2=curve_2, Data3=line_9, Data4=line_10, Data5=line_13, Data6=line_14, Data7=line_12, Data8=line_11)  # -> flatten(Result)
unit_z_2 = UnitZ(Factor=multiplication_2)
join_curves_4 = JoinCurves(Curves=merge_11, Preserve=False)
extrude_2 = Extrude(Base=join_curves_4, Direction=unit_z_2)
cap_holes_2 = CapHoles(Brep=extrude_2)
move_3 = Move(Geometry=cap_holes_2, Motion=unit_x_2)  # -> Geometry, Transform
merge_12 = Merge(Data1=move_3.Geometry, Data2=move_2.Geometry)

# ==== cluster Cluster
distance = ClusterInput()
curve = ClusterInput()
number = ClusterInput()
curve_2 = Curve(curve)
number_2 = Number(number)
bounding_box = BoundingBox(Content=curve_2, Plane=PlaneXY(0, 0, 0))  # -> Box, Box_2
offset_curve = OffsetCurve(Curve=curve_2, Distance=distance, Plane=PlaneXY(0, 0, 0), Corners=1)
deconstruct_box = DeconstructBox(Box=bounding_box.Box)  # -> Plane, X, Y, Z
extend_curve = ExtendCurve(Curve=offset_curve, Type=0, Start=distance, End=distance)
bounding_box_2 = BoundingBox(Content=extend_curve, Plane=PlaneXY(0, 0, 0))  # -> Box, Box_2
deconstruct_box_2 = DeconstructBox(Box=bounding_box_2.Box)  # -> Plane, X, Y, Z
deconstruct_domain = DeconstructDomain(Domain=deconstruct_box.Y)  # -> Start, End
deconstruct_domain_2 = DeconstructDomain(Domain=deconstruct_box_2.Y)  # -> Start, End
subtraction = Subtraction(A=deconstruct_domain_2.End, B=deconstruct_domain_2.Start)
subtraction_2 = Subtraction(A=deconstruct_domain.End, B=deconstruct_domain.Start)
subtraction_3 = Subtraction(A=number_2, B=subtraction)
subtraction_4 = Subtraction(A=number_2, B=subtraction_2)
subtraction_5 = Subtraction(A=number_2, B=deconstruct_domain.End)
subtraction_6 = Subtraction(A=number_2, B=deconstruct_domain_2.End)
negative = Negative(Value=subtraction_3)
unit_y = UnitY(Factor=subtraction_6)
unit_y_2 = UnitY(Factor=subtraction_5)
merge = Merge(Data1=subtraction_4, Data2=negative)
xy_plane = XYPlane(Origin=unit_y)
xy_plane_2 = XYPlane(Origin=unit_y_2)
result = ClusterOutput(merge)
rotate = Rotate(Geometry=xy_plane, Angle=3.141592654, Plane=PlaneXY(0, 0, 0))  # -> Geometry, Transform
ghpython_script = GhPythonScript(x=curve_2, y=xy_plane_2)  # -> p2p, x; inputs x: GeometryBase, y: Plane
# ---------- ghpython_script: Python ----------
from Rhino.Geometry.Transform import PlaneToPlane
from Rhino.Geometry.Plane import WorldXY

t_m=PlaneToPlane(WorldXY, y)
x.Transform(t_m)
# ---------- end ghpython_script ----------
ghpython_script_2 = GhPythonScript(x=extend_curve, y=rotate.Geometry)  # -> p2p, x; inputs x: GeometryBase, y: Plane; same code as ghpython_script
x = ClusterOutput(ghpython_script.x)
x_2 = ClusterOutput(ghpython_script_2.x)

# ==== cluster Cluster_2
value = ClusterInput()
A = ClusterInput()
curve = ClusterInput()
number = ClusterInput()
negative = Negative(Value=value)
extrat = Number(negative)
curve_2 = Curve(curve)
multiplication = Multiplication(A=A, B=2)
number_2 = Number(number)
bounding_box = BoundingBox(Content=curve_2, Plane=PlaneXY(0, 0, 0))  # -> Box, Box_2
flatoffset = Number(multiplication)
offset_curve = OffsetCurve(Curve=curve_2, Distance=extrat, Plane=PlaneXY(0, 0, 0), Corners=1)
deconstruct_box = DeconstructBox(Box=bounding_box.Box)  # -> Plane, X, Y, Z
deconstruct_domain = DeconstructDomain(Domain=deconstruct_box.Y)  # -> Start, End
extend_curve = ExtendCurve(Curve=offset_curve, Type=0, Start=extrat, End=extrat)
curve_3 = Curve(extend_curve)
bounding_box_2 = BoundingBox(Content=curve_3, Plane=PlaneXY(0, 0, 0))  # -> Box, Box_2
deconstruct_box_2 = DeconstructBox(Box=bounding_box_2.Box)  # -> Plane, X, Y, Z
deconstruct_domain_2 = DeconstructDomain(Domain=deconstruct_box_2.Y)  # -> Start, End
subtraction = Subtraction(A=deconstruct_domain_2.End, B=deconstruct_domain_2.Start)
subtraction_2 = Subtraction(A=deconstruct_domain.End, B=deconstruct_domain.Start)
subtraction_3 = Subtraction(A=number_2, B=subtraction_2)
subtraction_4 = Subtraction(A=number_2, B=subtraction)
negative_2 = Negative(Value=subtraction_4)
addition = Addition(A=deconstruct_domain.Start, B=number_2)
addition_2 = Addition(A=deconstruct_domain_2.Start, B=number_2)
addition_3 = Addition(A=addition, B=flatoffset)
addition_4 = Addition(A=addition_2, B=flatoffset)
merge = Merge(Data1=subtraction_3, Data2=negative_2)
negative_3 = Negative(Value=addition_4)
negative_4 = Negative(Value=addition_3)
result = ClusterOutput(merge)
unit_y = UnitY(Factor=negative_3)
unit_y_2 = UnitY(Factor=negative_4)
xy_plane = XYPlane(Origin=unit_y)
xy_plane_2 = XYPlane(Origin=unit_y_2)
negative_5 = Negative(Value=flatoffset)
rotate = Rotate(Geometry=xy_plane_2, Angle=3.141592654, Plane=PlaneXY(0, 0, 0))  # -> Geometry, Transform
ghpython_script = GhPythonScript(x=curve_3, y=xy_plane)  # -> p2p, x; inputs x: GeometryBase, y: Plane; same code as ghpython_script
flatoffset_2 = Number(negative_5)
ghpython_script_2 = GhPythonScript(x=curve_2, y=rotate.Geometry)  # -> p2p, x; inputs x: GeometryBase, y: Plane; same code as ghpython_script
extend_curve_2 = ExtendCurve(Curve=ghpython_script.x, Type=0, Start=flatoffset_2, End=flatoffset_2)
extend_curve_3 = ExtendCurve(Curve=ghpython_script_2.x, Type=0, Start=flatoffset_2, End=flatoffset_2)
curve_4 = ClusterOutput(extend_curve_3)
curve_5 = ClusterOutput(extend_curve_2)
