# Grasshopper definition larger_holes.gh (Grasshopper 1.0.7)
# plug-ins: Weaverbird

number_slider = Slider(120, range=0..250)
number_slider_2 = Slider(10, range=0..10)
number_slider_3 = Slider(2, range=0..10)
unit_z = UnitZ(Factor=number_slider)
division = Division(A=number_slider, B=2)
addition = Addition(A=number_slider_3, B=1)
division_2 = Division(A=number_slider, B=addition)
weaverbird_s_mesh_prism = WeaverbirdsMeshPrism(
    Plane=PlaneXY(0, 0, 0),
    Width=division,
    NumberOfSides=Slider(4, range=0..10),
    TopPoint=unit_z,
    BasePolygonMethod=True,
    FillStrategy=1)
bounding_box = BoundingBox(Content=weaverbird_s_mesh_prism, Plane=PlaneXY(0, 0, 0))  # -> Box, Box_2
deconstruct_box = DeconstructBox(Box=bounding_box.Box)  # -> Plane, X, Y, Z
rectangle = Rectangle(Plane=deconstruct_box.Plane, XSize=deconstruct_box.X, YSize=deconstruct_box.Y, Radius=0)  # -> Rectangle, Length
divide_curve = DivideCurve(Curve=rectangle.Rectangle, Count=1, Kinks=True)  # -> Points, Tangents, Parameters
number_slider_4 = Slider(3, range=0..10)
shift_list = ShiftList(List=divide_curve.Points, Shift=1, Wrap=True)
number_slider_5 = Slider(35, range=0..100)
line = Line(StartPoint=divide_curve.Points, EndPoint=shift_list)
series = Series(Start=division_2, Step=division_2, Count=number_slider_3)
weaverbird_s_constant_quads_split_subdiv = WeaverbirdsConstantQuadsSplitSubdivision(MeshCurves=weaverbird_s_mesh_prism, Level=Slider(3, range=0..10), SmoothNakedEdges=0)
multiplication = Multiplication(A=number_slider, B=Slider(1, range=0..10))
domain = Domain(Domain(0, 1))
point = Point(Point(0, 0, 0))
subtraction = Subtraction(A=number_slider_4, B=1)
negative = Negative(Value=number_slider_5)
shift_list_2 = ShiftList(List=line, Shift=1, Wrap=True)
negative_2 = Negative(Value=division)
negative_3 = Negative(Value=division)
unit_z_2 = UnitZ(Factor=series)
split_list = SplitList(List=shift_list_2, Index=Slider(1, range=0..1))  # -> ListA, ListB
series_2 = Series(Start=1, Step=1, Count=subtraction)
line_2 = Line(split_list.ListB)
crvdom = CurveDomain(Curve=line_2, Domain=domain)  # -> Curve, Domain
division_3 = Division(A=series_2, B=number_slider_4)
weaverbird_s_constant_quads_split_subdiv_2 = WeaverbirdsConstantQuadsSplitSubdivision(MeshCurves=weaverbird_s_constant_quads_split_subdiv, Level=Slider(2, range=0..10), SmoothNakedEdges=0)
unit_x = UnitX(Factor=division)
unit_x_2 = UnitX(Factor=negative_3)
unit_y = UnitY(Factor=division)
unit_y_2 = UnitY(Factor=negative_2)
subtraction_2 = Subtraction(A=division_3, B=0.5)
Z = UnitZ(Factor=1)
number_slider_6 = Slider(10, range=0..100)
multiplication_2 = Multiplication(A=Slider(1.5, range=0..10), B=subtraction_2)
yz_plane = YZPlane(Origin=unit_x)
yz_plane_2 = YZPlane(Origin=unit_x_2)
xz_plane = XZPlane(Origin=unit_y)
xz_plane_2 = XZPlane(Origin=unit_y_2)
addition_2 = Addition(A=multiplication_2, B=Slider(0.7, range=0..1))
eval = EvaluateCurve(Curve=graft(crvdom.Curve), Parameter=addition_2)  # -> flatten(Point), flatten(Tangent), Angle
addition_3 = Addition(A=graft(eval.Point), B=unit_z_2)
deconstruct = Deconstruct(Point=addition_3)  # -> XComponent, YComponent, ZComponent
line_3 = Line(StartPoint=addition_3, EndPoint=point)
length = Length(Curve=line_3)
division_4 = Division(A=length, B=multiplication)
multiplication_3 = Multiplication(A=deconstruct.ZComponent, B=division_4)
pl = ConstructPlane(Origin=eval.Point, XAxis=eval.Tangent, YAxis=Z)
lng = ListLength(List=pl)
vector_xyz = VectorXYZ(XComponent=deconstruct.XComponent, YComponent=deconstruct.YComponent, ZComponent=multiplication_3)  # -> Vector, Length
line_4 = Line()
mesh = Mesh(weaverbird_s_constant_quads_split_subdiv_2)
merge = Merge(Data1=Slider(15, range=0..100), Data2=Slider(15, range=0..100), Data3=Slider(15, range=0..100))
split = SplitList(List=pl, Index=expr("x-1", lng))  # -> ListA, ListB
point_2 = Point(vector_xyz.Vector)
unit_vector = UnitVector(Vector=point_2)
multiplication_4 = Multiplication(A=number_slider_5, B=unit_vector)
multiplication_5 = Multiplication(A=negative, B=unit_vector)
addition_4 = Addition(A=addition_3, B=multiplication_4)
addition_5 = Addition(A=addition_3, B=multiplication_5)
number_slider_7 = Slider(10, range=0..10)
deconstruct_mesh = DeconstructMesh(Mesh=mesh)  # -> Vertices, Faces, Colours, Normals
number_slider_8 = Slider(25, range=0..100)
line_5 = Line(StartPoint=addition_4, EndPoint=addition_5)
merge_2 = Merge(Data1=number_slider_6, Data2=number_slider_6, Data3=number_slider_6)
value_list = ValueList({"x", "y"}, selected="x")
pipe = Pipe(Curve=line_5, Radius=Slider(11, range=0..25), Caps=2)  # disabled
rad = Radians(Degrees=Slider(45, range=0..100))
number_slider_9 = Slider(7.5, range=0..100)
rad_2 = Radians(Degrees=Slider(0, range=0..100))
rad_3 = Radians(Degrees=Slider(30, range=0..100))
neg = Negative(Value=rad_3)
subtraction_3 = Subtraction(A=number_slider_7, B=1)
value_list_2 = ValueList({"x", "y"}, selected="x")
ghpython_script = GhPythonScript(
    pts=deconstruct_mesh.Vertices,
    direction=value_list,
    scales=merge,
    isoplane=Slider(60, range=-100..100),
    amplitude=Slider(60, range=-100..250),
    dir_b=Toggle(False),
    w=Slider(31.765, range=0..100))  # -> out, pts; inputs pts: list of Point3d, scales: list, dir_b: Boolean
# ---------- ghpython_script: Python ----------
import sys

sys.path.append("/Users/jonas/Documents/reps/rrreefs_coral_feet/grasshopper/patterns/")

import patterns as pat

reload(pat)

pts = pat.move_pts(pts, pat.uv_gyroid, direction, dir_b, isoplane, amplitude, w, scales)
# ---------- end ghpython_script ----------
merge_3 = Merge(Data1=number_slider_8, Data2=number_slider_8, Data3=number_slider_8)
series_3 = Series(Start=0, Step=1, Count=number_slider_7)
brep = Brep(flatten(pipe))  # disabled
lng_2 = ListLength(List=brep)  # disabled
division_5 = Division(A=rad, B=subtraction_3)
merge_4 = Merge(Data1=rad_2, Data2=rad_3)
subtraction_4 = Subtraction(A=lng_2, B=number_slider_3)  # disabled
merge_5 = Merge(Data1=neg, Data2=rad_2, Data3=rad_3)
merge_6 = Merge(Data1=Slider(40, range=0..100), Data2=Slider(95, range=0..100))
ghpython_script_2 = GhPythonScript(
    pts=ghpython_script.pts,
    direction=value_list_2,
    scales=merge_2,
    isoplane=Slider(-60, range=-100..100),
    amplitude=Slider(10, range=-100..250),
    dir_b=Toggle(True),
    w=Slider(31.765, range=0..100))  # -> out, pts; inputs pts: list of Point3d, scales: list, dir_b: Boolean; same code as ghpython_script
merge_7 = Merge(Data1=number_slider_9, Data2=number_slider_9, Data3=number_slider_9)
value_list_3 = ValueList({"x", "y"}, selected="y")
split_2 = SplitList(List=brep, Index=subtraction_4)  # -> ListA, ListB; disabled
int = Integer([0, 0, 1, 1])
multiplication_6 = Multiplication(A=division_5, B=series_3)
lng_3 = ListLength(List=int)
pln = Plane(graft(split.ListA))
brep_2 = Brep(flatten(split_2.ListA))  # disabled
mod = Modulus(A=series_3, B=lng_3)
panel = Panel(ghpython_script.out)
value_list_4 = ValueList({"x", "y"}, selected="y")
ghpython_script_3 = GhPythonScript(
    pts=ghpython_script_2.pts,
    direction=value_list_3,
    scales=merge_3,
    isoplane=Slider(60, range=-100..100),
    amplitude=Slider(15, range=-100..250),
    dir_b=Toggle(False),
    w=Slider(31.765, range=0..100))  # -> out, pts; inputs pts: list of Point3d, scales: list, dir_b: Boolean; same code as ghpython_script
Z_2 = UnitZ(Factor=merge_6)
item = ListItem(List=int, Index=mod, Wrap=True)
yz = YZPlane(Origin=Point(0, 0, 0))
item_2 = ListItem(List=merge_4, Index=item, Wrap=True)
merge_8 = Merge(Data1=pln, Data2=pln)  # -> flatten(Result)
ghpython_script_4 = GhPythonScript(
    pts=ghpython_script_3.pts,
    direction=value_list_4,
    scales=merge_7,
    isoplane=Slider(-60, range=-100..100),
    amplitude=Slider(15, range=-100..250),
    dir_b=Toggle(True),
    w=Slider(31.765, range=0..100))  # -> out, pts; inputs pts: list of Point3d, scales: list, dir_b: Boolean; same code as ghpython_script
construct_mesh = ConstructMesh(Vertices=ghpython_script_4.pts, Faces=deconstruct_mesh.Faces)
lng_4 = ListLength(List=Z_2)
mesh_2 = Mesh(weaverbird_s_mesh_prism)
weaverbird_s_catmull_clark_subdivision = WeaverbirdsCatmullClarkSubdivision(MeshCurves=construct_mesh, Level=1, SmoothNakedEdges=1)
neg_2 = Negative(Value=multiplication_6)
mesh_3 = Mesh(construct_mesh)
mod_2 = Modulus(A=series_3, B=lng_4)
item_3 = ListItem(List=Z_2, Index=mod_2, Wrap=True)
number_slider_10 = Slider(40, range=0..100)
move = Move(Geometry=merge_8, Motion=item_3)  # -> Geometry, Transform
deplane = DeconstructPlane(Plane=move.Geometry)  # -> Origin, XAxis, YAxis, ZAxis
pl_2 = PlaneNormal(Origin=Point(0, 0, 0), ZAxis=deplane.XAxis)
pl_3 = PlaneNormal(Origin=Point(0, 0, 0), ZAxis=deplane.YAxis)
rotate = Rotate(Geometry=deplane.ZAxis, Angle=neg_2, Plane=pl_2)  # -> Geometry, Transform
rotate_2 = Rotate(Geometry=rotate.Geometry, Angle=item_2, Plane=pl_3)  # -> Geometry, Transform
mesh_4 = Mesh(weaverbird_s_catmull_clark_subdivision)
multiplication_7 = Multiplication(A=number_slider_10, B=rotate_2.Geometry)
item_4 = ListItem(List=move.Geometry, Index=Slider(1, range=0..10), Wrap=True)
neg_3 = Negative(Value=number_slider_10)
addition_6 = Addition(A=multiplication_7, B=deplane.Origin)
multiplication_8 = Multiplication(A=neg_3, B=rotate_2.Geometry)
addition_7 = Addition(A=multiplication_8, B=deplane.Origin)
ln = Line(StartPoint=addition_7, EndPoint=addition_6)
multiplication_9 = Multiplication(A=Slider(35, range=0..100), B=unit_vector)
multiplication_10 = Multiplication(A=negative, B=unit_vector)
addition_8 = Addition(A=addition_3, B=multiplication_9)
addition_9 = Addition(A=addition_3, B=multiplication_10)
line_6 = Line(StartPoint=addition_8, EndPoint=addition_9)
pipe_2 = Pipe(Curve=ln, Radius=Slider(11, range=0..25), Caps=1)
mesh_5 = Mesh(pipe_2)
flatten_tree = FlattenTree(Tree=mesh_5, Path="{0}")
mesh_difference = MeshDifference(MeshesA=mesh_4, MeshesB=flatten_tree)
