# Grasshopper definition pattern_cube_sinoid_amplitude_holes_test.gh (Grasshopper 1.0.7)
# plug-ins: Weaverbird

number_slider = Slider(80, range=0..1000)
multiplication = Multiplication(A=number_slider, B=0.5)
neg = Negative(Value=multiplication)
number_slider_2 = Slider(120, range=0..1000)
dom = ConstructDomain(DomainStart=neg, DomainEnd=multiplication)
dom_2 = ConstructDomain(DomainStart=neg, DomainEnd=multiplication)
addition = Addition(A=number_slider, B=Slider(10, range=0..10))
number_slider_3 = Slider(3, range=0..10)
box = DomainBox(Base=PlaneXY(0, 0, 0), X=dom, Y=dom_2, Z=addition)
mbox = MeshBox(Base=box, XCount=number_slider_3, YCount=number_slider_3, ZCount=number_slider_3)
weld = WeldMesh(Mesh=mbox, Angle=3.141592654)
wbcatmullclark = WeaverbirdsCatmullClarkSubdivision(MeshCurves=weld, Level=Slider(3, range=0..10), SmoothNakedEdges=1)
wbcatmullclark_2 = WeaverbirdsCatmullClarkSubdivision(MeshCurves=wbcatmullclark, Level=Slider(2, range=0..10), SmoothNakedEdges=1)
demesh = DeconstructMesh(Mesh=wbcatmullclark_2)  # -> Vertices, Faces, Colours, Normals
vec = Vector(demesh.Normals)
pt = Point(demesh.Vertices)
number_slider_4 = Slider(200, range=0..500)
pi = Pi(Factor=2)
pt_2 = Point(pt)
pi_2 = Pi(Factor=2)
pi_3 = Pi(Factor=2)
pi_4 = Pi(Factor=2)
gyroid = GhPythonScript(pts=pt_2, n=vec, period=number_slider_4)  # -> out, pts; inputs pts: list of Point3d, n: list of Vector3d
# ---------- gyroid: Python ----------
from math import sin, cos

n_pts = []
for i, pt in enumerate(pts):
    u, v, w = (pt.X/period, pt.Y/period, pt.Z/period)
    
    v = ( sin(u) * cos(v) + sin(v) * cos(w) + sin(w) * cos(u) ) * .3333 + .5
    
    n_pts.append(n[i]*v + pt)
    
pts = n_pts
# ---------- end gyroid ----------
pi_5 = Pi(Factor=2)
division = Division(A=number_slider_4, B=pi_2)
division_2 = Division(A=Slider(10, range=0..100), B=pi)
division_3 = Division(A=Slider(30, range=0..100), B=pi)
pi_6 = Pi(Factor=2)
pt_3 = ConstructPoint(XCoordinate=1, YCoordinate=1, ZCoordinate=0)
Z = UnitZ(Factor=1)
neg_2 = Negative(Value=Slider(1, range=0..1))
division_4 = Division(A=Slider(20, range=0..25), B=pi_5)
xy = XYPlane(Origin=Point(0, 0, 0))
split = SplitList(List=pt, Index=Slider(100, range=0..100))  # -> ListA, ListB
division_5 = Division(A=Slider(120, range=0..250), B=pi_4)
division_6 = Division(A=Slider(100, range=0..100), B=pi_4)
gyroid_2 = GhPythonScript(pts=pt, n=vec, period=division, amplitude=Slider(60, range=0..100))  # -> out, pts; inputs pts: list of Point3d, n: list of Vector3d; disabled
# ---------- gyroid_2: Python ----------
from math import sin, cos

n_pts = []
for i, pt in enumerate(pts):
    u, v, w = (pt.X/period, pt.Y/period, pt.Z/period)
    
    v = ( sin(u) * cos(v) + sin(v) * cos(w) + sin(w) * cos(u) ) * .3333
    
    n_pts.append(n[i]*v*amplitude + pt)
    
pts = n_pts
# ---------- end gyroid_2 ----------
pt_4 = ConstructPoint(XCoordinate=Slider(1, range=0..1), YCoordinate=neg_2, ZCoordinate=0)
pl = ConstructPlane(Origin=Point(0, 0, 0), XAxis=pt_3, YAxis=Z)
Z_2 = UnitZ(Factor=1)
xy_2 = XYPlane(Origin=Point(0, 0, 0))
gyroid_3 = GhPythonScript(pts=pt, n=vec, period=division_4, amplitude=Slider(17.5, range=0..100))  # -> out, pts; inputs pts: list of Point3d, n: list of Vector3d
# ---------- gyroid_3: Python ----------
from math import sin, cos

n_pts = []

p_inv = 1. / period

for i, pt in enumerate(pts):
    u, v, w = (pt.X*p_inv, pt.Y*p_inv, pt.Z*p_inv)
    salt_val = ( sin(u) * cos(v) + sin(v) * cos(w) + sin(w) * cos(u) ) * .3333 
    s_val = p_inv*(1. + .01 * salt_val)
    
    u, v, w = (pt.X*s_val, pt.Y*s_val, pt.Z*s_val)
    
    v = ( sin(u) * cos(v) + sin(v) * cos(w) + sin(w) * cos(u) ) * .3333
    
    n_pts.append(n[i]*v*amplitude + pt)
    
pts = n_pts
# ---------- end gyroid_3 ----------
gyroid_4 = GhPythonScript(
    pts=pt,
    n=vec,
    period_min=division_2,
    period_max=division_3,
    amplitude=Slider(50, range=0..100),
    period_plane=pl,
    period_treshold_distance=Slider(50, range=0..1000),
    amplitude_plane=xy,
    amplitude_treshold_distance=Slider(120, range=0..1000))  # -> out, pts, shift_vals; inputs pts: list of Point3d, n: list of Vector3d, period_plane: Plane, amplitude_plane: Plane
# ---------- gyroid_4: Python ----------
from math import sin, cos, pi

n_pts = []
shift_vals = []

def remap_value(a, b, dm, v):
    return b + (v - a) * dm

def amplitude_function(pt):
    global amplitude_plane, amplitude_treshold_distance, amplitude
    d = amplitude_plane.DistanceTo(pt)
    f = (d / amplitude_treshold_distance) * amplitude if d < amplitude_treshold_distance else amplitude

    return f

dm_period = (period_max - period_min) / (2 * period_treshold_distance)
remap_a = period_treshold_distance
remap_b = period_min

count_pos = 0
count_negs = 0
count_smooth = 0

def period_function(pt):
    global period_plane, period_treshold_distance
    global dm_period, remap_a, remap_b
    global count_pos, count_negs, count_smooth
    
    d = period_plane.DistanceTo(pt)
    
    if d >= period_treshold_distance:
        count_pos += 1
        return period_max
    elif abs(d) >= period_treshold_distance:
        count_negs += 1
        return period_min
    else:
        count_smooth += 1
        return remap_value(-remap_a, remap_b, dm_period, d)

for i, pt in enumerate(pts):
    p = period_function(pt)
    # print(p)
    
    u, v, w = (pt.X / p, pt.Y / p, pt.Z / p)
    
    v = ( sin(u) * cos(v) + sin(v) * cos(w) + sin(w) * cos(u) ) * .3333 -.5
    amp = amplitude_function(pt) * .5
    
    shift_val = amp*v
    
    shift_vals.append(shift_val)
    n_pts.append(n[i]*shift_val + pt)
    
pts = n_pts

print("smooth: {}, negs: {}, pos: {}".format(count_smooth, count_negs, count_pos))
# ---------- end gyroid_4 ----------
pl_2 = ConstructPlane(Origin=Point(0, 0, 0), XAxis=pt_4, YAxis=Z_2)
gyroid_5 = GhPythonScript(
    pts=pt,
    n=vec,
    period_min=division_5,
    period_max=division_6,
    amplitude=Slider(51, range=0..100),
    period_plane=pl_2,
    period_treshold_distance=Slider(50, range=0..1000),
    amplitude_plane=xy_2,
    amplitude_treshold_distance=Slider(100, range=0..1000))  # -> out, shift_vals, pts; inputs pts: list of Point3d, n: list of Vector3d, period_plane: Plane, amplitude_plane: Plane
# ---------- gyroid_5: Python ----------
from math import sin, cos, pi

n_pts = []
shift_vals = []

def remap_value(a, b, dm, v):
    return b + (v - a) * dm

def amplitude_function(pt):
    global amplitude_plane, amplitude_treshold_distance, amplitude
    d = amplitude_plane.DistanceTo(pt)
    f = (d / amplitude_treshold_distance) * amplitude if d < amplitude_treshold_distance else amplitude

    return f

dm_period = (period_max - period_min) / (2 * period_treshold_distance)
remap_a = period_treshold_distance
remap_b = period_min

count_pos = 0
count_negs = 0
count_smooth = 0

def period_function(pt):
    global period_plane, period_treshold_distance
    global dm_period, remap_a, remap_b
    global count_pos, count_negs, count_smooth
    
    d = period_plane.DistanceTo(pt)
    
    if d >= period_treshold_distance:
        count_pos += 1
        return period_max
    elif abs(d) >= period_treshold_distance:
        count_negs += 1
        return period_min
    else:
        count_smooth += 1
        return remap_value(-remap_a, remap_b, dm_period, d)

for i, pt in enumerate(pts):
    p = period_function(pt)
    # print(p)
    
    u, v, w = (pt.X / p, pt.Y / p, pt.Z / p)
    
    v = ( sin(u) * cos(v) + sin(v) * cos(w) + sin(w) * cos(u) ) * .1666 + .5
    amp = amplitude_function(pt) * .5
    
    shift_val = amp*v
    
    shift_vals.append(shift_val)
    n_pts.append(n[i]*shift_val + pt)
    
pts = n_pts

print("smooth: {}, negs: {}, pos: {}".format(count_smooth, count_negs, count_pos))
# ---------- end gyroid_5 ----------
conmesh = ConstructMesh(Vertices=gyroid_3.pts, Faces=demesh.Faces)
addition_2 = Addition(A=gyroid_4.shift_vals, B=gyroid_5.shift_vals)
multiplication_2 = Multiplication(A=vec, B=addition_2)
bnd = Bounds(Numbers=gyroid_4.shift_vals)
addition_3 = Addition(A=demesh.Vertices, B=multiplication_2)
conmesh_2 = ConstructMesh(Vertices=addition_3, Faces=demesh.Faces)
panel = Panel(bnd)
bbox = BoundingBox(Content=conmesh_2, Plane=PlaneXY(0, 0, 0))  # -> Box, Box_2
debox = DeconstructBox(Box=bbox.Box)  # -> Plane, X, Y, Z
dedomain = DeconstructDomain(Domain=debox.X)  # -> Start, End
dedomain_2 = DeconstructDomain(Domain=debox.Y)  # -> Start, End
dedomain_3 = DeconstructDomain(Domain=debox.Z)  # -> Start, End
panel_2 = Panel(debox.X)
panel_3 = Panel(debox.Y)
panel_4 = Panel(debox.Z)
addition_4 = Addition(A=dedomain.Start, B=dedomain.End)
addition_5 = Addition(A=dedomain_2.Start, B=dedomain_2.End)
addition_6 = Addition(A=dedomain_3.Start, B=dedomain_3.End)
multiplication_3 = Multiplication(A=addition_4, B=0.5)
multiplication_4 = Multiplication(A=addition_5, B=0.5)
multiplication_5 = Multiplication(A=addition_6, B=0.5)
pt_5 = ConstructPoint(XCoordinate=multiplication_3, YCoordinate=dedomain_2.End, ZCoordinate=multiplication_5)
pt_6 = ConstructPoint(XCoordinate=dedomain.Start, YCoordinate=multiplication_4, ZCoordinate=multiplication_5)
pt_7 = ConstructPoint(XCoordinate=multiplication_3, YCoordinate=multiplication_4, ZCoordinate=multiplication_5)
pt_8 = ConstructPoint(XCoordinate=multiplication_3, YCoordinate=dedomain_2.Start, ZCoordinate=multiplication_5)
pt_9 = ConstructPoint(XCoordinate=dedomain.End, YCoordinate=multiplication_4, ZCoordinate=multiplication_5)
merge = Merge(Data1=pt_8, Data2=pt_5, Data3=pt_6, Data4=pt_9)
subtraction = Subtraction(A=merge, B=pt_7)
pl_3 = PlaneNormal(Origin=merge, ZAxis=subtraction)
rad = Radians(Degrees=Slider(10, range=0..90))
rad_2 = Radians(Degrees=Slider(30, range=0..90))
deplane = DeconstructPlane(Plane=pl_3)  # -> Origin, XAxis, YAxis, ZAxis
pt_10 = Point(Point(0, 0, 0))
xz = XZPlane(Origin=Point(0, 0, 0))
merge_2 = Merge(Data1=rad, Data2=rad_2)
yz = YZPlane(Origin=Point(0, 0, 0))
merge_3 = Merge(Data1=rad, Data2=rad_2)
neg_3 = Negative(Value=rad)
neg_4 = Negative(Value=rad_2)
multiplication_6 = Multiplication(A=merge_3, B=0)
xy_3 = XYPlane(Origin=Point(0, 0, 0))
merge_4 = Merge(Data1=yz, Data2=yz, Data3=xz, Data4=xz)
merge_5 = Merge(Data1=rad, Data2=neg_3, Data3=rad_2, Data4=neg_4)
xz_2 = XZPlane(Origin=Point(0, 0, 0))
xz_3 = XZPlane(Origin=Point(0, 0, 0))
merge_6 = Merge(Data1=merge_3, Data2=multiplication_6)
yz_2 = YZPlane(Origin=Point(0, 0, 0))
yz_3 = YZPlane(Origin=Point(0, 0, 0))
xz_4 = XZPlane(Origin=Point(0, 0, 0))
xz_5 = XZPlane(Origin=Point(0, 0, 0))
yz_4 = YZPlane(Origin=Point(0, 0, 0))
yz_5 = YZPlane(Origin=Point(0, 0, 0))
pl_4 = PlaneNormal(Origin=pt_10, ZAxis=deplane.XAxis)
pl_5 = PlaneNormal(Origin=pt_10, ZAxis=deplane.YAxis)
rotate = Rotate(Geometry=deplane.ZAxis, Angle=merge_6, Plane=xy_3)  # -> Geometry, Transform
neg_5 = Negative(Value=merge_5)
merge_7 = Merge(Data1=yz_4, Data2=xz_4, Data3=yz_5, Data4=xz_5)
merge_8 = Merge(Data1=xz_2, Data2=yz_2, Data3=yz_3, Data4=xz_3)
rotate_2 = Rotate(Geometry=rotate.Geometry, Angle=neg_5, Plane=merge_4)  # -> Geometry, Transform
rev = ReverseList(List=merge_4)
pt_11 = Point(rotate.Geometry)
scale = Scale(Geometry=graft(rotate_2.Geometry), Center=Point(0, 0, 0), Factor=Slider(40, range=0..100))  # -> Geometry, Transform
subtraction_2 = Subtraction(A=graft(deplane.Origin), B=scale.Geometry)
addition_7 = Addition(A=graft(deplane.Origin), B=scale.Geometry)
ln = Line(StartPoint=graft(subtraction_2), EndPoint=addition_7)
pipe = Pipe(Curve=ln, Radius=expr("x * .5", Slider(22, range=0..100)), Caps=1)
mesh = Mesh(flatten(pipe))
mdif = MeshDifference(MeshesA=conmesh_2, MeshesB=mesh)
preview = CustomPreview(
    Geometry=mdif,
    Material={diffuse=RGB(221, 160, 221), emission=RGB(66, 48, 66), shine=0.5, specular=RGB(255, 255, 255), transparency=0})
