# Grasshopper definition patterns.gh (Grasshopper 1.0.7)
# plug-ins: Weaverbird

number_slider = Slider(120, range=0..250)
number_slider_2 = Slider(10, range=0..10)
number_slider_3 = Slider(3, range=0..10)
unit_z = UnitZ(Factor=number_slider)
division = Division(A=number_slider, B=2)
addition = Addition(A=number_slider_3, B=1)
division_2 = Division(A=number_slider, B=addition)
weaverbird_s_mesh_prism = WeaverbirdsMeshPrism(
    Plane=PlaneXY(0, 0, 0),
    Width=division,
    NumberOfSides=Slider(4, range=0..10),
    TopPoint=unit_z,
    BasePolygonMethod=True,
    FillStrategy=1)
bounding_box = BoundingBox(Content=weaverbird_s_mesh_prism, Plane=PlaneXY(0, 0, 0))  # -> Box, Box_2
deconstruct_box = DeconstructBox(Box=bounding_box.Box)  # -> Plane, X, Y, Z
rectangle = Rectangle(Plane=deconstruct_box.Plane, XSize=deconstruct_box.X, YSize=deconstruct_box.Y, Radius=0)  # -> Rectangle, Length
divide_curve = DivideCurve(Curve=rectangle.Rectangle, Count=1, Kinks=True)  # -> Points, Tangents, Parameters
shift_list = ShiftList(List=divide_curve.Points, Shift=1, Wrap=True)
series = Series(Start=division_2, Step=division_2, Count=number_slider_3)
line = Line(StartPoint=divide_curve.Points, EndPoint=shift_list)
number_slider_4 = Slider(25, range=0..100)
weaverbird_s_constant_quads_split_subdiv = WeaverbirdsConstantQuadsSplitSubdivision(MeshCurves=weaverbird_s_mesh_prism, Level=Slider(3, range=0..10), SmoothNakedEdges=0)
shift_list_2 = ShiftList(List=line, Shift=1, Wrap=True)
multiplication = Multiplication(A=number_slider, B=Slider(1.5, range=0..10))
negative = Negative(Value=division)
negative_2 = Negative(Value=division)
split_list = SplitList(List=shift_list_2, Index=Slider(1, range=0..1))  # -> ListA, ListB
negative_3 = Negative(Value=number_slider_4)
unit_z_2 = UnitZ(Factor=series)
point = Point(Point(0, 0, 0))
line_2 = Line(split_list.ListB)
divide_curve_2 = DivideCurve(Curve=line_2, Count=Slider(4, range=0..10), Kinks=False)  # -> Points, Tangents, Parameters
list_item = ListItem(List=divide_curve_2.Points, Index=1, Wrap=True)  # -> Item, Item1, Item2
weaverbird_s_constant_quads_split_subdiv_2 = WeaverbirdsConstantQuadsSplitSubdivision(MeshCurves=weaverbird_s_constant_quads_split_subdiv, Level=Slider(2, range=0..10), SmoothNakedEdges=0)
unit_x = UnitX(Factor=division)
unit_x_2 = UnitX(Factor=negative_2)
unit_y = UnitY(Factor=division)
unit_y_2 = UnitY(Factor=negative)
merge = Merge(Data1=list_item.Item, Data2=list_item.Item1, Data3=list_item.Item2)  # -> flatten(Result)
number_slider_5 = Slider(10, range=0..100)
yz_plane = YZPlane(Origin=unit_x)
yz_plane_2 = YZPlane(Origin=unit_x_2)
xz_plane = XZPlane(Origin=unit_y)
xz_plane_2 = XZPlane(Origin=unit_y_2)
addition_2 = Addition(A=graft(merge), B=unit_z_2)
deconstruct = Deconstruct(Point=addition_2)  # -> XComponent, YComponent, ZComponent
line_3 = Line(StartPoint=addition_2, EndPoint=point)
length = Length(Curve=line_3)
division_3 = Division(A=length, B=multiplication)
multiplication_2 = Multiplication(A=deconstruct.ZComponent, B=division_3)
mesh = Mesh(weaverbird_s_constant_quads_split_subdiv_2)
merge_2 = Merge(Data1=Slider(15, range=0..100), Data2=Slider(15, range=0..100), Data3=Slider(15, range=0..100))
vector_xyz = VectorXYZ(XComponent=deconstruct.XComponent, YComponent=deconstruct.YComponent, ZComponent=multiplication_2)  # -> Vector, Length
line_4 = Line()
deconstruct_mesh = DeconstructMesh(Mesh=mesh)  # -> Vertices, Faces, Colours, Normals
number_slider_6 = Slider(25, range=0..100)
point_2 = Point(vector_xyz.Vector)
unit_vector = UnitVector(Vector=point_2)
multiplication_3 = Multiplication(A=number_slider_4, B=unit_vector)
multiplication_4 = Multiplication(A=negative_3, B=unit_vector)
addition_3 = Addition(A=addition_2, B=multiplication_3)
addition_4 = Addition(A=addition_2, B=multiplication_4)
merge_3 = Merge(Data1=number_slider_5, Data2=number_slider_5, Data3=number_slider_5)
value_list = ValueList({"x", "y"}, selected="x")
line_5 = Line(StartPoint=addition_3, EndPoint=addition_4)
number_slider_7 = Slider(10, range=0..100)
pipe = Pipe(Curve=line_5, Radius=Slider(7, range=0..10), Caps=2)
value_list_2 = ValueList({"x", "y"}, selected="x")
ghpython_script = GhPythonScript(
    pts=deconstruct_mesh.Vertices,
    direction=value_list,
    scales=merge_2,
    isoplane=Slider(60, range=-100..100),
    amplitude=Slider(60, range=-100..250),
    dir_b=Toggle(False),
    w=Slider(31.765, range=0..100))  # -> out, pts; inputs pts: list of Point3d, scales: list, dir_b: Boolean
# ---------- ghpython_script: Python ----------
import sys

sys.path.append("/Users/jonas/Documents/reps/rrreefs_coral_feet/grasshopper/patterns/")

import patterns as pat

reload(pat)

pts = pat.move_pts(pts, pat.uv_gyroid, direction, dir_b, isoplane, amplitude, w, scales)
# ---------- end ghpython_script ----------
merge_4 = Merge(Data1=number_slider_6, Data2=number_slider_6, Data3=number_slider_6)
ghpython_script_2 = GhPythonScript(
    pts=ghpython_script.pts,
    direction=value_list_2,
    scales=merge_3,
    isoplane=Slider(-60, range=-100..100),
    amplitude=Slider(10, range=-100..250),
    dir_b=Toggle(True),
    w=Slider(31.765, range=0..100))  # -> out, pts; inputs pts: list of Point3d, scales: list, dir_b: Boolean; same code as ghpython_script
merge_5 = Merge(Data1=number_slider_7, Data2=number_slider_7, Data3=number_slider_7)
value_list_3 = ValueList({"x", "y"}, selected="y")
panel = Panel(ghpython_script.out)
value_list_4 = ValueList({"x", "y"}, selected="y")
ghpython_script_3 = GhPythonScript(
    pts=ghpython_script_2.pts,
    direction=value_list_3,
    scales=merge_4,
    isoplane=Slider(60, range=-100..100),
    amplitude=Slider(15, range=-100..250),
    dir_b=Toggle(False),
    w=Slider(31.765, range=0..100))  # -> out, pts; inputs pts: list of Point3d, scales: list, dir_b: Boolean; same code as ghpython_script
ghpython_script_4 = GhPythonScript(
    pts=ghpython_script_3.pts,
    direction=value_list_4,
    scales=merge_5,
    isoplane=Slider(-60, range=-100..100),
    amplitude=Slider(15, range=-100..250),
    dir_b=Toggle(True),
    w=Slider(31.765, range=0..100))  # -> out, pts; inputs pts: list of Point3d, scales: list, dir_b: Boolean; same code as ghpython_script
construct_mesh = ConstructMesh(Vertices=ghpython_script_4.pts, Faces=deconstruct_mesh.Faces)
mesh_2 = Mesh(weaverbird_s_mesh_prism)
mesh_3 = Mesh(pipe)
weaverbird_s_catmull_clark_subdivision = WeaverbirdsCatmullClarkSubdivision(MeshCurves=construct_mesh, Level=1, SmoothNakedEdges=1)
mesh_4 = Mesh(construct_mesh)
flatten_tree = FlattenTree(Tree=mesh_3, Path="{0}")
mesh_difference = MeshDifference(MeshesA=weaverbird_s_catmull_clark_subdivision, MeshesB=flatten_tree)
