# Grasshopper definition union_diff.gh (Grasshopper 1.0.7)
# plug-ins: VoxelTools, Axolotl Info

number_slider = Slider(10, range=0.01..50)
division = Division(A=Slider(-50, range=-100..0), B=number_slider)
bbox = BoundingBox(Plane=PlaneXY(0, 0, 0))  # -> Box, Box_2
debox = DeconstructBox(Box=bbox.Box_2)  # -> Plane, X, Y, Z
dedomain = DeconstructDomain(Domain=debox.Y)  # -> Start, End
plane = Plane(Normal=Vector(0, 0, 1), Distance=0)
pt = Point(Point(0, 0, 0))
round = Round(Number=division)  # -> Nearest, Floor, Ceiling
number_slider_2 = Slider(0, range=0..100)
voxgeo = VoxelateGeometry(Distance=0)
division_2 = Division(A=Slider(7, range=0..10), B=2)
multiplication = Multiplication(A=number_slider, B=round.Floor)
dom = ConstructDomain(DomainStart=multiplication, DomainEnd=dedomain.End)
pt_2 = Point(Point(8.503171928, 6.554994746, 5.796682938))
number_slider_3 = Slider(50, range=0..1000)
voxelsize = Number(Slider(10, range=0.01..50))
vglist = VoxelGridToList()  # -> Bool, Pts
box = DomainBox(Base=debox.Plane, X=debox.X, Y=dom, Z=debox.Z)
voxcreate = CreateVoxelGrid(BoundingBox=box, SizeX=number_slider, SizeY=number_slider, SizeZ=number_slider)
voxgeo_2 = VoxelateGeometry(VoxelGrid=voxcreate, Distance=0)
box_2 = Box(DimensionX=8, DimensionY=7, DimensionZ=6, Radius=0, Plane=pt_2)
not = GateNot()
mesh = Mesh(voxgeo_2)
vglist_2 = VoxelGridToList(Grids=voxgeo_2)  # -> flatten(Bool), flatten(Pts)
number_slider_4 = Slider(100, range=0..100)
or = GateOr(A=vglist_2.Bool)
tpms = TPMS(Wavelength=number_slider_3)
tpms_spherical = TPMSS(Wavelength=number_slider_3, Azimuth=Slider(2, range=0..10), Inclination=Slider(0, range=0..10))
and = GateAnd(A=vglist_2.Bool, B=not)
bool = Boolean(True)
pt_3 = Point(vglist_2.Pts)
and_2 = GateAnd(A=bool, B=or)
and_3 = GateAnd(A=and_2)
evaluatepoints = EvaluatePoints(DistanceObject=tpms, Points=vglist_2.Pts)
neg = Negative(Value=number_slider_4)
vglist_3 = VoxelGridFromList(Grid=voxgeo_2, Bool=and_2)
smaller = SmallerThan(FirstNumber=evaluatepoints, SecondNumber=0)  # -> SmallerThan, OrEqualTo
xy = XYPlane(Origin=Point(0, 0, 0))
merge = Merge(Data1=number_slider_4, Data2=neg)
X = UnitX(Factor=merge)
mesh_2 = Mesh(vglist_3)
voxelsize_2 = Number(voxelsize)
pt_4 = Point(Point(0, 0, 0))
tpms_2 = TPMS(Wavelength=Slider(50, range=0..1000))

# ---- group: TotalPedistal
number_slider_5 = Slider(700, range=0..1000)
feet_mesh = Feet_mesh(
    body_thickness=Slider(150, range=0..1000),
    side_width=Slider(150, range=0..1000),
    body_width=Slider(300, range=0..1000),
    body_height=number_slider_5)  # -> R, B, M
Z = UnitZ(Factor=number_slider_5)
division_3 = Division(A=feet_mesh.R, B=2)

# ---- group: Double Circle
number_slider_6 = Slider(20, range=0..100)
interlock = Interlock(spacing=Slider(41, range=0..100), positive_radius=Slider(34, range=0..100), negative_radius=Slider(15, range=0..100))
thickness = Number(number_slider_5)
Z_2 = UnitZ(Factor=thickness)
extr = Extrude(Base=interlock, Direction=Z_2)
cap = CapHoles(Brep=extr)

# ---- group: Interface
X_2 = UnitX(Factor=division_3)
ellipse = Ellipse(Plane=pt, Radius1=Slider(20, range=0..100), Radius2=Slider(30, range=0..100))  # -> Ellipse, Focus1, Focus2
extr_2 = Extrude(Base=ellipse.Ellipse, Direction=Z)
cap_2 = CapHoles(Brep=extr_2)
brep = Brep(cap_2)

# ---- group: TotalPedistal (continued)
rotate = Rotate(Geometry=feet_mesh.B, Angle=3.141592654, Plane=X_2)  # -> Geometry, Transform
merge_2 = Merge(Data1=rotate.Geometry, Data2=feet_mesh.B)  # -> flatten(Result)

# ----
offset = OffsetCurve(Curve=interlock, Distance=division_2, Plane=PlaneXY(0, 0, 0), Corners=1)
extr_3 = Extrude(Base=offset, Direction=Z_2)
brep_2 = Brep(graft(merge_2))
cap_3 = CapHoles(Brep=extr_3)
mesh_3 = Mesh(feet_mesh.M)
move = Move(Geometry=X_2, Motion=X)  # -> Geometry, Transform
bbox_2 = BoundingBox(Content=merge_2, Plane=PlaneXY(0, 0, 0))  # -> Box, Box_2
merge_3 = Merge(Data1=X_2, Data2=move.Geometry)  # -> flatten(Result)
python = GhPythonScript(geoms=brep, plnA=xy, plnB=merge_3)  # -> out, geoms; inputs geoms: list of GeometryBase, plnA: Plane, plnB: Plane
# ---------- python: Python ----------
from Rhino.Geometry.Transform import PlaneToPlane

t_m = PlaneToPlane(plnA, plnB)
[geom.Transform(t_m) for geom in geoms]
# ---------- end python ----------
bbox_3 = Bbox(B=bbox_2.Box, voxelsize=voxelsize)
brep_3 = Brep(bbox_3)
geo = Geometry(python.geoms)
voxcreate_2 = CreateVoxelGrid(BoundingBox=bbox_3, SizeX=voxelsize_2, SizeY=voxelsize_2, SizeZ=voxelsize_2)
brepinc = PointInBrep(Brep=geo, Point=pt_4, Strict=False)
voxgeo_3 = VoxelateGeometry(Geometry=brep_2, VoxelGrid=voxcreate_2, Distance=0)
vglist_4 = VoxelGridToList(Grids=voxgeo_3)  # -> Bool, Pts
path_mapper = PathMapper(vglist_4.Pts, source="{A;B;C}", target="{B}")
path_mapper_2 = PathMapper(vglist_4.Bool, source="{A;B;C}", target="{B}")
bang = ExplodeTree(Data=path_mapper_2)  # -> Branch0, Branch1
bang_2 = ExplodeTree(Data=path_mapper)  # -> Branch0, Branch1
brepinc_2 = PointInBrep(Brep=geo, Point=bang_2.Branch1, Strict=False)
bang_3 = ExplodeTree(Data=brepinc_2)  # -> Branch0, Branch1, Branch2
or_2 = GateOr(A=bang_3.Branch0, B=bang_3.Branch1, C=bang_3.Branch2)
brepinc_3 = PointInBrep(Brep=geo, Point=bang_2.Branch1, Strict=False)  # disabled
not_2 = GateNot(A=or_2)
not_3 = GateNot(A=brepinc_3)
and_4 = GateAnd(A=bang.Branch0, B=not_3)
or_3 = GateOr(A=bang.Branch1, B=brepinc_3)
or_4 = GateOr(A=bang.Branch0, B=or_2)
and_5 = GateAnd(A=bang.Branch1, B=not_2)
and_6 = GateAnd(A=bang.Branch1, B=not_3)
entwine = Entwine(Branch00=and_4, Branch01=or_3, FlattenInputs=True)
entwine_2 = Entwine(Branch00=or_4, Branch01=and_5, FlattenInputs=True)
entwine_3 = Entwine(Branch00=and_4, Branch01=and_6, FlattenInputs=True)
vglist_5 = VoxelGridFromList(Grid=voxgeo_3, Bool=entwine)
vglist_6 = VoxelGridFromList(Grid=voxgeo_3, Bool=entwine_3)
evaluatepoints_2 = EvaluatePoints(DistanceObject=tpms_2, Points=bang_2.Branch1)
mesh_4 = Mesh(vglist_5)
mesh_5 = Mesh(vglist_6)
smaller_2 = SmallerThan(FirstNumber=evaluatepoints_2, SecondNumber=0)  # -> SmallerThan, OrEqualTo
and_7 = GateAnd(A=smaller_2.OrEqualTo, B=entwine_2)
vglist_7 = VoxelGridFromList(Grid=voxgeo_3, Bool=and_7)
mesh_6 = Mesh(vglist_7)
preview = CustomPreview(
    Geometry=mesh_4,
    Material={diffuse=RGB(221, 160, 221), emission=RGB(66, 48, 66), shine=0.5, specular=RGB(255, 255, 255), transparency=0})
preview_2 = CustomPreview(
    Geometry=mesh_5,
    Material={diffuse=RGB(221, 160, 221), emission=RGB(66, 48, 66), shine=0.5, specular=RGB(255, 255, 255), transparency=0})
preview_3 = CustomPreview(
    Geometry=mesh_6,
    Material={diffuse=RGB(221, 160, 221), emission=RGB(66, 48, 66), shine=0.5, specular=RGB(255, 255, 255), transparency=0})

# ==== cluster Interlock
spacing = ClusterInput()
positive_radius = ClusterInput()
negative_radius = ClusterInput()
negative_radius_2 = Number(negative_radius)
positive_radius_2 = Number(positive_radius)
spacing_2 = Number(spacing)
neg = Negative(Value=spacing_2)
Y = UnitY(Factor=spacing_2)
Y_2 = UnitY(Factor=neg)
addition = Addition(A=positive_radius_2, B=negative_radius_2)
circle = CircleCNR(Center=Y, Normal=Vector(0, 0, 1), Radius=positive_radius_2)
circle_2 = CircleCNR(Center=Y_2, Normal=Vector(0, 0, 1), Radius=positive_radius_2)
circle_3 = CircleCNR(Center=Y, Normal=Vector(0, 0, 1), Radius=addition)
circle_4 = CircleCNR(Center=Y_2, Normal=Vector(0, 0, 1), Radius=addition)
ccx = CurveCurve(CurveA=circle_3, CurveB=circle_4)  # -> Points, ParamsA, ParamsB
merge = Merge(Data1=circle, Data2=circle_2)  # -> graft(Result)
circle_5 = CircleCNR(Center=ccx.Points, Normal=Vector(0, 0, 1), Radius=negative_radius_2)
ccx_2 = CurveCurve(CurveA=merge, CurveB=circle_5)  # -> Points, ParamsA, ParamsB
path_mapper = PathMapper(ccx_2.ParamsB, source="{A;B;C}", target="{C}")
sort = SortList(Keys=path_mapper)  # -> Keys, ValuesA
path_mapper_2 = PathMapper(ccx_2.ParamsA, source="{A;B;C}", target="{B}")
shatter = Shatter(Curve=graft(circle_5), Parameters=sort.Keys)
panel = Panel(ccx_2.ParamsB)
shatter_2 = Shatter(Curve=merge, Parameters=path_mapper_2)
pt = Point(Point(0, 0, 0))
crv = Curve(shatter_2)
crv_2 = Curve(shatter)
crvmidpt = CurveMiddlePoint(Curve=crv, EvaluationType=False)  # -> Middle, Tangent, Parameter, Length
crvmidpt_2 = CurveMiddlePoint(Curve=crv_2, EvaluationType=False)  # -> Middle, Tangent, Parameter, Length
dist = Distance(PointA=crvmidpt.Middle, PointB=pt)
dist_2 = Distance(PointA=crvmidpt_2.Middle, PointB=pt)
sort_2 = SortList(Keys=dist)  # -> Keys, ValuesA
sort_3 = SortList(Keys=dist_2)  # -> Keys, ValuesA
panel_2 = Panel(dist)
item = ListItem(List=sort_2.Keys, Index=0, Wrap=True)
item_2 = ListItem(List=sort_3.Keys, Index=0, Wrap=True)
equals = Equality(FirstNumber=dist_2, SecondNumber=item_2)  # -> Equality, Inequality
equals_2 = Equality(FirstNumber=dist, SecondNumber=item)  # -> Equality, Inequality
panel_3 = Panel(equals_2.Equality)
item_3 = ListItem(List=equals_2.Equality, Index=0, Wrap=True)
item_4 = ListItem(List=equals.Equality, Index=1, Wrap=True)
item_5 = ListItem(List=crv, Index=item_3, Wrap=True)
item_6 = ListItem(List=crv_2, Index=item_4, Wrap=True)
merge_2 = Merge(Data1=item_5, Data2=item_6)  # -> flatten(Result)
join = JoinCurves(Curves=merge_2, Preserve=False)
C = ClusterOutput(join)

# ==== cluster Feet_mesh
body_thickness = ClusterInput()
side_width = ClusterInput()
body_height = ClusterInput()
body_width = ClusterInput()
body_thickness_2 = Number(body_thickness)
side_width_2 = Number(side_width)
body_height_2 = Number(body_height)
body_width_2 = Number(body_width)
multiplication = Multiplication(A=side_width_2, B=2)
addition = Addition(A=side_width_2, B=body_width_2)
addition_2 = Addition(A=body_thickness_2, B=side_width_2)
addition_3 = Addition(A=multiplication, B=body_width_2)
dom = ConstructDomain(DomainStart=side_width_2, DomainEnd=addition)
Z = UnitZ(Factor=side_width_2)
Z_2 = UnitZ(Factor=body_height_2)
R = ClusterOutput(addition_3)
rectangle = Rectangle(Plane=PlaneXY(0, 0, 0), XSize=addition_3, YSize=addition_2, Radius=0)  # -> Rectangle, Length
rectangle_2 = Rectangle(Plane=PlaneXY(0, 0, 0), XSize=dom, YSize=body_thickness_2, Radius=0)  # -> Rectangle, Length
move = Move(Geometry=rectangle_2.Rectangle, Motion=Z)  # -> Geometry, Transform
move_2 = Move(Geometry=rectangle_2.Rectangle, Motion=Z_2)  # -> Geometry, Transform
divide = DivideCurve(Curve=rectangle.Rectangle, Count=1, Kinks=True)  # -> Points, Tangents, Parameters
divide_2 = DivideCurve(Curve=move.Geometry, Count=1, Kinks=True)  # -> Points, Tangents, Parameters
divide_3 = DivideCurve(Curve=move_2.Geometry, Count=1, Kinks=True)  # -> Points, Tangents, Parameters
merge = Merge(Data1=divide.Points, Data2=divide_2.Points, Data3=divide_3.Points)
merge_2 = Merge(Data1=rectangle.Rectangle, Data2=move.Geometry, Data3=move_2.Geometry)
loft = Loft(Curves=merge_2, Options={Adjust=False, Closed=False, LoftEnds=0, LoftSimp=0, LoftType=3, Rebuild=10, Refit=0.01})
python = GhPythonScript(x=merge)  # -> out, msh; inputs x: list of Point3d
# ---------- python: Python ----------
from Rhino.Geometry import Mesh

msh = Mesh()
[msh.Vertices.Add(pt) for pt in x]

for i in range(4):
    msh.Faces.AddFace(i, (i+1) % 4, 4 + (i+1) % 4, 4 + i)
    msh.Faces.AddFace(4 + i, 4 + (i+1) % 4, 8 + (i+1) % 4, 8 + i)

a, b, c, d = tuple(range(4))
msh.Faces.AddFace(d, c, b, a)
msh.Faces.AddFace(8+a, 8+b, 8+c, 8+d)
# ---------- end python ----------
cap = CapHoles(Brep=loft)
unifynormals = MeshUnifyNormals(Mesh=python.msh)
B = ClusterOutput(cap)
M = ClusterOutput(unifynormals)

# ==== cluster Bbox
B = ClusterInput()
voxelsize = ClusterInput()
debox = DeconstructBox(Box=B)  # -> Plane, X, Y, Z
voxelsize_2 = Number(voxelsize)
cluster = Cluster(I=debox.X, voxelsize=voxelsize_2)
cluster_2 = Cluster(I=debox.Z, voxelsize=voxelsize_2)
cluster_3 = Cluster(I=debox.Y, voxelsize=voxelsize_2)
box = DomainBox(Base=PlaneXY(0, 0, 0), X=cluster, Y=cluster_3, Z=cluster_2)
B_2 = ClusterOutput(box)

# ==== cluster Cluster
I = ClusterInput()
voxelsize = ClusterInput()
dedomain = DeconstructDomain(Domain=I)  # -> Start, End
voxelsize_2 = Number(voxelsize)
sort = SortList(Keys=dedomain.Start)  # -> Keys, ValuesA
sort_2 = SortList(Keys=dedomain.End)  # -> Keys, ValuesA
item = ListItem(List=sort.Keys, Index=0, Wrap=True)
item_2 = ListItem(List=sort_2.Keys, Index=-1, Wrap=True)
division = Division(A=item, B=voxelsize_2)
division_2 = Division(A=item_2, B=voxelsize_2)
round = Round(Number=division)  # -> Nearest, Floor, Ceiling
round_2 = Round(Number=division_2)  # -> Nearest, Floor, Ceiling
multiplication = Multiplication(A=round.Floor, B=voxelsize_2)
multiplication_2 = Multiplication(A=round_2.Ceiling, B=voxelsize_2)
dom = ConstructDomain(DomainStart=multiplication, DomainEnd=multiplication_2)
I_2 = ClusterOutput(dom)
