# Grasshopper definition union_diff_positive_negative.gh (Grasshopper 1.0.7)
# plug-ins: Pufferfish, VoxelTools, Axolotl Info

number_slider = Slider(10, range=-10..10)
number_slider_2 = Slider(50, range=0..100)
neg = Negative(Value=number_slider)
addition = Addition(A=number_slider, B=number_slider_2)
addition_2 = Addition(A=neg, B=number_slider_2)
dom = ConstructDomain(DomainStart=neg, DomainEnd=number_slider)
dom_2 = ConstructDomain(DomainStart=Slider(0, range=0..100), DomainEnd=addition)
dom_3 = ConstructDomain(DomainStart=number_slider, DomainEnd=number_slider_2)
dom_4 = ConstructDomain(DomainStart=addition_2, DomainEnd=addition)
box = DomainBox(Base=PlaneXY(0, 0, 0), X=dom, Y=dom, Z=dom_2)
box_2 = DomainBox(Base=PlaneXY(0, 0, 0), X=dom_3, Y=dom, Z=dom_4)
number_slider_3 = Slider(10, range=0.01..50)
division = Division(A=Slider(-50, range=-100..0), B=number_slider_3)
merge = Merge(Data1=box, Data2=box_2)
bbox = BoundingBox(Plane=PlaneXY(0, 0, 0))  # -> Box, Box_2
debox = DeconstructBox(Box=bbox.Box_2)  # -> Plane, X, Y, Z
dedomain = DeconstructDomain(Domain=debox.Y)  # -> Start, End
neg_2 = Negative(Value=number_slider_2)
plane = Plane(Normal=Vector(0, 0, 1), Distance=0)
pt = Point(Point(0, 0, 0))
round = Round(Number=division)  # -> Nearest, Floor, Ceiling
X = UnitX(Factor=neg_2)
sunion = SolidUnion(Breps=merge)
number_slider_4 = Slider(0, range=0..100)
voxgeo = VoxelateGeometry(Distance=0)
division_2 = Division(A=Slider(7, range=0..10), B=2)
multiplication = Multiplication(A=number_slider_3, B=round.Floor)
dom_5 = ConstructDomain(DomainStart=multiplication, DomainEnd=dedomain.End)
pt_2 = Point(Point(8.503171928, 6.554994746, 5.796682938))
number_slider_5 = Slider(50, range=0..1000)
move = Move(Geometry=sunion, Motion=X)  # -> Geometry, Transform
rotate = Rotate(Geometry=move.Geometry, Angle=[1.570796327, -1.570796327], Plane=PlaneXY(0, 0, 0))  # -> Geometry, Transform
voxelsize = Number(Slider(10, range=0.01..50))
vglist = VoxelGridToList()  # -> Bool, Pts
box_3 = DomainBox(Base=debox.Plane, X=debox.X, Y=dom_5, Z=debox.Z)
voxcreate = CreateVoxelGrid(BoundingBox=box_3, SizeX=number_slider_3, SizeY=number_slider_3, SizeZ=number_slider_3)
number_slider_6 = Slider(100, range=0..100)
voxgeo_2 = VoxelateGeometry(VoxelGrid=voxcreate, Distance=0)
box_4 = Box(DimensionX=8, DimensionY=7, DimensionZ=6, Radius=0, Plane=pt_2)
not = GateNot()
sunion_2 = SolidUnion(Breps=rotate.Geometry)
mesh = Mesh(voxgeo_2)
vglist_2 = VoxelGridToList(Grids=voxgeo_2)  # -> flatten(Bool), flatten(Pts)
or = GateOr(A=vglist_2.Bool)
neg_3 = Negative(Value=number_slider_6)
tpms = TPMS(Wavelength=number_slider_5)
tpms_spherical = TPMSS(Wavelength=number_slider_5, Azimuth=Slider(2, range=0..10), Inclination=Slider(0, range=0..10))
and = GateAnd(A=vglist_2.Bool, B=not)
bool = Boolean(True)
pt_3 = Point(vglist_2.Pts)
and_2 = GateAnd(A=bool, B=or)
merge_2 = Merge(Data1=number_slider_6, Data2=neg_3)
and_3 = GateAnd(A=and_2)
evaluatepoints = EvaluatePoints(DistanceObject=tpms, Points=vglist_2.Pts)
X_2 = UnitX(Factor=merge_2)
yz = YZPlane(Origin=Point(0, 0, 0))
vglist_3 = VoxelGridFromList(Grid=voxgeo_2, Bool=and_2)
smaller = SmallerThan(FirstNumber=evaluatepoints, SecondNumber=0)  # -> SmallerThan, OrEqualTo
merge_3 = Merge(Data1=Slider(250, range=0..1000), Data2=Slider(500, range=0..1000))
xy = XYPlane(Origin=Point(0, 0, 0))
Z = UnitZ(Factor=merge_3)  # -> graft(UnitVector)
mesh_2 = Mesh(vglist_3)
voxelsize_2 = Number(voxelsize)
pt_4 = Point(Point(0, 0, 0))
tpms_2 = TPMS(Wavelength=Slider(50, range=0..1000))

# ---- group: TotalPedistal
number_slider_7 = Slider(300, range=0..1000)
number_slider_8 = Slider(700, range=0..1000)
feet_mesh = Feet_mesh(
    body_thickness=Slider(150, range=0..1000),
    side_width=Slider(150, range=0..1000),
    body_width=number_slider_7,
    body_height=number_slider_8)  # -> R, B, M
Z_2 = UnitZ(Factor=number_slider_8)
division_3 = Division(A=feet_mesh.R, B=2)

# ---- group: Double Circle
number_slider_9 = Slider(50, range=0..100)
interlock = Interlock(spacing=Slider(41, range=0..100), positive_radius=Slider(34, range=0..100), negative_radius=Slider(15, range=0..100))
thickness = Number(number_slider_8)
Z_3 = UnitZ(Factor=thickness)
extr = Extrude(Base=interlock, Direction=Z_3)
cap = CapHoles(Brep=extr)

# ---- group: Interface
X_3 = UnitX(Factor=division_3)
ellipse = Ellipse(Plane=pt, Radius1=Slider(20, range=0..100), Radius2=Slider(30, range=0..100))  # -> Ellipse, Focus1, Focus2
extr_2 = Extrude(Base=ellipse.Ellipse, Direction=Z_2)
cap_2 = CapHoles(Brep=extr_2)
brep = Brep(cap_2)

# ----
thickness_2 = Number(number_slider_9)

# ---- group: TotalPedistal (continued)
rotate_2 = Rotate(Geometry=feet_mesh.B, Angle=3.141592654, Plane=X_3)  # -> Geometry, Transform
merge_4 = Merge(Data1=rotate_2.Geometry, Data2=feet_mesh.B)  # -> flatten(Result)

# ----
offset = OffsetCurve(Curve=interlock, Distance=division_2, Plane=PlaneXY(0, 0, 0), Corners=1)
Z_4 = UnitZ(Factor=thickness_2)
division_4 = Division(A=number_slider_7, B=2)
extr_3 = Extrude(Base=interlock, Direction=Z_4)
extr_4 = Extrude(Base=offset, Direction=Z_3)
brep_2 = Brep(graft(merge_4))
cap_3 = CapHoles(Brep=extr_4)
Z_5 = UnitZ(Factor=number_slider_8)
cap_4 = CapHoles(Brep=extr_3)
X_4 = UnitX(Factor=division_4)
mesh_3 = Mesh(feet_mesh.M)
move_2 = Move(Geometry=X_3, Motion=Z_5)  # -> Geometry, Transform
move_3 = Move(Geometry=X_3, Motion=X_2)  # -> Geometry, Transform
addition_3 = Addition(A=X_3, B=X_4)
bbox_2 = BoundingBox(Content=merge_4, Plane=PlaneXY(0, 0, 0))  # -> Box, Box_2
xy_2 = XYPlane(Origin=move_2.Geometry)
merge_5 = Merge(Data1=X_3, Data2=move_3.Geometry)  # -> flatten(Result)
python = GhPythonScript(geoms=cap, plnA=xy, plnB=X_3)  # -> out, geoms; inputs geoms: list of GeometryBase, plnA: Plane, plnB: Plane
# ---------- python: Python ----------
from Rhino.Geometry.Transform import PlaneToPlane

t_m = PlaneToPlane(plnA, plnB)
[geom.Transform(t_m) for geom in geoms]
# ---------- end python ----------
move_4 = Move(Geometry=yz, Motion=addition_3)  # -> Geometry, Transform
rotate_3 = Rotate(Geometry=xy_2, Angle=1.570796327, Plane=move_2.Geometry)  # -> Geometry, Transform
bbox_3 = Bbox(B=bbox_2.Box, voxelsize=voxelsize)
brep_3 = Brep(bbox_3)
python_2 = GhPythonScript(geoms=brep, plnA=xy, plnB=merge_5)  # -> out, geoms; inputs geoms: list of GeometryBase, plnA: Plane, plnB: Plane; same code as python
rotate_4 = Rotate(Geometry=move_4.Geometry, Angle=3.141592654, Plane=X_3)  # -> Geometry, Transform
merge_6 = Merge(Data1=rotate_4.Geometry, Data2=move_4.Geometry)
voxcreate_2 = CreateVoxelGrid(BoundingBox=bbox_3, SizeX=voxelsize_2, SizeY=voxelsize_2, SizeZ=voxelsize_2)
geo = Geometry(python_2.geoms)
move_5 = Move(Geometry=merge_6, Motion=Z)  # -> Geometry, Transform
merge_7 = Merge(Data1=rotate_3.Geometry, Data2=move_5.Geometry)  # -> flatten(Result)
flippln = FlipPlane(Plane=merge_7, FlipX=False, FlipY=False, FlipZ=True)  # -> Flipped, R
python_3 = GhPythonScript(geoms=sunion_2, plnA=xy, plnB=flippln.Flipped)  # -> out, geoms; inputs geoms: list of GeometryBase, plnA: Plane, plnB: Plane; same code as python
python_4 = GhPythonScript(geoms=cap_4, plnA=xy, plnB=flippln.Flipped)  # -> out, geoms; inputs geoms: list of GeometryBase, plnA: Plane, plnB: Plane; same code as python
brepinc = PointInBrep(Brep=geo, Point=pt_4, Strict=False)
voxgeo_3 = VoxelateGeometry(Geometry=brep_2, VoxelGrid=voxcreate_2, Distance=0)
flatten = FlattenTree(Tree=geo, Path="{0}")
vglist_4 = VoxelGridToList(Grids=voxgeo_3)  # -> Bool, Pts
vglist_5 = VoxelGridToList(Grids=voxgeo_3)  # -> Bool, Pts
item = ListItem(List=flatten, Index=0, Wrap=True)  # -> Item, Item1, Item2
path_mapper = PathMapper(vglist_4.Pts, source="{A;B;C}", target="{B}")
path_mapper_2 = PathMapper(vglist_4.Bool, source="{A;B;C}", target="{B}")
path_mapper_3 = PathMapper(vglist_5.Pts, source="{A;B;C}", target="{B}")
path_mapper_4 = PathMapper(vglist_5.Bool, source="{A;B;C}", target="{B}")
merge_8 = Merge(Data1=item.Item1, Data2=item.Item2)  # -> graft(Result)
bang = ExplodeTree(Data=path_mapper_2)  # -> Branch0, Branch1
bang_2 = ExplodeTree(Data=path_mapper)  # -> Branch0, Branch1
bang_3 = ExplodeTree(Data=path_mapper_4)  # -> Branch0, Branch1
bang_4 = ExplodeTree(Data=path_mapper_3)  # -> Branch0, Branch1
brepinc_2 = PointInBrep(Brep=merge_8, Point=bang_4.Branch1, Strict=False)
bang_5 = ExplodeTree(Data=brepinc_2)  # -> Branch0, Branch1, Branch2
brepinc_3 = PointInBrep(Brep=python.geoms, Point=bang_2.Branch1, Strict=False)
or_2 = GateOr(A=bang_5.Branch0, B=bang_5.Branch1, C=bang_5.Branch2)
not_2 = GateNot(A=brepinc_3)
and_4 = GateAnd(A=bang.Branch0, B=not_2)
or_3 = GateOr(A=bang.Branch1, B=brepinc_3)
not_3 = GateNot(A=or_2)
entwine = Entwine(Branch00=and_4, Branch01=or_3, FlattenInputs=True)
or_4 = GateOr(A=bang_3.Branch0, B=or_2)
and_5 = GateAnd(A=bang_3.Branch1, B=not_3)
vglist_6 = VoxelGridFromList(Grid=voxgeo_3, Bool=entwine)
entwine_2 = Entwine(Branch00=or_4, Branch01=and_5, FlattenInputs=True)
mesh_4 = Mesh(vglist_6)
vglist_7 = VoxelGridFromList(Grid=voxgeo_3, Bool=entwine_2)
vglist_8 = VoxelGridToList(Grids=vglist_7)  # -> Bool, Pts
path_mapper_5 = PathMapper(vglist_8.Pts, source="{A;B;C}", target="{B}")
path_mapper_6 = PathMapper(vglist_8.Bool, source="{A;B;C}", target="{B}")
bang_6 = ExplodeTree(Data=path_mapper_6)  # -> Branch0, Branch1
bang_7 = ExplodeTree(Data=path_mapper_5)  # -> Branch0, Branch1
brepinc_4 = PointInBrep(Brep=geo, Point=bang_7.Branch1, Strict=False)
brepinc_5 = PointInBrep(Brep=python_3.geoms, Point=bang_7.Branch1, Strict=False)
bang_8 = ExplodeTree(Data=brepinc_4)  # -> Branch0, Branch1, Branch2
bang_9 = ExplodeTree(Data=brepinc_5)  # -> Branch0, Branch1, Branch2, Branch3, Branch4
brepinc_6 = PointInBrep(Brep=python.geoms, Point=bang_7.Branch1, Strict=False)
or_5 = GateOr(A=bang_8.Branch0, B=bang_8.Branch1, C=bang_8.Branch2)
not_4 = GateNot(A=brepinc_6)
or_6 = GateOr(A=bang_9.Branch0, B=bang_9.Branch1, C=bang_9.Branch2, D=bang_9.Branch3, E=bang_9.Branch4)
and_6 = GateAnd(A=bang_6.Branch0, B=not_4)
or_7 = GateOr(A=bang_6.Branch1, B=brepinc_6)
not_5 = GateNot(A=or_5)
and_7 = GateAnd(A=bang_6.Branch1, B=not_4)
not_6 = GateNot(A=or_6)
entwine_3 = Entwine(Branch00=and_6, Branch01=or_7, FlattenInputs=True)
or_8 = GateOr(A=bang_6.Branch0, B=or_5)
and_8 = GateAnd(A=bang_6.Branch1, B=not_5)
entwine_4 = Entwine(Branch00=and_6, Branch01=and_7, FlattenInputs=True)
and_9 = GateAnd(A=bang_6.Branch0, B=not_6)
and_10 = GateAnd(A=bang_6.Branch1, B=not_6)
vglist_9 = VoxelGridFromList(Grid=voxgeo_3, Bool=entwine_3)
entwine_5 = Entwine(Branch00=or_8, Branch01=and_8, FlattenInputs=True)
evaluatepoints_2 = EvaluatePoints(DistanceObject=tpms_2, Points=bang_7.Branch1)
entwine_6 = Entwine(Branch00=and_9, Branch01=and_10, FlattenInputs=True)
mesh_5 = Mesh(vglist_9)
smaller_2 = SmallerThan(FirstNumber=evaluatepoints_2, SecondNumber=0)  # -> SmallerThan, OrEqualTo
and_11 = GateAnd(A=smaller_2.OrEqualTo, B=entwine_4)
vglist_10 = VoxelGridFromList(Grid=voxgeo_3, Bool=and_11)
and_12 = GateAnd(A=smaller_2.OrEqualTo, B=entwine_5)
and_13 = GateAnd(A=smaller_2.OrEqualTo, B=entwine_6)
mesh_6 = Mesh(vglist_10)
vglist_11 = VoxelGridFromList(Grid=voxgeo_3, Bool=and_12)
vglist_12 = VoxelGridFromList(Grid=voxgeo_3, Bool=entwine_6)
mesh_7 = Mesh(vglist_11)
mesh_8 = Mesh(vglist_12)
mesh_9 = Mesh(vglist_7)

# ==== cluster Interlock
spacing = ClusterInput()
positive_radius = ClusterInput()
negative_radius = ClusterInput()
negative_radius_2 = Number(negative_radius)
positive_radius_2 = Number(positive_radius)
spacing_2 = Number(spacing)
neg = Negative(Value=spacing_2)
Y = UnitY(Factor=spacing_2)
Y_2 = UnitY(Factor=neg)
addition = Addition(A=positive_radius_2, B=negative_radius_2)
circle = CircleCNR(Center=Y, Normal=Vector(0, 0, 1), Radius=positive_radius_2)
circle_2 = CircleCNR(Center=Y_2, Normal=Vector(0, 0, 1), Radius=positive_radius_2)
circle_3 = CircleCNR(Center=Y, Normal=Vector(0, 0, 1), Radius=addition)
circle_4 = CircleCNR(Center=Y_2, Normal=Vector(0, 0, 1), Radius=addition)
ccx = CurveCurve(CurveA=circle_3, CurveB=circle_4)  # -> Points, ParamsA, ParamsB
merge = Merge(Data1=circle, Data2=circle_2)  # -> graft(Result)
circle_5 = CircleCNR(Center=ccx.Points, Normal=Vector(0, 0, 1), Radius=negative_radius_2)
ccx_2 = CurveCurve(CurveA=merge, CurveB=circle_5)  # -> Points, ParamsA, ParamsB
path_mapper = PathMapper(ccx_2.ParamsB, source="{A;B;C}", target="{C}")
sort = SortList(Keys=path_mapper)  # -> Keys, ValuesA
path_mapper_2 = PathMapper(ccx_2.ParamsA, source="{A;B;C}", target="{B}")
shatter = Shatter(Curve=graft(circle_5), Parameters=sort.Keys)
panel = Panel(ccx_2.ParamsB)
shatter_2 = Shatter(Curve=merge, Parameters=path_mapper_2)
pt = Point(Point(0, 0, 0))
crv = Curve(shatter_2)
crv_2 = Curve(shatter)
crvmidpt = CurveMiddlePoint(Curve=crv, EvaluationType=False)  # -> Middle, Tangent, Parameter, Length
crvmidpt_2 = CurveMiddlePoint(Curve=crv_2, EvaluationType=False)  # -> Middle, Tangent, Parameter, Length
dist = Distance(PointA=crvmidpt.Middle, PointB=pt)
dist_2 = Distance(PointA=crvmidpt_2.Middle, PointB=pt)
sort_2 = SortList(Keys=dist)  # -> Keys, ValuesA
sort_3 = SortList(Keys=dist_2)  # -> Keys, ValuesA
panel_2 = Panel(dist)
item = ListItem(List=sort_2.Keys, Index=0, Wrap=True)
item_2 = ListItem(List=sort_3.Keys, Index=0, Wrap=True)
equals = Equality(FirstNumber=dist_2, SecondNumber=item_2)  # -> Equality, Inequality
equals_2 = Equality(FirstNumber=dist, SecondNumber=item)  # -> Equality, Inequality
panel_3 = Panel(equals_2.Equality)
item_3 = ListItem(List=equals_2.Equality, Index=0, Wrap=True)
item_4 = ListItem(List=equals.Equality, Index=1, Wrap=True)
item_5 = ListItem(List=crv, Index=item_3, Wrap=True)
item_6 = ListItem(List=crv_2, Index=item_4, Wrap=True)
merge_2 = Merge(Data1=item_5, Data2=item_6)  # -> flatten(Result)
join = JoinCurves(Curves=merge_2, Preserve=False)
C = ClusterOutput(join)

# ==== cluster Feet_mesh
body_thickness = ClusterInput()
side_width = ClusterInput()
body_height = ClusterInput()
body_width = ClusterInput()
body_thickness_2 = Number(body_thickness)
side_width_2 = Number(side_width)
body_height_2 = Number(body_height)
body_width_2 = Number(body_width)
multiplication = Multiplication(A=side_width_2, B=2)
addition = Addition(A=side_width_2, B=body_width_2)
addition_2 = Addition(A=body_thickness_2, B=side_width_2)
addition_3 = Addition(A=multiplication, B=body_width_2)
dom = ConstructDomain(DomainStart=side_width_2, DomainEnd=addition)
Z = UnitZ(Factor=side_width_2)
Z_2 = UnitZ(Factor=body_height_2)
R = ClusterOutput(addition_3)
rectangle = Rectangle(Plane=PlaneXY(0, 0, 0), XSize=addition_3, YSize=addition_2, Radius=0)  # -> Rectangle, Length
rectangle_2 = Rectangle(Plane=PlaneXY(0, 0, 0), XSize=dom, YSize=body_thickness_2, Radius=0)  # -> Rectangle, Length
move = Move(Geometry=rectangle_2.Rectangle, Motion=Z)  # -> Geometry, Transform
move_2 = Move(Geometry=rectangle_2.Rectangle, Motion=Z_2)  # -> Geometry, Transform
divide = DivideCurve(Curve=rectangle.Rectangle, Count=1, Kinks=True)  # -> Points, Tangents, Parameters
divide_2 = DivideCurve(Curve=move.Geometry, Count=1, Kinks=True)  # -> Points, Tangents, Parameters
divide_3 = DivideCurve(Curve=move_2.Geometry, Count=1, Kinks=True)  # -> Points, Tangents, Parameters
merge = Merge(Data1=divide.Points, Data2=divide_2.Points, Data3=divide_3.Points)
merge_2 = Merge(Data1=rectangle.Rectangle, Data2=move.Geometry, Data3=move_2.Geometry)
loft = Loft(Curves=merge_2, Options={Adjust=False, Closed=False, LoftEnds=0, LoftSimp=0, LoftType=3, Rebuild=10, Refit=0.01})
python = GhPythonScript(x=merge)  # -> out, msh; inputs x: list of Point3d
# ---------- python: Python ----------
from Rhino.Geometry import Mesh

msh = Mesh()
[msh.Vertices.Add(pt) for pt in x]

for i in range(4):
    msh.Faces.AddFace(i, (i+1) % 4, 4 + (i+1) % 4, 4 + i)
    msh.Faces.AddFace(4 + i, 4 + (i+1) % 4, 8 + (i+1) % 4, 8 + i)

a, b, c, d = tuple(range(4))
msh.Faces.AddFace(d, c, b, a)
msh.Faces.AddFace(8+a, 8+b, 8+c, 8+d)
# ---------- end python ----------
cap = CapHoles(Brep=loft)
unifynormals = MeshUnifyNormals(Mesh=python.msh)
B = ClusterOutput(cap)
M = ClusterOutput(unifynormals)

# ==== cluster Bbox
B = ClusterInput()
voxelsize = ClusterInput()
debox = DeconstructBox(Box=B)  # -> Plane, X, Y, Z
voxelsize_2 = Number(voxelsize)
cluster = Cluster(I=debox.X, voxelsize=voxelsize_2)
cluster_2 = Cluster(I=debox.Z, voxelsize=voxelsize_2)
cluster_3 = Cluster(I=debox.Y, voxelsize=voxelsize_2)
box = DomainBox(Base=PlaneXY(0, 0, 0), X=cluster, Y=cluster_3, Z=cluster_2)
B_2 = ClusterOutput(box)

# ==== cluster Cluster
I = ClusterInput()
voxelsize = ClusterInput()
dedomain = DeconstructDomain(Domain=I)  # -> Start, End
voxelsize_2 = Number(voxelsize)
sort = SortList(Keys=dedomain.Start)  # -> Keys, ValuesA
sort_2 = SortList(Keys=dedomain.End)  # -> Keys, ValuesA
item = ListItem(List=sort.Keys, Index=0, Wrap=True)
item_2 = ListItem(List=sort_2.Keys, Index=-1, Wrap=True)
division = Division(A=item, B=voxelsize_2)
division_2 = Division(A=item_2, B=voxelsize_2)
round = Round(Number=division)  # -> Nearest, Floor, Ceiling
round_2 = Round(Number=division_2)  # -> Nearest, Floor, Ceiling
multiplication = Multiplication(A=round.Floor, B=voxelsize_2)
multiplication_2 = Multiplication(A=round_2.Ceiling, B=voxelsize_2)
dom = ConstructDomain(DomainStart=multiplication, DomainEnd=multiplication_2)
I_2 = ClusterOutput(dom)
