# Grasshopper definition design_a_iteration_2.gh (Grasshopper 1.0.7)
# plug-ins: Axolotl Info, VoxelTools, Weaverbird

number_slider = Slider(65, range=0..100)
number_slider_2 = Slider(2, range=0..10)
number_slider_3 = Slider(20, range=0..100)
number_slider_4 = Slider(35, range=0..100)
number_slider_5 = Slider(15, range=0..100)
number_slider_6 = Slider(12.5, range=0..100)
mesh = Mesh(<mesh referenced from the Rhino model>)
negative = Negative(Value=number_slider)
brep = Brep([<brep referenced from the Rhino model> x2])
brep_2 = Brep([<brep referenced from the Rhino model> x2])
bounding_box = BoundingBox(Content=mesh, Plane=PlaneXY(0, 0, 0))  # -> Box, Box_2
number_slider_7 = Slider(15, range=0..100)
construct_domain = ConstructDomain(DomainStart=negative, DomainEnd=number_slider)
number_slider_8 = Slider(10, range=0..10)
bounding_box_2 = BoundingBox(Content=brep, Plane=PlaneXY(0, 0, 0))  # -> Box, Box_2
bounding_box_3 = BoundingBox(Content=brep_2, Plane=PlaneXY(0, 0, 0))  # -> Box, Box_2
number_slider_9 = Slider(120, range=0..250)  # disabled
ghpython_script = GhPythonScript(r0=number_slider_6, h1=number_slider_4, r1=number_slider_5, w=number_slider_3)  # -> out, pts
# ---------- ghpython_script: Python ----------
from Rhino.Geometry import Point3d

delta=((r0+r1)**2.-(h1-r0)**2.)**.5
    
pts=[
    Point3d(-w*.5-delta, r0,0),
    Point3d(-w*.5, h1,0),
]

pts_2=[Point3d(-pt.X, pt.Y, 0) for pt in pts[::-1]]

pts+=pts_2
# ---------- end ghpython_script ----------
ghpython_script_2 = GhPythonScript(r0=number_slider_6, h1=number_slider_4, r1=number_slider_5, w=number_slider_3)  # -> out, pts, pts_a
# ---------- ghpython_script_2: Python ----------
from Rhino.Geometry import Point3d, Vector3d, Arc

delta=((r0+r1)**2.-(h1-r0)**2.)**.5
    
pts=[
    Point3d(-w*.5-delta, r0,0),
    Point3d(-w*.5, h1,0),
]

pt_b=Point3d(-w*.5-delta, 0.,0.)
dir_v=Vector3d(pts[1]-pts[0])
pt_c=Point3d(-w*.5, h1+r1,0.),
v_2=Vector3d((Vector3d(pt_b-pts[0])+dir_v)*.5)
v_3=Vector3d((Vector3d(0, r1, 0)-dir_v)*.5)
dir_v.Unitize()
v_2.Unitize()
v_3.Unitize()

pts_a=[
    Point3d(pt_b),
    Point3d(pts[0]+v_2*r0),
    Point3d(pts[0]+dir_v*r0),
    Point3d(pts[1]+v_3*r1),
    Point3d(-w*.5, h1+r1,0.)
]
# ---------- end ghpython_script_2 ----------
multiplication = Multiplication(A=2, B=number_slider_2)
number_slider_10 = Slider(150, range=0..1000)
number_slider_11 = Slider(250, range=0..1000)
number_slider_12 = Slider(650, range=0..1000)
ghpython_script_3 = GhPythonScript(
    h0=Slider(20, range=0..100),
    h1=Slider(20, range=0..100),
    h2=Slider(10, range=0..100),
    w0=Slider(20, range=0..100),
    w1=Slider(40, range=0..100))  # -> out, pts
# ---------- ghpython_script_3: Python ----------
from Rhino.Geometry import Point3d

hs=[h0, h0+h1, h0+h1+h2]
pts=[
    Point3d(w0, 0,0),
    Point3d(w0, h0,0),
    Point3d(w1, h0+h1,0),
    Point3d(w1, h0+h1+h2,0)
]

pts_2=[Point3d(-pt.X, pt.Y, 0) for pt in pts[::-1]]

pts+=pts_2
# ---------- end ghpython_script_3 ----------
line = Line([Line((120, -158.0615218, 120), (0, -158.0615218, 120)), Line((120, 60, 120), (0, 60, 120))])
number_slider_13 = Slider(10, range=0..10)  # disabled
box_2pt = Box2Pt(PointA=Point(167.0694036, 261.6520427, 0), PointB=Point(207.0694036, 381.6520427, 120), Plane=PlaneXY(0, 0, 0))
negative_2 = Negative(Value=number_slider_7)
number_slider_14 = Slider(2, range=0..10)  # disabled
list_item = ListItem(List=ghpython_script_2.pts_a, Index=0, Wrap=True)  # -> Item, Item1, Item2, Item3, Item4
volume = Volume(Geometry=mesh)  # -> Volume, Centroid
volume_2 = Volume(Geometry=bounding_box.Box)  # -> Volume, Centroid
tpms = TPMS(Wavelength=Slider(1.923, range=0..10))
point = Point(ghpython_script_2.pts_a)
polyline = PolyLine(Vertices=ghpython_script_3.pts, Closed=False)
number_slider_15 = Slider(50, range=0..1000)
number_slider_16 = Slider(120, range=0..1000)
lattice = Lattice(Cellsize=Slider(2, range=0..10), Thickness=1)
deconstruct_box = DeconstructBox(Box=box_2pt)  # -> Plane, X, Y, Z
domain_box = DomainBox(Base=PlaneXY(0, 0, 0), X=construct_domain, Y=construct_domain, Z=number_slider_2)
deconstruct_box_2 = DeconstructBox(Box=bounding_box_3.Box_2)  # -> Plane, X, Y, Z
deconstruct_box_3 = DeconstructBox(Box=bounding_box_2.Box_2)  # -> Plane, X, Y, Z
merge = Merge(Data1=number_slider_6, Data2=number_slider_5, Data3=number_slider_5, Data4=number_slider_6)
panel = Panel(ghpython_script_2.out)
construct_domain_2 = ConstructDomain(DomainStart=negative_2, DomainEnd=number_slider_7)
arc_3pt = Arc3Pt(PointA=list_item.Item2, PointB=list_item.Item3, PointC=list_item.Item4)  # -> Arc, Plane, Radius
arc_3pt_2 = Arc3Pt(PointA=list_item.Item, PointB=list_item.Item1, PointC=list_item.Item2)  # -> Arc, Plane, Radius
number_slider_17 = Slider(2.5, range=0..10)
number_slider_18 = Slider(4, range=0..10)  # disabled
feet_mesh = Feet_mesh(
    body_thickness=number_slider_10,
    side_width=Slider(150, range=0..1000),
    body_width=number_slider_11,
    body_height=number_slider_12)  # -> R, G_2, G
weld = WeldMesh(Mesh=feet_mesh.G, Angle=3.141592654)
unit_z = UnitZ(Factor=number_slider_9)  # disabled
circle_cnr = CircleCNR(Center=ghpython_script.pts, Normal=Vector(0, 0, 1), Radius=merge)
box = Box(DimensionX=number_slider_8, DimensionY=number_slider_8, DimensionZ=number_slider_8, Radius=0, Plane=PlaneXY(0, 0, 0))
create_voxelgrid = CreateVoxelGrid(BoundingBox=domain_box, SizeX=number_slider_2, SizeY=number_slider_2, SizeZ=number_slider_2)
wbsplitquads = WeaverbirdsConstantQuadsSplitSubdivision(MeshCurves=weld, Level=Slider(1, range=0..10), SmoothNakedEdges=1)
deconstruct_domain = DeconstructDomain(Domain=deconstruct_box.X)  # -> Start, End
deconstruct_domain_2 = DeconstructDomain(Domain=deconstruct_box.Y)  # -> Start, End
deconstruct_domain_3 = DeconstructDomain(Domain=deconstruct_box.Z)  # -> Start, End
deconstruct_domain_4 = DeconstructDomain(Domain=deconstruct_box_2.X)  # -> Start, End
deconstruct_domain_5 = DeconstructDomain(Domain=deconstruct_box_2.Y)  # -> Start, End
deconstruct_domain_6 = DeconstructDomain(Domain=deconstruct_box_3.Y)  # -> Start, End
deconstruct_domain_7 = DeconstructDomain(Domain=deconstruct_box_3.X)  # -> Start, End
deconstruct_domain_8 = DeconstructDomain(Domain=deconstruct_box_3.Z)  # -> Start, End
deconstruct_domain_9 = DeconstructDomain(Domain=deconstruct_box_2.Z)  # -> Start, End
panel_2 = Panel(volume.Volume)
division = Division(A=volume_2.Volume, B=volume.Volume)
number_slider_19 = Slider(50, range=0..100)
pt = Point(Point(0, 0, 0))
boolean_intersect = BooleanIntersect(DistanceObjectS=box, DistanceObject=tpms)
flip_curve = FlipCurve(Curve=polyline)  # -> Curve, Flag
multiplication_2 = Multiplication(A=Slider(1.2, range=0..10), B=number_slider_12)
multiplication_3 = Multiplication(A=Slider(1, range=0..10), B=number_slider_12)
division_2 = Division(A=number_slider_9, B=2)  # disabled
neg = Negative(Value=number_slider_16)
neg_2 = Negative(Value=number_slider_15)
surface = Surface(<surface referenced from the Rhino model>)
addition = Addition(A=number_slider_14, B=1)  # disabled
number_slider_20 = Slider(50, range=0..100)
merge_2 = Merge(Data1=arc_3pt_2.Arc, Data2=arc_3pt.Arc)
tpms_d = TPMSD(Wavelength=1, Modulator=lattice)
number_slider_21 = Slider(60, range=0..100)
negative_3 = Negative(Value=number_slider_17)
unit_y = UnitY(Factor=number_slider_21)
domain_box_2 = DomainBox(Base=PlaneXY(0, 0, 0), X=construct_domain_2, Y=construct_domain_2, Z=construct_domain_2)
Z = UnitZ(Factor=Slider(-50, range=-200..1000))
Z_2 = UnitZ(Factor=multiplication_2)
Z_3 = UnitZ(Factor=Slider(0, range=-200..1000))
Z_4 = UnitZ(Factor=multiplication_3)
xy_plane = XYPlane(Origin=Point(0, 0, 0))
panel_3 = Panel(division)
dom = ConstructDomain(DomainStart=number_slider_16, DomainEnd=neg)
dom_2 = ConstructDomain(DomainStart=number_slider_15, DomainEnd=neg_2)
weld_2 = WeldMesh(Mesh=feet_mesh.G, Angle=3.141592654)
deconstruct_box_4 = DeconstructBox(Box=surface)  # -> Plane, X, Y, Z
division_3 = Division(A=number_slider_9, B=addition)  # disabled
weaverbird_s_mesh_prism = WeaverbirdsMeshPrism(
    Plane=PlaneXY(0, 0, 0),
    Width=division_2,
    NumberOfSides=number_slider_18,
    TopPoint=unit_z,
    BasePolygonMethod=True,
    FillStrategy=1)  # disabled
bounding_box_4 = BoundingBox(Content=weaverbird_s_mesh_prism, Plane=PlaneXY(0, 0, 0))  # -> Box, Box_2; disabled
deconstruct_box_5 = DeconstructBox(Box=bounding_box_4.Box)  # -> Plane, X, Y, Z; disabled
rectangle = Rectangle(Plane=deconstruct_box_5.Plane, XSize=deconstruct_box_5.X, YSize=deconstruct_box_5.Y, Radius=0)  # -> Rectangle, Length; disabled
divide_curve = DivideCurve(Curve=rectangle.Rectangle, Count=1, Kinks=True)  # -> Points, Tangents, Parameters; disabled
join_curves = JoinCurves(Curves=merge_2, Preserve=False)
voxelategeometry = VoxelateGeometry(Geometry=domain_box, VoxelGrid=create_voxelgrid, Distance=0)
number_slider_22 = Slider(3, range=0..10)  # disabled
shift_list = ShiftList(List=divide_curve.Points, Shift=1, Wrap=True)  # disabled
merge_3 = Merge(
    Data1=deconstruct_domain_5.Start,
    Data2=deconstruct_domain_5.End,
    Data3=deconstruct_domain_6.Start,
    Data4=deconstruct_domain_6.End)
merge_4 = Merge(
    Data1=deconstruct_domain_4.Start,
    Data2=deconstruct_domain_4.End,
    Data3=deconstruct_domain_7.Start,
    Data4=deconstruct_domain_7.End)
merge_5 = Merge(
    Data1=deconstruct_domain_9.Start,
    Data2=deconstruct_domain_9.End,
    Data3=deconstruct_domain_8.Start,
    Data4=deconstruct_domain_8.End)
number_slider_23 = Slider(1, range=0..10)  # disabled
fmerge = MergeFaces(Brep=feet_mesh.G_2)  # -> Breps, Before, After
wbsplitquads_2 = WeaverbirdsConstantQuadsSplitSubdivision(MeshCurves=weld_2, Level=Slider(3, range=0..10), SmoothNakedEdges=1)
number_slider_24 = Slider(1.5, range=0..10)  # disabled
number_slider_25 = Slider(0.65, range=0..1)  # disabled
ln = Line(StartPoint=Z, EndPoint=Z_2)
ln_2 = Line(StartPoint=Z_3, EndPoint=Z_4)
number_slider_26 = Slider(1, range=0..1)  # disabled
number_slider_27 = Slider(35, range=0..100)  # disabled
construct_point = ConstructPoint(XCoordinate=deconstruct_domain.Start, YCoordinate=deconstruct_domain_2.Start, ZCoordinate=deconstruct_domain_3.Start)
construct_point_2 = ConstructPoint(XCoordinate=deconstruct_domain.End, YCoordinate=deconstruct_domain_2.End, ZCoordinate=deconstruct_domain_3.End)
number_slider_28 = Slider(3, range=0..10)  # disabled
rotate = Rotate(Geometry=xy_plane, Angle=3.141592654, Plane=PlaneXY(0, 0, 0))  # -> Geometry, Transform
number_slider_29 = Slider(2, range=0..10)  # disabled
offset_curve = OffsetCurve(Curve=flip_curve.Curve, Distance=number_slider_17, Plane=PlaneXY(0, 0, 0), Corners=1)
isosurface_distancefunction = IsosurfaceDistancefunction(
    BoundingBox=box_2pt,
    NumberX=Slider(16, range=0..100),
    NumberY=number_slider_19,
    NumberZ=number_slider_19,
    Isovalue=0,
    Capped=False,
    DistanceObject=boolean_intersect,
    Refine=True)
negative_4 = Negative(Value=number_slider_21)
offset_curve_2 = OffsetCurve(Curve=flip_curve.Curve, Distance=negative_3, Plane=PlaneXY(0, 0, 0), Corners=1)
wbsplitquads_3 = WeaverbirdsConstantQuadsSplitSubdivision(MeshCurves=wbsplitquads_2, Level=Slider(2, range=0..10), SmoothNakedEdges=1)
mirror = Mirror(Geometry=join_curves, Plane=PlaneYZ(0, 0, 0))  # -> Geometry, Transform
multiplication_4 = Multiplication(A=number_slider_21, B=2)
sort_list = SortList(Keys=merge_3)  # -> Keys, ValuesValuesA
line_2 = Line(StartPoint=divide_curve.Points, EndPoint=shift_list)  # disabled
end_points = EndPoints(Curve=mirror.Geometry)  # -> Start, End
end_points_2 = EndPoints(Curve=join_curves)  # -> Start, End
sort_list_2 = SortList(Keys=merge_4)  # -> Keys, ValuesValuesA
rectangle_2 = Rectangle(Plane=Z, XSize=dom_2, YSize=dom, Radius=0)  # -> Rectangle, Length
series = Series(Start=division_3, Step=division_3, Count=number_slider_14)  # disabled
sort_list_3 = SortList(Keys=merge_5)  # -> Keys, ValuesValuesA
merge_6 = Merge(Data1=negative_4, Data2=number_slider_21)
divide = DivideCurve(Curve=ln_2, Count=10, Kinks=False)  # -> Points, Tangents, Parameters
wbsplitquads_4 = WeaverbirdsConstantQuadsSplitSubdivision(MeshCurves=wbsplitquads_3, Level=Slider(1, range=0..10), SmoothNakedEdges=1)
isosurface_octree = IsosurfaceOctree(Origin=Point(0, 0, 0), WorldSize=number_slider_20, Isovalue=0, Subdivisions=4, DistanceObject=boolean_intersect)
isosurface_distancefunction_2 = IsosurfaceDistancefunction(
    BoundingBox=domain_box_2,
    NumberX=Slider(16, range=0..100),
    NumberY=number_slider_20,
    NumberZ=number_slider_20,
    Isovalue=0,
    Capped=False,
    DistanceObject=box,
    Refine=True)
division_4 = Division(A=number_slider_2, B=2)
deconstruct_mesh = DeconstructMesh(Mesh=voxelategeometry)  # -> Vertices, Faces, Colours, Normals
number_slider_30 = Slider(5, range=0..10)
weaverbird_s_constant_quads_split_subdiv = WeaverbirdsConstantQuadsSplitSubdivision(MeshCurves=weaverbird_s_mesh_prism, Level=number_slider_28, SmoothNakedEdges=0)  # disabled
multiplication_5 = Multiplication(A=number_slider_9, B=number_slider_23)  # disabled
domain = Domain(Domain(0, 1))  # disabled
point_2 = Point(Point(0, 0, 0))  # disabled
extrcrv = ExtrudeAlong(Base=rectangle_2.Rectangle, Curve=ln)
split = SplitList(List=divide.Points, Index=2)  # -> ListA, ListB
move = Move(Geometry=rotate.Geometry, Motion=unit_y)  # -> Geometry, Transform
subtraction = Subtraction(A=number_slider_22, B=1)  # disabled
medges = MeshEdges(Mesh=wbsplitquads_4)  # -> NakedEdges, InteriorEdges, NonManifoldEdges
negative_5 = Negative(Value=number_slider_27)  # disabled
pi = Pi(Factor=expr("1/(x+1)", number_slider_30))
subtraction_2 = Subtraction(A=construct_point_2, B=construct_point)
line_3 = Line(StartPoint=end_points_2.End, EndPoint=end_points.End)
shift_list_2 = ShiftList(List=line_2, Shift=1, Wrap=True)  # disabled
negative_6 = Negative(Value=division_2)  # disabled
negative_7 = Negative(Value=division_2)  # disabled
custom_preview = CustomPreview(
    Geometry=isosurface_distancefunction,
    Material={diffuse=RGB(221, 160, 221), emission=RGB(66, 48, 66), shine=0.5, specular=RGB(255, 255, 255), transparency=0})
unit_z_2 = UnitZ(Factor=series)  # disabled
number_slider_31 = Slider(2.5, range=0..10)
split_list = SplitList(List=shift_list_2, Index=number_slider_26)  # -> ListA, ListB; disabled
lng = ListLength(List=split.ListB)
deconstruct = Deconstruct(Point=deconstruct_mesh.Vertices)  # -> XComponent, YComponent, ZComponent
box_2 = Box(DimensionX=8, DimensionY=7, DimensionZ=6, Radius=0, Plane=PlaneXY(0, 0, 0))
multiplication_6 = Multiplication(A=subtraction_2, B=0.5)
cap = CapHoles(Brep=extrcrv)
point_3 = Point(flatten(deconstruct_mesh.Vertices))
list_item_2 = ListItem(List=sort_list_2.Keys, Index=0, Wrap=True)  # -> Item1, Item
list_item_3 = ListItem(List=sort_list.Keys, Index=0, Wrap=True)  # -> Item1, Item
list_item_4 = ListItem(List=sort_list_3.Keys, Index=0, Wrap=True)  # -> Item1, Item
multiplication_7 = Multiplication(A=number_slider_11, B=0.5)
series_2 = Series(Start=1, Step=1, Count=subtraction)  # disabled
construct_point_3 = ConstructPoint(XCoordinate=graft(merge_6), YCoordinate=merge_6, ZCoordinate=0)  # -> flatten(Point)
number_slider_32 = Slider(60, range=0..200)
number_slider_33 = Slider(300, range=0..500)
number_slider_34 = Slider(45, range=0..100)
number_slider_35 = Slider(25, range=0..100)
number_slider_36 = Slider(25.01, range=0..100)
split_2 = SplitList(List=split.ListB, Index=expr("x-1", lng))  # -> graft(ListA), ListB
series_3 = Series(Start=pi, Step=pi, Count=number_slider_30)
custom_preview_2 = CustomPreview(
    Geometry=isosurface_octree,
    Material={diffuse=RGB(221, 160, 221), emission=RGB(66, 48, 66), shine=0.5, specular=RGB(255, 255, 255), transparency=0})
deconstruct_2 = Deconstruct(Point=construct_point_2)  # -> XComponent, YComponent, ZComponent
line_4 = Line(split_list.ListB)  # disabled
crvdom = CurveDomain(Curve=line_4, Domain=domain)  # -> Curve, Domain; disabled
merge_7 = Merge(Data1=join_curves, Data2=mirror.Geometry, Data3=line_3)
rotate_2 = Rotate(Geometry=move.Geometry, Angle=3.141592654, Plane=PlaneXY(0, 0, 0))  # -> Geometry, Transform
division_5 = Division(A=series_2, B=number_slider_22)  # disabled
subtraction_3 = Subtraction(A=number_slider_33, B=number_slider_32)
addition_2 = Addition(A=multiplication_6, B=construct_point)
weaverbird_s_constant_quads_split_subdiv_2 = WeaverbirdsConstantQuadsSplitSubdivision(MeshCurves=weaverbird_s_constant_quads_split_subdiv, Level=number_slider_29, SmoothNakedEdges=0)  # disabled
construct_domain_3 = ConstructDomain(DomainStart=list_item_2.Item, DomainEnd=list_item_2.Item1)
construct_domain_4 = ConstructDomain(DomainStart=list_item_3.Item, DomainEnd=list_item_3.Item1)
unit_x = UnitX(Factor=division_2)  # disabled
ghpython_script_4 = GhPythonScript(y=point_3, g_a=Slider(0.01, range=0..1), g_b=Slider(0.1, range=0..10), global_scale=Slider(10, range=0..10))  # -> out, flatten(y); inputs y: list of Point3d
# ---------- ghpython_script_4: Python ----------
from math import sin, cos

def sdfGyroid(pt, scale):
    x,y,z=pt.X*scale, pt.Y*scale, pt.Z*scale
    ds = (
        sin(x) * cos(y) + 
        sin(y) * cos(z) + 
        sin(z) * cos(x)
    )
    return ds

for pt in y:
    pt.Z += global_scale*(1+.333*sdfGyroid(pt, g_a * sdfGyroid(pt, g_b)))
# ---------- end ghpython_script_4 ----------
construct_domain_5 = ConstructDomain(DomainStart=list_item_4.Item, DomainEnd=list_item_4.Item1)
unit_x_2 = UnitX(Factor=negative_7)  # disabled
unit_y_2 = UnitY(Factor=division_2)  # disabled
unit_y_3 = UnitY(Factor=negative_6)  # disabled
number_slider_37 = Slider(45, range=0..100)  # disabled
number_slider_38 = Slider(15, range=0..100)  # disabled
number_slider_39 = Slider(25.01, range=0..100)  # disabled
larger_than = LargerThan(FirstNumber=deconstruct.ZComponent, SecondNumber=division_4)  # -> LargerThan, flatten(OrEqualTo)
number_slider_40 = Slider(45, range=0..100)
number_slider_41 = Slider(15, range=0..100)
random = Random(Range=Domain(0, 1), Number=1, Seed=2)
number_slider_42 = Slider(25.01, range=0..100)
box_3 = Box(DimensionX=8, DimensionY=7, DimensionZ=6, Radius=0, Plane=PlaneXY(0, 0, 0))
list_item_5 = ListItem(List=construct_point_3, Index=0, Wrap=True)  # -> Item, Item1, Item2, Item3
subtraction_4 = Subtraction(A=division_5, B=0.5)  # disabled
cluster = Cluster_2(value=number_slider_31, A=number_slider_17, curve=offset_curve_2, number=number_slider_21)  # -> curve_4, curve_5, result
cluster_2 = Cluster(distance=number_slider_31, curve=offset_curve, number=number_slider_21)  # -> x, x_2, result
join_curves_2 = JoinCurves(Curves=merge_7, Preserve=False)
offset_curve_3 = OffsetCurve(Curve=join_curves_2, Distance=number_slider_17, Plane=PlaneXY(0, 0, 0), Corners=1)
offset_curve_4 = OffsetCurve(Curve=join_curves_2, Distance=negative_3, Plane=PlaneXY(0, 0, 0), Corners=1)
merge_8 = Merge(Data1=graft(point_3), Data2=graft(ghpython_script_4.y))
ghpython_script_5 = GhPythonScript(x=offset_curve_2, y=move.Geometry)  # -> p2p, x; inputs x: GeometryBase, y: Plane; same code as ghpython_script
number_slider_43 = Slider(60, range=-100..100)
X = UnitX(Factor=number_slider_32)
X_2 = UnitX(Factor=number_slider_33)
multiplication_8 = Multiplication(A=subtraction_3, B=Slider(0.2, range=0..1))
multiplication_9 = Multiplication(A=subtraction_3, B=Slider(0.5, range=0..1))
number_slider_44 = Slider(15, range=0..100)  # disabled
number_slider_45 = Slider(10, range=0..100)  # disabled
multiplication_10 = Multiplication(A=number_slider_24, B=subtraction_4)  # disabled
number_slider_46 = Slider(11, range=0..25)  # disabled
box_4 = Box(
    DimensionX=deconstruct_box.X,
    DimensionY=deconstruct_box.Y,
    DimensionZ=deconstruct_box.Z,
    Radius=1,
    Plane=construct_point)
line_5 = Line(StartPoint=list_item_5.Item, EndPoint=list_item_5.Item1)
merge_9 = Merge(Data1=number_slider_35, Data2=number_slider_35, Data3=number_slider_35)
line_6 = Line(StartPoint=list_item_5.Item2, EndPoint=list_item_5.Item3)
dom_3 = ConstructDomain(DomainStart=multiplication_8, DomainEnd=multiplication_9)
rotate_3 = Rotate(Geometry=X, Angle=series_3, Plane=PlaneXY(0, 0, 0))  # -> Geometry, Transform
rotate_4 = Rotate(Geometry=X_2, Angle=series_3, Plane=PlaneXY(0, 0, 0))  # -> Geometry, Transform
number_slider_47 = Slider(60, range=-100..100)  # disabled
ghpython_script_6 = GhPythonScript(x=offset_curve_4, y=rotate_2.Geometry)  # -> p2p, x; inputs x: GeometryBase, y: Plane; same code as ghpython_script
number_slider_48 = Slider(30, range=-100..250)  # disabled
yz_plane = YZPlane(Origin=unit_x)  # disabled
yz_plane_2 = YZPlane(Origin=unit_x_2)  # disabled
addition_3 = Addition(A=split_2.ListA, B=rotate_3.Geometry)  # -> flatten(Result)
addition_4 = Addition(A=split_2.ListA, B=rotate_4.Geometry)  # -> flatten(Result)
lng_2 = ListLength(List=addition_4)
xz_plane = XZPlane(Origin=unit_y_2)  # disabled
xz_plane_2 = XZPlane(Origin=unit_y_3)  # disabled
deconstruct_mesh_2 = DeconstructMesh(Mesh=wbsplitquads_4)  # -> Vertices, Faces, Colours, Normals
addition_5 = Addition(A=multiplication_10, B=number_slider_25)  # disabled
eval = EvaluateCurve(Curve=graft(crvdom.Curve), Parameter=addition_5)  # -> flatten(Point), Tangent, Angle; disabled
addition_6 = Addition(A=graft(eval.Point), B=unit_z_2)  # disabled
deconstruct_3 = Deconstruct(Point=addition_6)  # -> XComponent, YComponent, ZComponent; disabled
line_7 = Line(StartPoint=addition_6, EndPoint=point_2)  # disabled
length = Length(Curve=line_7)  # disabled
division_6 = Division(A=length, B=multiplication_5)  # disabled
multiplication_11 = Multiplication(A=deconstruct_3.ZComponent, B=division_6)  # disabled
number_slider_49 = Slider(45, range=0..100)
number_slider_50 = Slider(15, range=0..100)
number_slider_51 = Slider(25.01, range=0..100)
vector_xyz = VectorXYZ(XComponent=deconstruct_3.XComponent, YComponent=deconstruct_3.YComponent, ZComponent=multiplication_11)  # -> Vector, Length; disabled
line_8 = Line()  # disabled
number_slider_52 = Slider(60, range=-100..100)
mesh_2 = Mesh(weaverbird_s_constant_quads_split_subdiv_2)  # disabled
list_item_6 = ListItem(List=merge_8, Index=graft(larger_than.OrEqualTo), Wrap=True)  # -> flatten(Item)
value_list = ValueList({"x", "y"}, selected="x")
domain_box_3 = DomainBox(Base=PlaneXY(0, 0, 0), X=construct_domain_3, Y=construct_domain_4, Z=construct_domain_5)
merge_10 = Merge(Data1=number_slider_38, Data2=number_slider_38, Data3=number_slider_38)  # disabled
random_2 = Random(Range=dom_3, Number=lng_2, Seed=2)
number_slider_53 = Slider(31.765, range=0..100)  # disabled
point_4 = Point(vector_xyz.Vector)  # disabled
unit_vector = UnitVector(Vector=point_4)  # disabled
multiplication_12 = Multiplication(A=number_slider_27, B=unit_vector)  # disabled
multiplication_13 = Multiplication(A=negative_5, B=unit_vector)  # disabled
addition_7 = Addition(A=addition_6, B=multiplication_12)  # disabled
addition_8 = Addition(A=addition_6, B=multiplication_13)  # disabled
number_slider_54 = Slider(60, range=-100..100)  # disabled
number_slider_55 = Slider(60, range=-100..250)  # disabled
boolean_toggle = BooleanToggle(False)  # disabled
number_slider_56 = Slider(-60, range=-100..100)  # disabled
number_slider_57 = Slider(10, range=-100..250)  # disabled
end_points_3 = EndPoints(Curve=cluster.curve_4)  # -> Start, End
end_points_4 = EndPoints(Curve=cluster.curve_5)  # -> Start, End
deconstruct_mesh_3 = DeconstructMesh(Mesh=mesh_2)  # -> Vertices, Faces, Colours, Normals; disabled
number_slider_58 = Slider(11, range=0..20)
number_slider_59 = Slider(25, range=0..100)  # disabled
merge_11 = Merge(Data1=number_slider_41, Data2=number_slider_41, Data3=number_slider_41)
Z_5 = UnitZ(Factor=random_2)
line_9 = Line(StartPoint=addition_7, EndPoint=addition_8)  # disabled
addition_9 = Addition(A=Z_5, B=addition_4)
merge_12 = Merge(Data1=number_slider_44, Data2=number_slider_44, Data3=number_slider_44)  # disabled
merge_13 = Merge(Data1=number_slider_45, Data2=number_slider_45, Data3=number_slider_45)  # disabled
value_list_2 = ValueList({"x", "y"}, selected="x")  # disabled
pipe = Pipe(Curve=line_9, Radius=number_slider_46, Caps=2)  # disabled
number_slider_60 = Slider(60, range=-100..100)
number_slider_61 = Slider(31.765, range=0..100)  # disabled
ln_3 = Line(StartPoint=addition_3, EndPoint=addition_9)
value_list_3 = ValueList({"x", "y"}, selected="x")
number_slider_62 = Slider(7.5, range=0..100)  # disabled
boolean_toggle_2 = BooleanToggle(False)  # disabled
boolean_toggle_3 = BooleanToggle(True)  # disabled
ghpython_script_7 = GhPythonScript(
    pts=deconstruct_mesh_2.Vertices,
    direction=value_list,
    scales=merge_9,
    isoplane=multiplication_7,
    amplitude=Slider(60, range=-100..250),
    dir_b=Toggle(False),
    w=Slider(31.765, range=0..100))  # -> out, pts; inputs pts: list of Point3d, scales: list, dir_b: Boolean
# ---------- ghpython_script_7: Python ----------
import sys

sys.path.append("/Users/jonas/Documents/GitHub/rrreefs_coral_feet/grasshopper/patterns/")

import patterns as pat

reload(pat)

pts = pat.move_pts(pts, pat.uv_gyroid, direction, dir_b, isoplane, amplitude, w, scales)
# ---------- end ghpython_script_7 ----------
end = EndPoints(Curve=ln_3)  # -> Start, End
panel_4 = Panel(list_item_6)
line_10 = Line(StartPoint=end_points_4.Start, EndPoint=list_item_5.Item)
line_11 = Line(StartPoint=end_points_4.End, EndPoint=list_item_5.Item2)
neg_3 = Negative(Value=multiplication_7)
line_12 = Line(StartPoint=end_points_3.End, EndPoint=list_item_5.Item1)
line_13 = Line(StartPoint=end_points_3.Start, EndPoint=list_item_5.Item3)
value_list_4 = ValueList({"x", "y"}, selected="x")  # disabled
pipe_2 = Pipe(Curve=ln_3, Radius=number_slider_58, Caps=1)
construct_mesh = ConstructMesh(Vertices=list_item_6, Faces=deconstruct_mesh.Faces, Colours=deconstruct_mesh.Colours)
value_list_5 = ValueList({"x", "y"}, selected="x")  # disabled
number_slider_63 = Slider(60, range=-100..100)  # disabled
merge_14 = Merge(Data1=number_slider_50, Data2=number_slider_50, Data3=number_slider_50)
number_slider_64 = Slider(15, range=-100..250)  # disabled
ghpython_script_8 = GhPythonScript(
    pts=deconstruct_mesh_3.Vertices,
    direction=value_list_2,
    scales=merge_10,
    isoplane=number_slider_47,
    amplitude=number_slider_48,
    dir_b=boolean_toggle,
    w=number_slider_53)  # -> out, pts; inputs pts: list of Point3d, scales: list, dir_b: Boolean; disabled
# ---------- ghpython_script_8: Python ----------
import sys

sys.path.append("/Users/jonas/Documents/reps/rrreefs_coral_feet/grasshopper/patterns/")

import patterns as pat

reload(pat)

pts = pat.move_pts(pts, pat.uv_gyroid, direction, dir_b, isoplane, amplitude, w, scales)
# ---------- end ghpython_script_8 ----------
subtraction_5 = Subtraction(A=end.End, B=end.Start)
merge_15 = Merge(Data1=number_slider_59, Data2=number_slider_59, Data3=number_slider_59)  # disabled
pl = PlaneNormal(Origin=end.Start, ZAxis=subtraction_5)
brep_3 = Brep(flatten(pipe))  # disabled
lng_3 = ListLength(List=brep_3)  # disabled
ghpython_script_9 = GhPythonScript(
    pts=ghpython_script_7.pts,
    direction=value_list_3,
    scales=merge_9,
    isoplane=neg_3,
    amplitude=Slider(60, range=-100..250),
    dir_b=Toggle(True),
    w=Slider(31.765, range=0..100))  # -> out, pts; inputs pts: list of Point3d, scales: list, dir_b: Boolean; same code as ghpython_script_7
value_list_6 = ValueList({"x", "y"}, selected="y")
number_slider_65 = Slider(31.765, range=0..100)  # disabled
boolean_toggle_4 = BooleanToggle(False)  # disabled
number_slider_66 = Slider(-60, range=-100..100)  # disabled
number_slider_67 = Slider(15, range=-100..250)  # disabled
subtraction_6 = Subtraction(A=lng_3, B=number_slider_14)  # disabled
neg_4 = Negative(Value=multiplication_7)
ghpython_script_10 = GhPythonScript(
    pts=deconstruct_mesh_3.Vertices,
    direction=value_list_4,
    scales=merge_12,
    isoplane=number_slider_54,
    amplitude=number_slider_55,
    dir_b=boolean_toggle_2,
    w=number_slider_53)  # -> out, pts; inputs pts: list of Point3d, scales: list, dir_b: Boolean; disabled
# ---------- ghpython_script_10: Python ----------
import sys

sys.path.append("/Users/jonas/Documents/reps/rrreefs_coral_feet/grasshopper/patterns/")

import patterns as pat

reload(pat)

pts_b = pat.move_pts(pts, pat.uv_gyroid, direction, dir_b, isoplane, amplitude, w, scales)
pts_a = pat.move_pts(pts, pat.uv_gyroid, direction, dir_b, isoplane, 20., w, (7.5,7.5,7.5))

pts = [(pts_b[i] + pt_a)*.5 for i, pt_a in enumerate(pts_a)]
# ---------- end ghpython_script_10 ----------
ghpython_script_11 = GhPythonScript(
    pts=ghpython_script_8.pts,
    direction=value_list_5,
    scales=merge_13,
    isoplane=number_slider_56,
    amplitude=number_slider_57,
    dir_b=boolean_toggle_3,
    w=number_slider_61)  # -> out, pts; inputs pts: list of Point3d, scales: list, dir_b: Boolean; disabled; same code as ghpython_script_8
merge_16 = Merge(
    Data1=cluster.curve_4,
    Data2=cluster.curve_5,
    Data3=line_5,
    Data4=line_6,
    Data5=line_13,
    Data6=line_12,
    Data7=line_10,
    Data8=line_11)  # -> flatten(Result)
custom_preview_3 = CustomPreview(
    Geometry=construct_mesh,
    Material={diffuse=RGB(221, 160, 221), emission=RGB(66, 48, 66), shine=0.5, specular=RGB(255, 255, 255), transparency=0})
wbprism = WeaverbirdsMeshPrism(
    Plane=pl,
    Width=number_slider_58,
    NumberOfSides=Slider(6, range=0..10),
    TopPoint=end.End,
    BasePolygonMethod=True,
    FillStrategy=1)
merge_17 = Merge(Data1=number_slider_62, Data2=number_slider_62, Data3=number_slider_62)  # disabled
value_list_7 = ValueList({"x", "y"}, selected="y")  # disabled
split_3 = SplitList(List=brep_3, Index=subtraction_6)  # -> ListA, ListB; disabled
number_slider_68 = Slider(31.765, range=0..100)  # disabled
boolean_toggle_5 = BooleanToggle(True)  # disabled
ghpython_script_12 = GhPythonScript(
    pts=ghpython_script_9.pts,
    direction=value_list_6,
    scales=merge_9,
    isoplane=number_slider_10,
    amplitude=Slider(60, range=-100..250),
    dir_b=Toggle(True),
    w=Slider(31.765, range=0..100))  # -> out, pts; inputs pts: list of Point3d, scales: list, dir_b: Boolean; same code as ghpython_script_7
brep_4 = Brep(flatten(split_3.ListA))  # disabled
panel_5 = Panel(ghpython_script_8.out)  # disabled
value_list_8 = ValueList({"x", "y"}, selected="y")  # disabled
unit_z_3 = UnitZ(Factor=multiplication_4)
join_curves_3 = JoinCurves(Curves=merge_16, Preserve=False)
construct_mesh_2 = ConstructMesh(Vertices=ghpython_script_8.pts, Faces=deconstruct_mesh_3.Faces)  # disabled
ghpython_script_13 = GhPythonScript(
    pts=ghpython_script_11.pts,
    direction=value_list_7,
    scales=merge_15,
    isoplane=number_slider_63,
    amplitude=number_slider_64,
    dir_b=boolean_toggle_4,
    w=number_slider_65)  # -> out, pts; inputs pts: list of Point3d, scales: list, dir_b: Boolean; disabled; same code as ghpython_script_8
merge_18 = Merge(Data1=negative_4, Data2=number_slider_21)
number_slider_69 = Slider(10, range=0..10)  # disabled
number_slider_70 = Slider(20, range=0..25)  # disabled
number_slider_71 = Slider(20, range=0..25)  # disabled
number_slider_72 = Slider(5, range=0..10)  # disabled
ghpython_script_14 = GhPythonScript(
    pts=ghpython_script_13.pts,
    direction=value_list_8,
    scales=merge_17,
    isoplane=number_slider_66,
    amplitude=number_slider_67,
    dir_b=boolean_toggle_5,
    w=number_slider_68)  # -> out, pts; inputs pts: list of Point3d, scales: list, dir_b: Boolean; disabled; same code as ghpython_script_8
construct_mesh_3 = ConstructMesh(Vertices=ghpython_script_14.pts, Faces=deconstruct_mesh_3.Faces)  # disabled
extrude = Extrude(Base=join_curves_3, Direction=unit_z_3)
mesh_3 = Mesh(weaverbird_s_mesh_prism)  # disabled
demesh = DeconstructMesh(Mesh=construct_mesh_2)  # -> Vertices, Faces, Colours, Normals; disabled
mesh_4 = Mesh(brep_4)  # disabled
volume_3 = Volume(Geometry=feet_mesh.G)  # -> Volume, Centroid
weaverbird_s_catmull_clark_subdivision = WeaverbirdsCatmullClarkSubdivision(MeshCurves=construct_mesh_3, Level=1, SmoothNakedEdges=1)  # disabled
pt_2 = Point(deconstruct_mesh_2.Vertices)
construct_point_4 = ConstructPoint(XCoordinate=merge_18, YCoordinate=graft(cluster_2.result), ZCoordinate=0)  # -> flatten(Point)
pdecon = Deconstruct(Point=demesh.Vertices)  # -> XComponent, YComponent, ZComponent; disabled
mesh_5 = Mesh(construct_mesh_3)  # disabled
panel_6 = Panel(volume_3.Volume)
flatten_tree = FlattenTree(Tree=mesh_4, Path="{0}")  # disabled
number_slider_73 = Slider(23, range=0..50)
addition_10 = Addition(A=multiplication_4, B=Slider(15, range=0..100))
division_7 = Division(A=pdecon.YComponent, B=number_slider_72)  # disabled
division_8 = Division(A=pdecon.ZComponent, B=number_slider_72)  # disabled
division_9 = Division(A=pdecon.XComponent, B=number_slider_72)  # disabled
curve = Curve(cluster_2.x)
curve_2 = Curve(cluster_2.x_2)
number_slider_74 = Slider(5, range=0..10)
pdecon_2 = Deconstruct(Point=pt_2)  # -> XComponent, YComponent, ZComponent
cap_holes = CapHoles(Brep=extrude)
multiplication_14 = Multiplication(A=addition_10, B=2)
list_item_7 = ListItem(List=construct_point_4, Index=0, Wrap=True)  # -> Item, Item1, Item2, Item3
mesh_difference = MeshDifference(MeshesA=weaverbird_s_catmull_clark_subdivision, MeshesB=flatten_tree)  # disabled
expression = Expression(
    u=division_8,
    v=division_7,
    w=division_9,
    Expression="( sin(u) * cos(v) + sin(v) * cos(w) + sin(w) * cos(u) ) / 3.0 + .5")  # disabled
multiplication_15 = Multiplication(A=expression, B=number_slider_70)  # disabled
multiplication_16 = Multiplication(A=demesh.Normals, B=multiplication_15)  # disabled
addition_11 = Addition(A=demesh.Vertices, B=multiplication_16)  # disabled
unit_x_3 = UnitX(Factor=addition_10)
division_10 = Division(A=pdecon_2.YComponent, B=number_slider_73)
division_11 = Division(A=pdecon_2.ZComponent, B=number_slider_73)
division_12 = Division(A=pdecon_2.XComponent, B=number_slider_73)
unit_x_4 = UnitX(Factor=multiplication_14)
line_14 = Line(StartPoint=list_item_7.Item, EndPoint=list_item_7.Item2)
line_15 = Line(StartPoint=list_item_7.Item1, EndPoint=list_item_7.Item3)
construct_mesh_4 = ConstructMesh(Vertices=addition_11, Faces=deconstruct_mesh_3.Faces)  # disabled
expression_2 = Expression(
    u=division_11,
    v=division_10,
    w=division_12,
    Expression="( sin(u) * cos(v) + sin(v) * cos(w) + sin(w) * cos(u) ) / 3.0 + .5")
multiplication_17 = Multiplication(A=expression_2, B=Slider(60, range=0..100))
multiplication_18 = Multiplication(A=deconstruct_mesh_2.Normals, B=multiplication_17)
addition_12 = Addition(A=pt_2, B=multiplication_18)
pdecon_3 = Deconstruct(Point=addition_12)  # -> XComponent, YComponent, ZComponent
division_13 = Division(A=pdecon_3.YComponent, B=number_slider_74)
division_14 = Division(A=pdecon_3.ZComponent, B=number_slider_74)
division_15 = Division(A=pdecon_3.XComponent, B=number_slider_74)
move_2 = Move(Geometry=cap_holes, Motion=unit_x_3)  # -> Geometry, Transform
end_points_5 = EndPoints(Curve=curve_2)  # -> Start, End
end_points_6 = EndPoints(Curve=curve)  # -> Start, End
expression_3 = Expression(
    u=division_14,
    v=division_13,
    w=division_15,
    Expression="( sin(u) * cos(v) + sin(v) * cos(w) + sin(w) * cos(u) ) / 3.0 + .5")
multiplication_19 = Multiplication(A=expression_3, B=Slider(20, range=0..25))
multiplication_20 = Multiplication(A=deconstruct_mesh_2.Normals, B=multiplication_19)
addition_13 = Addition(A=addition_12, B=multiplication_20)
pdecon_4 = Deconstruct(Point=addition_13)  # -> graft(XComponent), graft(YComponent), graft(ZComponent)
multiplication_21 = Multiplication(A=pdecon_4.YComponent, B=0)
smaller = SmallerThan(FirstNumber=pdecon_4.YComponent, SecondNumber=0)  # -> SmallerThan, OrEqualTo
multiplication_22 = Multiplication(A=pdecon_4.ZComponent, B=0)
smaller_2 = SmallerThan(FirstNumber=pdecon_4.ZComponent, SecondNumber=0)  # -> SmallerThan, OrEqualTo
merge_19 = Merge(Data1=pdecon_4.YComponent, Data2=multiplication_21)
merge_20 = Merge(Data1=pdecon_4.ZComponent, Data2=multiplication_22)
item = ListItem(List=merge_19, Index=smaller.OrEqualTo, Wrap=True)
item_2 = ListItem(List=merge_20, Index=smaller_2.OrEqualTo, Wrap=True)
pt_3 = ConstructPoint(XCoordinate=pdecon_4.XComponent, YCoordinate=item, ZCoordinate=item_2)  # -> flatten(Point)
construct_mesh_5 = ConstructMesh(Vertices=pt_3, Faces=deconstruct_mesh_2.Faces)
mdif = MeshDifference(MeshesA=construct_mesh_5, MeshesB=cap)
preview = CustomPreview(Geometry=mdif, Material=ColourSwatch(SwatchColor=RGB(255, 184, 41)))
volume_4 = Volume(Geometry=mdif)  # -> Volume, Centroid
panel_7 = Panel(volume_4.Volume)
wbsplitquads_5 = WeaverbirdsConstantQuadsSplitSubdivision(MeshCurves=construct_mesh_5, Level=Slider(2, range=0..10), SmoothNakedEdges=1)  # disabled
mdif_2 = MeshDifference(MeshesA=mdif, MeshesB=flatten(wbprism))  # disabled
wbcatmullclark = WeaverbirdsCatmullClarkSubdivision(MeshCurves=construct_mesh_4, Level=1, SmoothNakedEdges=1)  # disabled
line_16 = Line(StartPoint=end_points_5.End, EndPoint=list_item_7.Item2)
line_17 = Line(StartPoint=end_points_5.Start, EndPoint=list_item_7.Item3)
line_18 = Line(StartPoint=end_points_6.Start, EndPoint=list_item_7.Item)
line_19 = Line(StartPoint=end_points_6.End, EndPoint=list_item_7.Item1)
merge_21 = Merge(Data1=curve, Data2=curve_2, Data3=line_14, Data4=line_15, Data5=line_18, Data6=line_19, Data7=line_17, Data8=line_16)  # -> flatten(Result)
unit_z_4 = UnitZ(Factor=multiplication_4)
join_curves_4 = JoinCurves(Curves=merge_21, Preserve=False)
extrude_2 = Extrude(Base=join_curves_4, Direction=unit_z_4)
cap_holes_2 = CapHoles(Brep=extrude_2)
move_3 = Move(Geometry=cap_holes_2, Motion=unit_x_4)  # -> Geometry, Transform
merge_22 = Merge(Data1=move_3.Geometry, Data2=move_2.Geometry)

# ==== cluster Cluster
distance = ClusterInput()
curve = ClusterInput()
number = ClusterInput()
curve_2 = Curve(curve)
number_2 = Number(number)
bounding_box = BoundingBox(Content=curve_2, Plane=PlaneXY(0, 0, 0))  # -> Box, Box_2
offset_curve = OffsetCurve(Curve=curve_2, Distance=distance, Plane=PlaneXY(0, 0, 0), Corners=1)
deconstruct_box = DeconstructBox(Box=bounding_box.Box)  # -> Plane, X, Y, Z
extend_curve = ExtendCurve(Curve=offset_curve, Type=0, Start=distance, End=distance)
bounding_box_2 = BoundingBox(Content=extend_curve, Plane=PlaneXY(0, 0, 0))  # -> Box, Box_2
deconstruct_box_2 = DeconstructBox(Box=bounding_box_2.Box)  # -> Plane, X, Y, Z
deconstruct_domain = DeconstructDomain(Domain=deconstruct_box.Y)  # -> Start, End
deconstruct_domain_2 = DeconstructDomain(Domain=deconstruct_box_2.Y)  # -> Start, End
subtraction = Subtraction(A=deconstruct_domain_2.End, B=deconstruct_domain_2.Start)
subtraction_2 = Subtraction(A=deconstruct_domain.End, B=deconstruct_domain.Start)
subtraction_3 = Subtraction(A=number_2, B=subtraction)
subtraction_4 = Subtraction(A=number_2, B=subtraction_2)
subtraction_5 = Subtraction(A=number_2, B=deconstruct_domain.End)
subtraction_6 = Subtraction(A=number_2, B=deconstruct_domain_2.End)
negative = Negative(Value=subtraction_3)
unit_y = UnitY(Factor=subtraction_6)
unit_y_2 = UnitY(Factor=subtraction_5)
merge = Merge(Data1=subtraction_4, Data2=negative)
xy_plane = XYPlane(Origin=unit_y)
xy_plane_2 = XYPlane(Origin=unit_y_2)
result = ClusterOutput(merge)
rotate = Rotate(Geometry=xy_plane, Angle=3.141592654, Plane=PlaneXY(0, 0, 0))  # -> Geometry, Transform
ghpython_script = GhPythonScript(x=curve_2, y=xy_plane_2)  # -> p2p, x; inputs x: GeometryBase, y: Plane
# ---------- ghpython_script: Python ----------
from Rhino.Geometry.Transform import PlaneToPlane
from Rhino.Geometry.Plane import WorldXY

t_m=PlaneToPlane(WorldXY, y)
x.Transform(t_m)
# ---------- end ghpython_script ----------
ghpython_script_2 = GhPythonScript(x=extend_curve, y=rotate.Geometry)  # -> p2p, x; inputs x: GeometryBase, y: Plane; same code as ghpython_script
x = ClusterOutput(ghpython_script.x)
x_2 = ClusterOutput(ghpython_script_2.x)

# ==== cluster Cluster_2
value = ClusterInput()
A = ClusterInput()
curve = ClusterInput()
number = ClusterInput()
negative = Negative(Value=value)
extrat = Number(negative)
curve_2 = Curve(curve)
multiplication = Multiplication(A=A, B=2)
number_2 = Number(number)
bounding_box = BoundingBox(Content=curve_2, Plane=PlaneXY(0, 0, 0))  # -> Box, Box_2
flatoffset = Number(multiplication)
offset_curve = OffsetCurve(Curve=curve_2, Distance=extrat, Plane=PlaneXY(0, 0, 0), Corners=1)
deconstruct_box = DeconstructBox(Box=bounding_box.Box)  # -> Plane, X, Y, Z
deconstruct_domain = DeconstructDomain(Domain=deconstruct_box.Y)  # -> Start, End
extend_curve = ExtendCurve(Curve=offset_curve, Type=0, Start=extrat, End=extrat)
curve_3 = Curve(extend_curve)
bounding_box_2 = BoundingBox(Content=curve_3, Plane=PlaneXY(0, 0, 0))  # -> Box, Box_2
deconstruct_box_2 = DeconstructBox(Box=bounding_box_2.Box)  # -> Plane, X, Y, Z
deconstruct_domain_2 = DeconstructDomain(Domain=deconstruct_box_2.Y)  # -> Start, End
subtraction = Subtraction(A=deconstruct_domain_2.End, B=deconstruct_domain_2.Start)
subtraction_2 = Subtraction(A=deconstruct_domain.End, B=deconstruct_domain.Start)
subtraction_3 = Subtraction(A=number_2, B=subtraction_2)
subtraction_4 = Subtraction(A=number_2, B=subtraction)
negative_2 = Negative(Value=subtraction_4)
addition = Addition(A=deconstruct_domain.Start, B=number_2)
addition_2 = Addition(A=deconstruct_domain_2.Start, B=number_2)
addition_3 = Addition(A=addition, B=flatoffset)
addition_4 = Addition(A=addition_2, B=flatoffset)
merge = Merge(Data1=subtraction_3, Data2=negative_2)
negative_3 = Negative(Value=addition_4)
negative_4 = Negative(Value=addition_3)
result = ClusterOutput(merge)
unit_y = UnitY(Factor=negative_3)
unit_y_2 = UnitY(Factor=negative_4)
xy_plane = XYPlane(Origin=unit_y)
xy_plane_2 = XYPlane(Origin=unit_y_2)
negative_5 = Negative(Value=flatoffset)
rotate = Rotate(Geometry=xy_plane_2, Angle=3.141592654, Plane=PlaneXY(0, 0, 0))  # -> Geometry, Transform
ghpython_script = GhPythonScript(x=curve_3, y=xy_plane)  # -> p2p, x; inputs x: GeometryBase, y: Plane; same code as ghpython_script
flatoffset_2 = Number(negative_5)
ghpython_script_2 = GhPythonScript(x=curve_2, y=rotate.Geometry)  # -> p2p, x; inputs x: GeometryBase, y: Plane; same code as ghpython_script
extend_curve_2 = ExtendCurve(Curve=ghpython_script.x, Type=0, Start=flatoffset_2, End=flatoffset_2)
extend_curve_3 = ExtendCurve(Curve=ghpython_script_2.x, Type=0, Start=flatoffset_2, End=flatoffset_2)
curve_4 = ClusterOutput(extend_curve_3)
curve_5 = ClusterOutput(extend_curve_2)

# ==== cluster Feet_mesh
body_thickness = ClusterInput()
side_width = ClusterInput()
body_height = ClusterInput()
body_width = ClusterInput()
body_thickness_2 = Number(body_thickness)
side_width_2 = Number(side_width)
body_height_2 = Number(body_height)
body_width_2 = Number(body_width)
multiplication = Multiplication(A=side_width_2, B=2)
addition = Addition(A=side_width_2, B=body_width_2)
addition_2 = Addition(A=body_thickness_2, B=side_width_2)
addition_3 = Addition(A=multiplication, B=body_width_2)
dom = ConstructDomain(DomainStart=side_width_2, DomainEnd=addition)
multiplication_2 = Multiplication(A=body_width_2, B=0.5)
Z = UnitZ(Factor=side_width_2)
Z_2 = UnitZ(Factor=body_height_2)
R = ClusterOutput(addition_3)
addition_4 = Addition(A=multiplication_2, B=side_width_2)
rectangle = Rectangle(Plane=PlaneXY(0, 0, 0), XSize=addition_3, YSize=addition_2, Radius=0)  # -> Rectangle, Length
rectangle_2 = Rectangle(Plane=PlaneXY(0, 0, 0), XSize=dom, YSize=body_thickness_2, Radius=0)  # -> Rectangle, Length
neg = Negative(Value=addition_4)
move = Move(Geometry=rectangle_2.Rectangle, Motion=Z)  # -> Geometry, Transform
move_2 = Move(Geometry=rectangle_2.Rectangle, Motion=Z_2)  # -> Geometry, Transform
X = UnitX(Factor=neg)
divide = DivideCurve(Curve=rectangle.Rectangle, Count=1, Kinks=True)  # -> Points, Tangents, Parameters
divide_2 = DivideCurve(Curve=move.Geometry, Count=1, Kinks=True)  # -> Points, Tangents, Parameters
divide_3 = DivideCurve(Curve=move_2.Geometry, Count=1, Kinks=True)  # -> Points, Tangents, Parameters
merge = Merge(Data1=divide.Points, Data2=divide_2.Points, Data3=divide_3.Points)
merge_2 = Merge(Data1=rectangle.Rectangle, Data2=move.Geometry, Data3=move_2.Geometry)
loft = Loft(Curves=merge_2, Options={Adjust=False, Closed=False, LoftEnds=0, LoftSimp=0, LoftType=3, Rebuild=10, Refit=0.01})
python = GhPythonScript(x=merge)  # -> out, msh; inputs x: list of Point3d
# ---------- python: Python ----------
from Rhino.Geometry import Mesh

msh = Mesh()
[msh.Vertices.Add(pt) for pt in x]

for i in range(4):
    msh.Faces.AddFace(i, (i+1) % 4, 4 + (i+1) % 4, 4 + i)
    msh.Faces.AddFace(4 + i, 4 + (i+1) % 4, 8 + (i+1) % 4, 8 + i)

a, b, c, d = tuple(range(4))
msh.Faces.AddFace(d, c, b, a)
msh.Faces.AddFace(8+a, 8+b, 8+c, 8+d)
# ---------- end python ----------
cap = CapHoles(Brep=loft)
move_3 = Move(Geometry=python.msh, Motion=X)  # -> Geometry, Transform
unifynormals = MeshUnifyNormals(Mesh=python.msh)
move_4 = Move(Geometry=cap, Motion=X)  # -> Geometry, Transform
G = ClusterOutput(move_3.Geometry)
G_2 = ClusterOutput(move_4.Geometry)
