# Grasshopper definition PatternOverlay_fitted.gh (Grasshopper 1.0.7)
# plug-ins: Weaverbird

number_slider = Slider(120, range=0..250)
number_slider_2 = Slider(10, range=0..10)
number_slider_3 = Slider(2, range=0..10)
unit_z = UnitZ(Factor=number_slider)
division = Division(A=number_slider, B=2)
negative = Negative(Value=division)
addition = Addition(A=number_slider_3, B=1)
domain = Domain()
division_2 = Division(A=number_slider, B=addition)
weaverbird_s_mesh_prism = WeaverbirdsMeshPrism(
    Plane=PlaneXY(0, 0, 0),
    Width=division,
    NumberOfSides=Slider(4, range=0..10),
    TopPoint=unit_z,
    BasePolygonMethod=True,
    FillStrategy=1)
bounding_box = BoundingBox(Content=weaverbird_s_mesh_prism, Plane=PlaneXY(0, 0, 0))  # -> Box, Box_2
deconstruct_box = DeconstructBox(Box=bounding_box.Box)  # -> Plane, X, Y, Z
rectangle = Rectangle(Plane=deconstruct_box.Plane, XSize=deconstruct_box.X, YSize=deconstruct_box.Y, Radius=0)  # -> Rectangle, Length
divide_curve = DivideCurve(Curve=rectangle.Rectangle, Count=1, Kinks=True)  # -> Points, Tangents, Parameters
number_slider_4 = Slider(3, range=0..10)
shift_list = ShiftList(List=divide_curve.Points, Shift=1, Wrap=True)
dom = ConstructDomain(DomainStart=negative, DomainEnd=division)
number_slider_5 = Slider(35, range=0..100)
line = Line(StartPoint=divide_curve.Points, EndPoint=shift_list)
box = DomainBox(Base=PlaneXY(0, 0, 0), X=dom, Y=dom, Z=number_slider)
series = Series(Start=division_2, Step=division_2, Count=number_slider_3)
weaverbird_s_constant_quads_split_subdiv = WeaverbirdsConstantQuadsSplitSubdivision(MeshCurves=weaverbird_s_mesh_prism, Level=Slider(3, range=0..10), SmoothNakedEdges=0)
multiplication = Multiplication(A=number_slider, B=Slider(1, range=0..10))
domain_2 = Domain(Domain(0, 1))
point = Point(Point(0, 0, 0))
subtraction = Subtraction(A=number_slider_4, B=1)
negative_2 = Negative(Value=number_slider_5)
shift_list_2 = ShiftList(List=line, Shift=1, Wrap=True)
negative_3 = Negative(Value=division)
negative_4 = Negative(Value=division)
unit_z_2 = UnitZ(Factor=series)
split_list = SplitList(List=shift_list_2, Index=Slider(1, range=0..1))  # -> ListA, ListB
series_2 = Series(Start=1, Step=1, Count=subtraction)
line_2 = Line(split_list.ListB)
crvdom = CurveDomain(Curve=line_2, Domain=domain_2)  # -> Curve, Domain
division_3 = Division(A=series_2, B=number_slider_4)
weaverbird_s_constant_quads_split_subdiv_2 = WeaverbirdsConstantQuadsSplitSubdivision(MeshCurves=weaverbird_s_constant_quads_split_subdiv, Level=Slider(2, range=0..10), SmoothNakedEdges=0)
unit_x = UnitX(Factor=division)
unit_x_2 = UnitX(Factor=negative_4)
unit_y = UnitY(Factor=division)
unit_y_2 = UnitY(Factor=negative_3)
number_slider_6 = Slider(45, range=0..100)
number_slider_7 = Slider(15, range=0..100)
number_slider_8 = Slider(25.01, range=0..100)
subtraction_2 = Subtraction(A=division_3, B=0.5)
number_slider_9 = Slider(15, range=0..100)
number_slider_10 = Slider(10, range=0..100)
multiplication_2 = Multiplication(A=Slider(1.5, range=0..10), B=subtraction_2)
yz_plane = YZPlane(Origin=unit_x)
yz_plane_2 = YZPlane(Origin=unit_x_2)
xz_plane = XZPlane(Origin=unit_y)
xz_plane_2 = XZPlane(Origin=unit_y_2)
addition_2 = Addition(A=multiplication_2, B=Slider(0.65, range=0..1))
eval = EvaluateCurve(Curve=graft(crvdom.Curve), Parameter=addition_2)  # -> flatten(Point), Tangent, Angle
addition_3 = Addition(A=graft(eval.Point), B=unit_z_2)
deconstruct = Deconstruct(Point=addition_3)  # -> XComponent, YComponent, ZComponent
line_3 = Line(StartPoint=addition_3, EndPoint=point)
length = Length(Curve=line_3)
division_4 = Division(A=length, B=multiplication)
multiplication_3 = Multiplication(A=deconstruct.ZComponent, B=division_4)
vector_xyz = VectorXYZ(XComponent=deconstruct.XComponent, YComponent=deconstruct.YComponent, ZComponent=multiplication_3)  # -> Vector, Length
line_4 = Line()
mesh = Mesh(weaverbird_s_constant_quads_split_subdiv_2)
merge = Merge(Data1=number_slider_7, Data2=number_slider_7, Data3=number_slider_7)
number_slider_11 = Slider(25, range=0..100)
point_2 = Point(vector_xyz.Vector)
unit_vector = UnitVector(Vector=point_2)
multiplication_4 = Multiplication(A=number_slider_5, B=unit_vector)
multiplication_5 = Multiplication(A=negative_2, B=unit_vector)
addition_4 = Addition(A=addition_3, B=multiplication_4)
addition_5 = Addition(A=addition_3, B=multiplication_5)
deconstruct_mesh = DeconstructMesh(Mesh=mesh)  # -> Vertices, Faces, Colours, Normals
number_slider_12 = Slider(25, range=0..100)
line_5 = Line(StartPoint=addition_4, EndPoint=addition_5)
merge_2 = Merge(Data1=number_slider_9, Data2=number_slider_9, Data3=number_slider_9)
merge_3 = Merge(Data1=number_slider_10, Data2=number_slider_10, Data3=number_slider_10)
value_list = ValueList({"x", "y"}, selected="x")
pipe = Pipe(Curve=line_5, Radius=Slider(11, range=0..25), Caps=2)
number_slider_13 = Slider(7.5, range=0..100)
value_list_2 = ValueList({"x", "y"}, selected="x")
value_list_3 = ValueList({"x", "y"}, selected="x")
ghpython_script = GhPythonScript(
    pts=deconstruct_mesh.Vertices,
    direction=value_list,
    scales=merge,
    isoplane=Slider(60, range=-100..100),
    amplitude=Slider(60, range=-100..250),
    dir_b=Toggle(False),
    w=number_slider_11)  # -> out, pts; inputs pts: list of Point3d, scales: list, dir_b: Boolean
# ---------- ghpython_script: Python ----------
import sys

sys.path.append("/Users/jonas/Documents/reps/rrreefs_coral_feet/grasshopper/patterns/")

import patterns as pat

reload(pat)

pts = pat.move_pts(pts, pat.uv_gyroid, direction, dir_b, isoplane, amplitude, w, scales)
# ---------- end ghpython_script ----------
merge_4 = Merge(Data1=number_slider_12, Data2=number_slider_12, Data3=number_slider_12)
brep = Brep(flatten(pipe))
lng = ListLength(List=brep)
subtraction_3 = Subtraction(A=lng, B=number_slider_3)
ghpython_script_2 = GhPythonScript(
    pts=deconstruct_mesh.Vertices,
    direction=value_list_2,
    scales=merge_2,
    isoplane=Slider(60, range=-100..100),
    amplitude=Slider(60, range=-100..250),
    dir_b=Toggle(False),
    w=number_slider_11)  # -> out, pts; inputs pts: list of Point3d, scales: list, dir_b: Boolean
# ---------- ghpython_script_2: Python ----------
import sys

sys.path.append("/Users/jonas/Documents/reps/rrreefs_coral_feet/grasshopper/patterns/")

import patterns as pat

reload(pat)

pts_b = pat.move_pts(pts, pat.uv_gyroid, direction, dir_b, isoplane, amplitude, w, scales)
pts_a = pat.move_pts(pts, pat.uv_gyroid, direction, dir_b, isoplane, 20., w, (7.5,7.5,7.5))

pts = [(pts_b[i] + pt_a)*.5 for i, pt_a in enumerate(pts_a)]
# ---------- end ghpython_script_2 ----------
ghpython_script_3 = GhPythonScript(
    pts=ghpython_script.pts,
    direction=value_list_3,
    scales=merge_3,
    isoplane=Slider(-60, range=-100..100),
    amplitude=Slider(30, range=-100..250),
    dir_b=Toggle(True),
    w=Slider(31.765, range=0..100))  # -> out, pts; inputs pts: list of Point3d, scales: list, dir_b: Boolean; same code as ghpython_script
merge_5 = Merge(Data1=number_slider_13, Data2=number_slider_13, Data3=number_slider_13)
value_list_4 = ValueList({"x", "y"}, selected="y")
split = SplitList(List=brep, Index=subtraction_3)  # -> ListA, ListB
brep_2 = Brep(flatten(split.ListA))
panel = Panel(ghpython_script.out)
value_list_5 = ValueList({"x", "y"}, selected="y")
construct_mesh = ConstructMesh(Vertices=ghpython_script_3.pts, Faces=deconstruct_mesh.Faces)
ghpython_script_4 = GhPythonScript(
    pts=ghpython_script_3.pts,
    direction=value_list_4,
    scales=merge_4,
    isoplane=Slider(60, range=-100..100),
    amplitude=Slider(15, range=-100..250),
    dir_b=Toggle(False),
    w=Slider(31.765, range=0..100))  # -> out, pts; inputs pts: list of Point3d, scales: list, dir_b: Boolean; same code as ghpython_script
number_slider_14 = Slider(10, range=0..10)
number_slider_15 = Slider(5, range=0..10)
ghpython_script_5 = GhPythonScript(
    pts=ghpython_script_4.pts,
    direction=value_list_5,
    scales=merge_5,
    isoplane=Slider(-60, range=-100..100),
    amplitude=Slider(15, range=-100..250),
    dir_b=Toggle(True),
    w=Slider(31.765, range=0..100))  # -> out, pts; inputs pts: list of Point3d, scales: list, dir_b: Boolean; same code as ghpython_script
construct_mesh_2 = ConstructMesh(Vertices=ghpython_script_5.pts, Faces=deconstruct_mesh.Faces)
mesh_2 = Mesh(weaverbird_s_mesh_prism)
demesh = DeconstructMesh(Mesh=construct_mesh)  # -> Vertices, Faces, Colours, Normals
mesh_3 = Mesh(brep_2)
weaverbird_s_catmull_clark_subdivision = WeaverbirdsCatmullClarkSubdivision(MeshCurves=construct_mesh_2, Level=1, SmoothNakedEdges=1)
mesh_4 = Mesh(construct_mesh_2)
pdecon = Deconstruct(Point=demesh.Vertices)  # -> XComponent, YComponent, ZComponent
flatten_tree = FlattenTree(Tree=mesh_3, Path="{0}")
division_5 = Division(A=pdecon.YComponent, B=number_slider_15)
division_6 = Division(A=pdecon.ZComponent, B=number_slider_15)
division_7 = Division(A=pdecon.XComponent, B=number_slider_15)
mesh_difference = MeshDifference(MeshesA=weaverbird_s_catmull_clark_subdivision, MeshesB=flatten_tree)
expression = Expression(u=division_6, v=division_5, w=division_7, Expression="( sin(u) * cos(v) + sin(v) * cos(w) + sin(w) * cos(u) ) / 3.0")
multiplication_6 = Multiplication(A=expression, B=Slider(10, range=0..10))
multiplication_7 = Multiplication(A=demesh.Normals, B=multiplication_6)
addition_6 = Addition(A=demesh.Vertices, B=multiplication_7)
python = GhPythonScript(pts=addition_6, spacing=Slider(60, range=0..100))  # -> out, pts; inputs pts: list of Point3d
# ---------- python: Python ----------
z_space = spacing * 2.

for pt in pts:
    pt.X = -spacing if pt.X<-spacing else pt.X
    pt.X = spacing if pt.X>spacing else pt.X
    
    pt.Y = -spacing if pt.Y<-spacing else pt.Y
    pt.Y = spacing if pt.Y>spacing else pt.Y
    
    pt.Z = 0 if pt.Z<0 else pt.Z
    pt.Z = z_space if pt.Z>z_space else pt.Z
# ---------- end python ----------
construct_mesh_3 = ConstructMesh(Vertices=python.pts, Faces=deconstruct_mesh.Faces)
wbcatmullclark = WeaverbirdsCatmullClarkSubdivision(MeshCurves=construct_mesh_3, Level=1, SmoothNakedEdges=1)
larger = LargerThan(SecondNumber=0)  # -> LargerThan, OrEqualTo
